vi "802.11 Host.gvi"   [LabVIEW Communications System Design Suite 2.0.1]
# Queues pseudorandom number data to send the queue at the specified packet rate. The node ensures that the average packet rate is met even if it is not called in a regular time interval.
panel controls:
  "Trigger TX": bool
  "Clear events": bool
  "Operation Mode": T2 = "RF Loopback"
  "Primary Subband": UFXP(2.0) = 1
  "Transmit IP Address": string = "127.0.0.1"
  "Transmit Port": u16 = 12346
  "Receive Port": u16 = 12345
  "Tab": i32
  "Power Level [dBm]": f64
  "TX Frequency [Hz]": f64 = 2437000000
  "Destination MAC Address": u8[6] = [71, 111, 75, 117, 109, 98]
  "Device MAC Address": u8[6] = [71, 111, 75, 117, 109, 97]
  "TX Port (USRP only)": enum{"TX1/RF 0", "TX1/RF 1"} = "TX1/RF 0"
  "RX Port (USRP only)": T3 = "RX2/RF 1"
  "AGC": bool = TRUE
  "Manual RX gain [dB]": f64 = 37.5
  "PN Data Packet Size": i32 = 1024
  "Subcarrier Format": i32 = "20 MHz (IEEE 802.11 a)"(0)
  "Stop": bool
  "RIO Device": string = "RIO0"
  "Station": bool
  "reset TX staistics": bool
  "reset RX staistics": bool
  "PN Packets per Second": u32 = 1000
  "Transmit ACK": bool = TRUE
  "Backoff": u16 = 4
  "All": bool
  "None": bool
  "Events to Track": T5
  "CCA Energy Detection Threshold [dBm]": FXP(10.3) = -72
  "MCS": UFXP(4.0) = 4
  "session": "802.11 Host Session.gtype"
  "Data Source Option": i32 = 1
  "Data Sink Options": i32
  "Data Source": enum{"UDP", "PN Data", "Manual", "Multi-stream"} = "PN Data"
  "Data Sink": enum{"Off", "UDP"} = "Off"
  "Reference Clock": string = "Internal"
  "USRP bandwidth": "USRP bandwidth.gtype" = "40 MHz"
  "PN Data Packet Size_1": i32 = 1024
  "PN Packets per Second_1": u32 = 1000
  "PN Data Packet Size_2": i32 = 1024
  "PN Packets per Second_2": u32 = 1000
  "PN Data Packet Size_3": i32 = 1024
  "PN Packets per Second_3": u32 = 1000
  "PN Data Packet Size_4": i32 = 1024
  "PN Packets per Second_4": u32 = 1000
  "PN Data Packet Size_5": i32 = 1024
  "PN Packets per Second_5": u32 = 1000
  "time to wait for decoding packet(0.1us)": u32
panel indicators:
  "Events": string
  "MAC TX Statistic": T1
  "Baseband Power": f64
  "Coerced LO frequency TX [Hz]": f64
  "Coerced LO frequency RX [Hz]": f64
  "Channel Estimation": cluster{"Element 1": i32[], "Element 2": f64[]}[]
  "TX Block Error Rate": f64
  "Coerced Power Level [dBm]": f64
  "RX Throughput": f64
  "Applied RX Gain [dB]": f64
  "RX Throughput [bits/s]": f64
  "Current TX Block Error Rate (BLER)": f64
  "RX Frequency [Hz]": f64
  "Overwritten by Device MAC Address": bool
  "Station Active": bool
  "Device Ready": bool
  "Baseband RX Power [dBFS]": f64
  "RX Constellation": c128[]
  "RX Power Spectrum": T4
  "TX Power Spectrum": T4
  "Data Transfer": bool
  "FIFO Full": bool
  "FIFO Full": bool
  "Data Transfer": bool
  "Compensated CFO [Hz]": f64
  "TX Data Dropped": bool
  "modulation and coding rate": string
  "MAC RX Statistic": T10
  "Target FIFO Overflow": bool
  "RF Input Power": f64[][]
types:
  T1 = cluster{"TX after SIFS Requests Detected": u32, "TX after SIFS Requests Completed": u32, "TX after Backoff Requests Detected": u32, "TX after Backoff Requests Completed": u32}
  T2 = enum{"Baseband Loopback", "RF Loopback", "RF Multi Station"}
  T3 = enum{"RX1/RF 0", "RX2/RF 0", "RX1/RF 1", "RX2/RF 1"}
  T4 = cluster{"f0": f64, "df": f64, "magnitude": f64[]}
  T5 = cluster{"PhyTxStart": bool, "PhyTxEnd": bool, "PhyRxStart": bool, "PhyRxEnd": bool, "MacChannelState": bool, "MacTxStatus": bool, "PhyCcaTiming": bool, "PhyCcaTiming_2": bool, "PhyCcaTiming_3": bool}
  T6 = cluster{"Timestamp": u32, "Transferred Bytes": u32}
  T7 = cluster{"fpga ref": any, "bus instance": u32, "instruction FIFO depth": u32, "executing on FPGA target": bool, "show error call chain": bool}
  T8 = cluster{"Actual Gain [dB]": f64, "Attenuation Table Index": i32}
  T9 = cluster{"Attenuation Table [dB]": f64[][], "Frequencies [Hz]": f64[], "IQ Imbalance Table": "niUsrpRio Config v1 Host.lvlib__IQ Imbalance.gtype"[], "Gain Table": T8[][]}
  "niInstr Register Bus v0 Host.lvlib__Register Bus Session.gtype" = Queue<"niInstr Register Bus v0 Host.lvlib__Session Data.gtype">
  "Semaphore RefNum.gtype" = i32
  "niUsrpRio Config v1 Host.lvlib__DB Queue Reference.gtype" = Queue<"niUsrpRio Config v1 Host.lvlib__Daughterboard Data.gtype">
  "niUsrpRio Config v1 Host.lvlib__niUsrpRio Session.gtype" = cluster{"FPGA Interface": any, "RIO Interface Number": u32, "Data Clock Rate": u32, "FPGA Data Clock Rate": u32, "Global Settings Register Bus": "niInstr Register Bus v0 Host.lvlib__Register Bus Session.gtype", "Radio 0 Settings Register Bus": "niInstr Register Bus v0 Host.lvlib__Register Bus Session.gtype", "Radio 1 Settings Register Bus": "niInstr Register Bus v0 Host.lvlib__Register Bus Session.gtype", "Radio Settings Bus Semaphore": "Semaphore RefNum.gtype", "DB Queues": "niUsrpRio Config v1 Host.lvlib__DB Queue Reference.gtype"[], "Characterization Data Valid?": bool, "EEPROM Header": "niUsrpRio Config v1 Host.lvlib__EEPROM Header.gtype", "Device Data Header": "niUsrpRio Config v1 Host.lvlib__EEPROM Device Data Header.gtype", "EEPROM Characterization Header": "niUsrpRio Config v1 Host.lvlib__EEPROM Characterization Header.gtype", "Characterization Data": "niUsrpRio Config v1 Host.lvlib__Characterization Data.gtype"[], "FPGA Current Version": u32, "FPGA Oldest Compatible Version": u32, "Fixed Logic Current Version": u32, "Fixed Logic Oldest Compatible Version": u32, "FPGA Radio Settings Bus Current Version": u32, "FPGA Radio Settings Bus Oldest Compatible Version": u32, "FPGA Board Config Current Version": u32, "FPGA Board Config Oldest Compatible Version": u32, "Daughterboard Clock Rate": u32}
  "802.11 Host Session.gtype" = cluster{"FPGA interface": "802.11 FGPA Reference.gtype", "send queue": Queue<u8[]>, "receive queue": Queue<u8[]>, "receive throughput queue": Queue<T6>, "UDP Receiver": UdpNetworkConnectionRefnum, "PN packet": u8[], "FlexRIO session": Queue<T7>, "FlexRIO TX Characterization Data": T9, "FlexRIO RX Characterization Data": T9, "USRP session": "niUsrpRio Config v1 Host.lvlib__niUsrpRio Session.gtype", "RF loop clock frequency": f64}
  T10 = cluster{"Packet Starts detected": u32, "Frames from PHY": u32, "Frames with FCS pass": u32, "ACKs Received": u32}
  "USRP bandwidth.gtype" = enum{"40 MHz", "120 MHz", "160 MHz"}
  T11 = cluster{"TX after SIFS requests detected": u32, "TX after SIFS requests completed": u32, "TX after backoff requests detected": u32, "TX after backoff requests completed": u32}
  T12 = cluster{"Frames detected": u32, "Subframes received": u32, "Valid subframes received": u32, "ACKs received": u32}
  T13 = cluster{"PhyTxStart": bool, "PhyTxEnd": bool, "PhyRxStart": bool, "PhyRxEnd": bool, "MacChannelState": bool, "MacTxStatus": bool, "PhyCcaTiming": bool, "PhyRxGainChange": bool, "PhyRxAGCStateChange": bool}
  T14 = cluster{"remove header": bool, "block unsupported frame types": bool, "block FCS errors": bool, "block address mismatch": bool, "block header recognize error": bool}
diagram:
  sequence {
    frame 0 {
      $Events <- EmptyString
      $"Device Ready" <- FALSE
      $"Station Active" <- FALSE
      $Station <- FALSE
      $"RX Constellation" <- c128[] []
      $"RX Power Spectrum" <- T4 {all zero or empty}
      $"TX Power Spectrum" <- T4 {all zero or empty}
      $"Channel Estimation" <- cluster{"Element 1": i32[], "Element 2": f64[]}[] []
      $"MAC TX Statistic" <- T11 {all zero or empty}
      $"MAC RX Statistic" <- T12 {all zero or empty}
      $"Current TX Block Error Rate (BLER)" <- 0
      $"RX Throughput [bits/s]" <- 0
      $"Compensated CFO [Hz]" <- 0
      for (N = 51) {
        $"RX Throughput" <- NaN
        $"TX Block Error Rate" <- NaN
        $"Baseband Power" <- NaN
      }
      Initialize Array(element=NaN, size=51, size=2) -> w1
      $"RF Input Power" <- w1
    }
  }
  call "Create Stop Notifier.gvi"(error in=no error) -> (error out=w2)
  call "802.11 Host Init.gvi"(device=$"RIO Device", error in=w2, reference clock=$"Reference Clock", USRP bandwidth=$"USRP bandwidth") -> (session out=w3, error out=w4)
  # 2017/08/18 Yue
  # These session contains five parts of send queue.
  case (w4) {
    frame Error {
      w5 = w4
    }
    frame No Error {
      $"Device Ready" <- TRUE
      $session <- w3
      w5 = w4
    }
  }
  while {
    call "802.11 Unbundle Session.gvi"(session=$session) -> (FPGA interface=w6)
    call "Configure FPGA MAC.gvi"(FPGA Interface In=w6, Error in=w5, time to wait for decoding packet=$"time to wait for decoding packet(0.1us)") -> (Error Out=w7)
    call "Check Stop.gvi"(error in=w7) -> (error out=w8, stop=w9)
    stop if w9
  }
  call "Stop On Error.gvi"(error in=w8) -> (error out=w10)
  s1 = w5  # shift register
  while {
    Feedback Node(input=$"Station Active") -> w11
    Is Not Equal(x=$"Station Active", y=w11) -> w12
    # update plots and indicators (fast)
    case ($"Station Active") {
      frame False, Default {
        w13 = s1
      }
      frame True {
        call "802.11 Unbundle Session.gvi"(session=$session) -> (FPGA interface=w14, receive throughput queue=w15)
        call "802.11 Prepare Throughput Measurements.gvi"(reset=w12, FPGA interface=w14, receive throughput queue=w15, error in=s1, timing granularity=100) -> (error out=w13, TX block error rate=w16, RX throughput=w17)
        $"Current TX Block Error Rate (BLER)" <- w16
        $"TX Block Error Rate" <- w16
        $"RX Throughput [bits/s]" <- w17
        Divide(x=w17, y=1000000) -> w18
        $"RX Throughput" <- w18
      }
    }
    call "Check Stop.gvi"(error in=w13) -> (error out=w19, stop=w20)
    Wait Until Next Multiple(multiple to wait=100)
    next s1 = w19
    stop if w20
  }
  call "Stop On Error.gvi"(error in=s1) -> (error out=w21)
  s2 = w5  # shift register
  while {
    # RX Reception
    call "802.11 Unbundle Session.gvi"(session=$session) -> (FPGA interface=w22, receive queue=w23, receive throughput queue=w24)
    call "802.11 Receive RX ICP.gvi"(FPGA interface=w22, error in=s2, receive queue=w23, receive throughput queue=w24, enqueue decoded data=$"Station Active") -> (error out=w25)
    call "Check Stop.gvi"(error in=w25) -> (error out=w26, stop=w27)
    Wait Until Next Multiple(multiple to wait=0)
    next s2 = w26
    stop if w27
  }
  call "Stop On Error.gvi"(error in=s2) -> (error out=w28)
  s3 = w5  # shift register
  s4 = string[] []  # shift register
  while {
    call "802.11 Unbundle Session.gvi"(session=$session) -> (FPGA interface=w29)
    call "802.11 Prepare Constellation.gvi"(FPGA interface=w29, error in=s3, maximal number of subcarriers=4800) -> (error out=w30, data field constellation=w31, update constellation=w32)
    # update plots and indicators (slow)
    Logical And($"Station Active", w32) -> w33
    case (w33) {
      frame False { }
      frame True {
        $"RX Constellation" <- w31
      }
    }
    call "802.11 Read Event FIFO.gvi"(FPGA interface=w29, error in=s3) -> (raw events=w34, error out=w35)
    call "802.11 Prepare RX Power Spectrum.gvi"(FPGA interface=w29, error in=s3) -> (error out=w36, RX power spectrum=w37, update power spectrum=w38)
    call "802.11 Prepare TX Power Spectrum.gvi"(FPGA interface=w29, error in=s3) -> (error out=w39, TX power spectrum=w40, update power spectrum=w41)
    call "802.11 Prepare Channel Estimation.gvi"(FPGA interface=w29, error in=s3, channel subband=$"Primary Subband", subcarrier format=$"Subcarrier Format") -> (error out=w42, channel estimation=w43, update power spectrum=w44)
    call "802.11 Read Target Registers.gvi"(FPGA interface=w29, error in=s3) -> (error out=w45, target FIFO overflow=w46, compensated CFO=w47, RF input power=w48, MAC RX statistics=w49, MAC TX statistics=w50, signal power at packet start=w51)
    Merge Errors(w30, w36, w39, w42, w45, w35) -> (error out=w52)
    call "Check Stop.gvi"(error in=w52) -> (error out=w53, stop=w54)
    Logical And($"Station Active", w38) -> w55
    case (w55) {
      frame False, Default { }
      frame True {
        $"RX Power Spectrum" <- w37
      }
    }
    Logical And($"Station Active", w41) -> w56
    case (w56) {
      frame False, Default { }
      frame True {
        $"TX Power Spectrum" <- w40
      }
    }
    Logical And($"Station Active", w44) -> w57
    case (w57) {
      frame False, Default { }
      frame True {
        $"Channel Estimation" <- w43
      }
    }
    $"Target FIFO Overflow" <- w46
    $"Compensated CFO [Hz]" <- w47
    $"RF Input Power" <- w48
    $"Baseband Power" <- w51
    $"MAC RX Statistic" <- w49
    $"MAC TX Statistic" <- w50
    call "802.11 Events to String.gvi"(event data=w34, events to track=$"Events to Track") -> (event strings=w58)
    for {
      w59 = each element of w58
      Match Pattern(regular expression="PhyRxStart.ind ", string=w59) -> (offset past match=w61)
      Is Not Equal(x=w61, y=-1) -> w62
      append w62 to w60
    }
    Or Array Elements(Boolean array=w60)
    w63 = -12  # CFX data type offset
    Add(w51, w63) -> w64
    $"Baseband RX Power [dBFS]" <- w64
    Build Array[ConcatenateInputs=True](s4, w58) -> w65
    Delete From Array(inArray=w65, length (1)=10000) -> (deleted=w66)
    Select(s=$"Clear events", t=string[] [], f=w66) -> w67
    Concatenate Strings(w66) -> w68
    $Events <- w68
    Select(s=$None, t=T13 {all zero or empty}, f=$"Events to Track") -> w69
    w70 = T13 {"PhyTxStart"=TRUE, "PhyTxEnd"=TRUE, "PhyRxStart"=TRUE, "PhyRxEnd"=TRUE, "MacChannelState"=TRUE, "MacTxStatus"=TRUE, "PhyCcaTiming"=TRUE, "PhyRxGainChange"=TRUE, "PhyRxAGCStateChange"=TRUE}
    Select(s=$All, t=w70, f=w69) -> w71
    $"Events to Track" <- w71
    Wait Until Next Multiple(multiple to wait=250)
    next s3 = w53
    next s4 = w67
    stop if w54
  }
  call "Stop On Error.gvi"(error in=s3) -> (error out=w72)
  Udp Open(error in=w5, net address=0, port=0, service name="", timeout ms=25000) -> (connection ID=w73, error out=w74)
  call "Set Socket Option.gvi"(connection in=w73, level=0xFFFF, option name=0x1001, value=1024000, error in=w74) -> (error out=w75, connection out=w76)
  s5 = w75  # shift register
  s6 = w76  # shift register
  while {
    call "802.11 Unbundle Session.gvi"(session=$session) -> (send queue_1=w77, send queue_5=w78, receive queue=w79, send queue_2=w80, UDP receiver=w81, PN packet=w82, send queue_3=w83, send queue_4=w84)
    # UDP send and receive
    case ($"Station Active") {
      frame False, Default {
        w85 = s5
        w86 = s6
      }
      frame True {
        # 2017/08/18 Yue
        # when we use the data source as PN data/
        # UDP/Manual, only use the send quene_1
        Array Subset(array=w82, length0=$"PN Data Packet Size_1") -> w87
        Array Subset(array=w82, length0=$"PN Data Packet Size_2") -> w88
        Array Subset(array=w82, length0=$"PN Data Packet Size_3") -> w89
        Array Subset(array=w82, length0=$"PN Data Packet Size_4") -> w90
        Array Subset(array=w82, length0=$"PN Data Packet Size_5") -> w91
        Array Subset(array=w82, length0=$"PN Data Packet Size") -> w92
        case ($"Data Source") {
          frame "UDP" {
            # UDP
            call "802.11 Receive UDP Data.gvi"(UDP receiver=w81, send queue=w77, error in=s5) -> (data transfer=w94, error out=w93, FIFO full=w99)
            $"FIFO Full" <- w99
            w95 = default
            w96 = default
            w97 = default
            w98 = default
          }
          frame "PN Data" {
            # PN data
            call "802.11 Send PN Data.gvi"(PN packets per second=$"PN Packets per Second", send queue=w77, PN data=w92, error in=s5) -> (data transfer=w94, error out=w93)
            w95 = default
            w96 = default
            w97 = default
            w98 = default
          }
          frame "Manual", Default {
            # Manual
            case ($"Trigger TX") {
              frame False, Default {
                w93 = s5
                w94 = $"Trigger TX"
              }
              frame True {
                Enqueue Element(element=w92, error in=s5, queue=w77, timeout in ms=-1) -> (error out=w93, queue out=w100)
                w94 = $"Trigger TX"
              }
            }
            w95 = default
            w96 = default
            w97 = default
            w98 = default
          }
          frame "Multi-stream" {
            case ($"Data Source") {
              frame "UDP", Default {
                w93 = s5
                w94 = FALSE
              }
              frame "PN Data" {
                # PN data
                call "802.11 Send PN Data.gvi"(PN packets per second=$"PN Packets per Second_1", send queue=w77, PN data=w87, error in=s5) -> (data transfer=w94, error out=w93)
              }
            }
            case ($"Data Source") {
              frame "UDP", Default {
                w95 = s5
              }
              frame "PN Data" {
                # PN data
                call "802.11 Send PN Data.gvi"(PN packets per second=$"PN Packets per Second_2", send queue=w80, PN data=w88, error in=s5) -> (error out=w95)
              }
            }
            case ($"Data Source") {
              frame "UDP", Default {
                w96 = s5
              }
              frame "PN Data" {
                # PN data
                call "802.11 Send PN Data.gvi"(PN packets per second=$"PN Packets per Second_3", send queue=w83, PN data=w89, error in=s5) -> (error out=w96)
              }
            }
            case ($"Data Source") {
              frame "UDP", Default {
                w97 = s5
              }
              frame "PN Data" {
                # PN data
                call "802.11 Send PN Data.gvi"(PN packets per second=$"PN Packets per Second_4", send queue=w84, PN data=w90, error in=s5) -> (error out=w97)
              }
            }
            case ($"Data Source") {
              frame "UDP", Default {
                w98 = s5
              }
              frame "PN Data" {
                # PN data
                call "802.11 Send PN Data.gvi"(PN packets per second=$"PN Packets per Second_5", send queue=w78, PN data=w91, error in=s5) -> (error out=w98)
              }
            }
          }
        }
        $"Data Transfer" <- w94
        Is Equal(x=$"Data Sink", y="UDP") -> w101
        call "802.11 Send UDP Data.gvi"(target port=$"Transmit Port", target IP address=$"Transmit IP Address", receive queue=w79, UDP sender=s6, enable=w101, error in=s5) -> (FIFO full=w102, error out=w103, UDP sender dup=w86, data transfer=w104)
        Merge Errors(w93, w95, w96, w97, w98, w103) -> (error out=w85)
        $"Data Transfer" <- w104
        $"FIFO Full" <- w102
      }
    }
    call "Check Stop.gvi"(error in=w85) -> (error out=w105, stop=w106)
    Wait Until Next Multiple(multiple to wait=0)
    next s5 = w105
    next s6 = w86
    stop if w106
  }
  call "Stop On Error.gvi"(error in=s5) -> (error out=w107)
  Udp Close(connection ID=s6, error in=w107) -> (error out=w108)
  s7 = w5  # shift register
  while {
    call "802.11 Unbundle Session.gvi"(session=$session) -> (FPGA interface=w109, send queue_1=w110, send queue_5=w111, send queue_2=w112, send queue_3=w113, send queue_4=w114)
    w115 = $"Device MAC Address"
    w116 = $"Operation Mode"
    w117 = $"Destination MAC Address"
    w118 = $"Subcarrier Format"
    # 2017/08/18 Yue
    # The only different between the input of these
    # five steams is the different payload, it is
    # from different queues.
    # TX transmission
    w119 = $MCS
    w120 = $"Station Active"
    while {
      Dequeue Element(error in=s7, queue=w112, timeout in ms=0) -> (element=w121, error out=w122, timed out?=w123)
      Logical And(w120, not w123) -> w124
      case (w124) {
        frame False {
          w125 = w122
          w126 = default
          w127 = default
        }
        frame True {
          call "802.11 Subcarrier Format to Configuration.gvi"(MCS=w119, subcarrier format=w118, error in=w122) -> (error out=w128, format=w129, bandwidth=w130, valid configuration=w131)
          Is Not Equal(x=w116, y="RF Multi Station") -> w127
          Select(s=w127, t=w115, f=w117) -> w132
          case (w131) {
            frame False, Default {
              w126 = FALSE
              w125 = w128
            }
            frame True {
              call "802.11 Send TX ICP_2.gvi"(FPGA interface=w109, MCS=w119, device MAC address=w115, error in=w128, destination MAC address=w132, payload=w121, format=w129, bandwidth=w130) -> (dropped?=w126, error out=w125)
            }
          }
        }
      }
      call "Check Stop.gvi"(error in=w125) -> (error out=w133, stop=w134)
      Logical Or(w134, w123) -> w135
      stop if w135
    }
    while {
      Dequeue Element(error in=s7, queue=w113, timeout in ms=0) -> (element=w136, error out=w137, timed out?=w138)
      Logical And(w120, not w138) -> w139
      case (w139) {
        frame False {
          w140 = w137
          w141 = default
          w142 = default
        }
        frame True {
          call "802.11 Subcarrier Format to Configuration.gvi"(MCS=w119, subcarrier format=w118, error in=w137) -> (error out=w143, format=w144, bandwidth=w145, valid configuration=w146)
          Is Not Equal(x=w116, y="RF Multi Station") -> w142
          Select(s=w142, t=w115, f=w117) -> w147
          case (w146) {
            frame False, Default {
              w141 = FALSE
              w140 = w143
            }
            frame True {
              call "802.11 Send TX ICP_3.gvi"(FPGA interface=w109, MCS=w119, device MAC address=w115, error in=w143, destination MAC address=w147, payload=w136, format=w144, bandwidth=w145) -> (dropped?=w141, error out=w140)
            }
          }
        }
      }
      call "Check Stop.gvi"(error in=w140) -> (error out=w148, stop=w149)
      Logical Or(w149, w138) -> w150
      stop if w150
    }
    while {
      Dequeue Element(error in=s7, queue=w114, timeout in ms=0) -> (element=w151, error out=w152, timed out?=w153)
      Logical And(w120, not w153) -> w154
      case (w154) {
        frame False {
          w155 = w152
          w156 = default
          w157 = default
        }
        frame True {
          call "802.11 Subcarrier Format to Configuration.gvi"(MCS=w119, subcarrier format=w118, error in=w152) -> (error out=w158, format=w159, bandwidth=w160, valid configuration=w161)
          Is Not Equal(x=w116, y="RF Multi Station") -> w157
          Select(s=w157, t=w115, f=w117) -> w162
          case (w161) {
            frame False, Default {
              w156 = FALSE
              w155 = w158
            }
            frame True {
              call "802.11 Send TX ICP_4.gvi"(FPGA interface=w109, MCS=w119, device MAC address=w115, error in=w158, destination MAC address=w162, payload=w151, format=w159, bandwidth=w160) -> (dropped?=w156, error out=w155)
            }
          }
        }
      }
      call "Check Stop.gvi"(error in=w155) -> (error out=w163, stop=w164)
      Logical Or(w164, w153) -> w165
      stop if w165
    }
    while {
      Dequeue Element(error in=s7, queue=w111, timeout in ms=0) -> (element=w166, error out=w167, timed out?=w168)
      Logical And(w120, not w168) -> w169
      case (w169) {
        frame False {
          w170 = w167
          w171 = default
          w172 = default
        }
        frame True {
          call "802.11 Subcarrier Format to Configuration.gvi"(MCS=w119, subcarrier format=w118, error in=w167) -> (error out=w173, format=w174, bandwidth=w175, valid configuration=w176)
          Is Not Equal(x=w116, y="RF Multi Station") -> w172
          Select(s=w172, t=w115, f=w117) -> w177
          case (w176) {
            frame False, Default {
              w171 = FALSE
              w170 = w173
            }
            frame True {
              call "802.11 Send TX ICP_5.gvi"(FPGA interface=w109, MCS=w119, device MAC address=w115, error in=w173, destination MAC address=w177, payload=w166, format=w174, bandwidth=w175) -> (dropped?=w171, error out=w170)
            }
          }
        }
      }
      call "Check Stop.gvi"(error in=w170) -> (error out=w178, stop=w179)
      Logical Or(w179, w168) -> w180
      stop if w180
    }
    # 2017/08/18  Yue
    # need to point the write FIFO to RX
    while {
      Dequeue Element(error in=s7, queue=w110, timeout in ms=0) -> (element=w181, error out=w182, timed out?=w183)
      Logical And(w120, not w183) -> w184
      case (w184) {
        frame False {
          w185 = w182
          w186 = default
          w187 = default
        }
        frame True {
          call "802.11 Subcarrier Format to Configuration.gvi"(MCS=w119, subcarrier format=w118, error in=w182) -> (error out=w188, format=w189, bandwidth=w190, valid configuration=w191)
          Is Not Equal(x=w116, y="RF Multi Station") -> w187
          Select(s=w187, t=w115, f=w117) -> w192
          case (w191) {
            frame False, Default {
              w186 = FALSE
              w185 = w188
            }
            frame True {
              call "802.11 Send TX ICP.gvi"(FPGA interface=w109, MCS=w119, device MAC address=w115, error in=w188, destination MAC address=w192, payload=w181, format=w189, bandwidth=w190) -> (dropped?=w186, error out=w185)
            }
          }
        }
      }
      call "Check Stop.gvi"(error in=w185) -> (error out=w193, stop=w194)
      Logical Or(w194, w183) -> w195
      stop if w195
    }
    Merge Errors(w193, w133, w148, w163, w178) -> (error out=w196)
    call "Check Stop.gvi"(error in=w196) -> (error out=w197, stop=w198)
    Logical And(w186, w126, w141, w156, w171) -> w199
    $"TX Data Dropped" <- w199
    Logical And(w187, w127, w142, w157, w172) -> w200
    $"Overwritten by Device MAC Address" <- w200
    Wait Until Next Multiple(multiple to wait=0)
    next s7 = w197
    stop if w198
  }
  call "Stop On Error.gvi"(error in=s7) -> (error out=w201)
  s8 = w5  # shift register
  while {
    # configuration
    call "802.11 Unbundle Session.gvi"(session=$session) -> (FPGA interface=w202)
    Feedback Node(input=$"Station Active") -> w203
    case ($"Station Active") {
      frame False, Default {
        w204 = s8
      }
      frame True {
        Is Not Equal(x=$"Station Active", y=w203) -> w205
        call "802.11 Gain Control.gvi"(initialize=w205, RX Port (USRP only)=$"RX Port (USRP only)", session=$session, AGC=$AGC, error in=s8, Manual RX gain [dB]=$"Manual RX gain [dB]", RX Frequency [Hz]=$"RX Frequency [Hz]", TX Port (USRP only)=$"TX Port (USRP only)") -> (Applied RX Gain [dB]=w206, error out=w207)
        $"Applied RX Gain [dB]" <- w206
        call "802.11 Subcarrier Format to Configuration.gvi"(MCS=$MCS, subcarrier format=$"Subcarrier Format", error in=s8) -> (error out=w208, format=w209)
        call "802.11 Configure Dynamic Parameters.gvi"(FPGA interface=w202, error in=w208, format=w209, transmit ACK=$"Transmit ACK", backoff value=$Backoff, CCA energy detection threshold=$"CCA Energy Detection Threshold [dBm]") -> (error out=w210)
        Merge Errors(w207, w210) -> (error out=w204)
      }
    }
    w211 = $Station
    Feedback Node(input=w211) -> w212
    Logical Exclusive Or(w211, w212) -> w213
    case (w213) {
      frame False, Default {
        w214 = s8
      }
      frame True {
        case (w211) {
          frame False, Default {
            sequence {
              frame 0 {
                $"Station Active" <- w211
              }
            }
            call "802.11 Unbundle Session.gvi"(session=$session) -> (UDP receiver=w215)
            Udp Close(connection ID=w215, error in=s8) -> (error out=w216)
            call "Clear Errors.gvi"(specific error code to clear=1, error in=w216) -> (error out=w217)
            call "802.11 Abort RF Streams.gvi"(session=$session, error in=w217) -> (error out=w214)
          }
          frame True {
            $"RX Frequency [Hz]" <- $"TX Frequency [Hz]"
            call "802.11 FPGA Target Configuration.gvi"() -> (maximum gain=w218, enable DC offset correction=w219)
            w220 = T14 {"remove header"=TRUE, "block unsupported frame types"=TRUE, "block FCS errors"=TRUE, "block address mismatch"=TRUE, "block header recognize error"=TRUE}
            call "802.11 Configure Static Parameters.gvi"(session in=$session, error in=s8, primary subband=$"Primary Subband", operation mode=$"Operation Mode", enable DC offset correction=w219, MPDU filter configuration=w220, device MAC address=$"Device MAC Address") -> (session dup=w221, error out=w222)
            call "802.11 Reset Statistics.gvi"(session in=w221, error in=w222, reset RX statistics=TRUE, reset TX statistics=TRUE) -> (error out=w223, session dup=w224)
            call "802.11 Configure TX RF.gvi"(TX port=$"TX Port (USRP only)", session=w224, TX frequency=$"TX Frequency [Hz]", TX power level=$"Power Level [dBm]", error in=w223) -> (session dup=w225, error out=w226, coerced TX power level=w227, coerced LO frequency=w228)
            call "802.11 Configure RX RF.gvi"(RX frequency=$"TX Frequency [Hz]", session=w225, RX gain=w218, error in=w226, RX port=$"RX Port (USRP only)") -> (error out=w229, session dup=w230, coerced RX gain=w231, coerced LO frequency=w232)
            call "802.11 Configure AGC Registers.gvi"(TX Port=$"TX Port (USRP only)", enable AGC=FALSE, session=w230, RX port=$"RX Port (USRP only)", error in=w229) -> (error out=w233, session dup=w234)
            call "802.11 Set Power Calibration Offset.gvi"(session=w234, frequency=$"TX Frequency [Hz]", error in=w233, RX port=$"RX Port (USRP only)") -> (session dup=w235, error out=w236)
            call "802.11 Configure RF Streams.gvi"(TX port=$"TX Port (USRP only)", RX port=$"RX Port (USRP only)", session=w235, error in=w236) -> (session dup=w237, error out=w238)
            call "802.11 Configure Data Source.gvi"(error in=w238, receive port=$"Receive Port", session in=w237) -> (error out=w214, session out=w239, success?=w240)
            $session <- w239
            sequence {
              frame 0 {
                $Station <- w240
                $"Station Active" <- w211
              }
            }
            $"Coerced LO frequency RX [Hz]" <- w232
            $"Applied RX Gain [dB]" <- w231
            $"Coerced LO frequency TX [Hz]" <- w228
            $"Coerced Power Level [dBm]" <- w227
          }
        }
      }
    }
    call "802.11 Reset Statistics.gvi"(session in=$session, error in=s8, reset RX statistics=$"reset RX staistics", reset TX statistics=$"reset TX staistics") -> (error out=w241)
    call "802.11 Subcarrier Format to Configuration.gvi"(MCS=$MCS, subcarrier format=$"Subcarrier Format", error in=w241) -> (modulation and coding rate=w242, error out=w243)
    Merge Errors(w204, w214, w243) -> (error out=w244)
    call "Create Stop.gvi"(error in=w244, stop in=$Stop) -> (error out=w245)
    call "Check Stop.gvi"(error in=w245) -> (error out=w246, stop=w247)
    Wait Until Next Multiple(multiple to wait=100)
    $"modulation and coding rate" <- w242
    next s8 = w246
    stop if w247
  }
  call "Stop On Error.gvi"(error in=s8) -> (error out=w248)
  Merge Errors(w248, w201, w28, w108, w72, w21, w10) -> (error out=w249)
  sequence {
    frame 0 {
      w250 = $session
    }
  }
  call "802.11 Host Release.gvi"(session=w250, error in=w249) -> (error out=w251)
  call "Simple Error Handler.gvi"(type of dialog="OK message", error in=w251)
