vi "802.11 Configure Dynamic Parameters.gvi"   [LabVIEW Communications System Design Suite 2.0.1]
# Configures all parameters that can be modified when the station is active.
# See also: 802.11 Configure Static Parameters.gvi
inputs:
  "FPGA interface": "802.11 FGPA Reference.gtype"  # Interface to the device's FPGA handle.
  "error in": error
  "format": enum{"a", "ac"} = "a"  # The 802.11 format to use (currently a or ac). Default: a
  "transmit ACK": bool  # Switches to enabled/disabled ACK transmission. Default: True
  "backoff value": u16 = 4  # The slot to wait for in the backoff procedure. Refer to section 9.3.4.3 of IEEE Standard 802.11-2012 for more details. Default: 4
  "CCA energy detection threshold": FXP(10.3) = -72  # Threshold for the CCA energy detection busy flag. Default: -72
outputs:
  "error out": error
diagram:
  Is Equal(x=$format, y="a") -> w1
  Not(x=$"transmit ACK") -> w2
  Property Node(instance in=$"FPGA interface", "format"=$format, "suppress ACK"=w2, "backoff value"=$"backoff value", "DC centered signal"=w1, "CCA energy detect threshold"=$"CCA energy detection threshold", error in=$"error in") -> (error out=w3)
  $"error out" <- w3
