vi "802.11 Configure Static Parameters.gvi"   [LabVIEW Communications System Design Suite 2.0.1]
# Configures all parameters that can be modified when the station is not active.
# See also: 802.11 Configure Dynamic Parameters.gvi
inputs:
  "session in": "802.11 Host Session.gtype"
    # Cluster containing all references the host uses during runtime. This cluster includes the following components:
    # FPGA interface: empty reference to the FPGA handle; needs to be cast each time it is used.
    # FlexRIO session: handle to the FlexRIO device. This component is valid only with FlexRIO devices.
    # FlexRIO TX Characterization Data: This component is valid only with FlexRIO sessions.
    # FlexRIO RX Characterization Data: This component is valid only with FlexRIO sessions.
    # USRP session: handle to the USRP device, including charaterization data. This component is valid only with USRP.
    # stop queue: handle to queue used to coordinate host shutdown between the loops.
    # send queue: handle to queue used to buffer TX packets to the target.
    # receive queue: handle to queue used to buffer RX packets from the target.
    # receive throughput queue: handle to queue used to buffer information about received RX packets (time and transferred bytes).
    # UDP receiver: handle to a UPD socket used to receive payload from outside the host.
    # PN packet: byte array used to stream payload inside the host.
  "error in": error
  "primary subband": UFXP(2.0) = 1  # Channel sub-band to be used to synchronize on legacy frames. Only applies to the 802.11ac format. Default: 1
  "operation mode": T2 = "Baseband Loopback"  # Current operation mode. Baseband Loopback: the baseband output of target TX is fed into the target RX. RF Loopback: the RF stream transmitted by a station is received by the same station. RF Multi Station: a station transmits data for another station and receives its data from other stations. Default: RF Loopback
  "enable DC offset correction": bool = TRUE  # Controls whether DC offset correction will be enabled. Recommended behavior is to enable for USRP devices and disable for FlexRIO-FAM modules.
  "MPDU filter configuration": T1 = {"remove header"=TRUE, "block unsupported frame types"=TRUE, "block FCS errors"=TRUE, "block address mismatch"=TRUE, "block header recognize error"=TRUE}  # Configures filters to block unsupported frame types, FCS errors, address mismatches, and header recognition errors. This node also removes the MAC Protocol Data Unit (MPDU) header when receiving MPDUs on the RX MAC. By default, this node removes the header and filters all mismatches.
  "device MAC address": u8[6] = [71, 111, 75, 117, 109, 97]  # 6-octet 80211 MAC address Default: 47:6F:4B:75:6D:61
outputs:
  "session dup": "802.11 Host Session.gtype"
    # Cluster containing all references the host uses during runtime. This cluster includes the following components:
    # FPGA interface: empty reference to the FPGA handle; needs to be cast each time it is used.
    # FlexRIO session: handle to the FlexRIO device. This component is valid only with FlexRIO devices.
    # FlexRIO TX Characterization Data: This component is valid only with FlexRIO sessions.
    # FlexRIO RX Characterization Data: This component is valid only with FlexRIO sessions.
    # USRP session: handle to the USRP device, including charaterization data. This component is valid only with USRP.
    # stop queue: handle to queue used to coordinate host shutdown between the loops.
    # send queue: handle to queue used to buffer TX packets to the target.
    # receive queue: handle to queue used to buffer RX packets from the target.
    # receive throughput queue: handle to queue used to buffer information about received RX packets (time and transferred bytes).
    # UDP receiver: handle to a UPD socket used to receive payload from outside the host.
    # PN packet: byte array used to stream payload inside the host.
  "error out": error
types:
  T1 = cluster{"remove header": bool, "block unsupported frame types": bool, "block FCS errors": bool, "block address mismatch": bool, "block header recognize error": bool}
  T2 = enum{"Baseband Loopback", "RF Loopback", "RF Multi Station"}
  T3 = cluster{"Timestamp": u32, "Transferred Bytes": u32}
  T4 = cluster{"fpga ref": any, "bus instance": u32, "instruction FIFO depth": u32, "executing on FPGA target": bool, "show error call chain": bool}
  T5 = cluster{"Actual Gain [dB]": f64, "Attenuation Table Index": i32}
  T6 = cluster{"Attenuation Table [dB]": f64[][], "Frequencies [Hz]": f64[], "IQ Imbalance Table": "niUsrpRio Config v1 Host.lvlib__IQ Imbalance.gtype"[], "Gain Table": T5[][]}
  "niInstr Register Bus v0 Host.lvlib__Register Bus Session.gtype" = Queue<"niInstr Register Bus v0 Host.lvlib__Session Data.gtype">
  "Semaphore RefNum.gtype" = i32
  "niUsrpRio Config v1 Host.lvlib__DB Queue Reference.gtype" = Queue<"niUsrpRio Config v1 Host.lvlib__Daughterboard Data.gtype">
  "niUsrpRio Config v1 Host.lvlib__niUsrpRio Session.gtype" = cluster{"FPGA Interface": any, "RIO Interface Number": u32, "Data Clock Rate": u32, "FPGA Data Clock Rate": u32, "Global Settings Register Bus": "niInstr Register Bus v0 Host.lvlib__Register Bus Session.gtype", "Radio 0 Settings Register Bus": "niInstr Register Bus v0 Host.lvlib__Register Bus Session.gtype", "Radio 1 Settings Register Bus": "niInstr Register Bus v0 Host.lvlib__Register Bus Session.gtype", "Radio Settings Bus Semaphore": "Semaphore RefNum.gtype", "DB Queues": "niUsrpRio Config v1 Host.lvlib__DB Queue Reference.gtype"[], "Characterization Data Valid?": bool, "EEPROM Header": "niUsrpRio Config v1 Host.lvlib__EEPROM Header.gtype", "Device Data Header": "niUsrpRio Config v1 Host.lvlib__EEPROM Device Data Header.gtype", "EEPROM Characterization Header": "niUsrpRio Config v1 Host.lvlib__EEPROM Characterization Header.gtype", "Characterization Data": "niUsrpRio Config v1 Host.lvlib__Characterization Data.gtype"[], "FPGA Current Version": u32, "FPGA Oldest Compatible Version": u32, "Fixed Logic Current Version": u32, "Fixed Logic Oldest Compatible Version": u32, "FPGA Radio Settings Bus Current Version": u32, "FPGA Radio Settings Bus Oldest Compatible Version": u32, "FPGA Board Config Current Version": u32, "FPGA Board Config Oldest Compatible Version": u32, "Daughterboard Clock Rate": u32}
  "802.11 Host Session.gtype" = cluster{"FPGA interface": "802.11 FGPA Reference.gtype", "send queue": Queue<u8[]>, "receive queue": Queue<u8[]>, "receive throughput queue": Queue<T3>, "UDP Receiver": UdpNetworkConnectionRefnum, "PN packet": u8[], "FlexRIO session": Queue<T4>, "FlexRIO TX Characterization Data": T6, "FlexRIO RX Characterization Data": T6, "USRP session": "niUsrpRio Config v1 Host.lvlib__niUsrpRio Session.gtype", "RF loop clock frequency": f64}
  T7 = cluster{"maximal normalization threshold": UFXP(19.15), "peak timing metric threshold": FXP(2.6), "consecutive samples over threshold": u8, "valley timing metric threshold": FXP(2.6), "consecutive samples under threshold": u8, "autocorelation threshold": UFXP(2.14), "expected peak valley distance": u16, "maximum peak valley distance deviation": u8, "samples to shift frame start": i8, "use static CFO?": bool, "static CFO": FXP(0.48)}
diagram:
  Property Node(instance in=$"session in") -> ("FPGA interface"=w1, "RF loop clock frequency"=w2, instance out=w3)
  $"session dup" <- w3
  case ($"operation mode") {
    frame "Baseband Loopback" {
      w4 = "Internal Loopback"
      w5 = TRUE
      w6 = FALSE
    }
    frame "RF Loopback" {
      w4 = "RF"
      w5 = FALSE
      w6 = FALSE
    }
    frame "RF Multi Station" {
      w4 = "RF"
      w5 = FALSE
      w6 = TRUE
    }
  }
  w7 = T7 {"maximal normalization threshold"=65000, "peak timing metric threshold"=0.65625, "consecutive samples over threshold"=10, "valley timing metric threshold"=-0.296875, "consecutive samples under threshold"=10, "autocorelation threshold"=0.5, "expected peak valley distance"=608, "maximum peak valley distance deviation"=64, "samples to shift frame start"=-32, "use static CFO?"=FALSE, "static CFO"=0}
  w8 = 4e-06  # OFDM symbol duration [s]
  Multiply(w2, w8) -> w9
  To Unsigned Word Integer(number=w9) -> w10
  w11 = 1e-07  # Timer resolution [s]
  Multiply(w2, w11) -> w12
  To Unsigned Word Integer(number=w12) -> w13
  Property Node(instance in=w1, "MPDU filter config"=$"MPDU filter configuration", "device MAC address"=$"device MAC address", "enable DC offset correction"=$"enable DC offset correction", "channel selector"=$"primary subband", "RX data source"=w4, "produce silent samples"=w5, "mute RX while TX active?"=w6, "trigger condition"="RX Packet Start", "number of samples to capture"=4096, "number of samples before trigger"=1024, "Data clock cycles per OFDM symbol"=w10, "Data clock cycles per tick (0.1us)"=w13, "synchronization settings"=w7, error in=$"error in") -> (error out=w14)
  $"error out" <- w14
