vi "802.11 Random Bit Generator.gvi"   [LabVIEW Communications System Design Suite 2.0.1]
# Generates a random byte array of fixed size.
inputs:
  "packet size": i32 = 1024  # Specifies the size of the resulting array.
outputs:
  "random array": u8[]  # Byte array of size as specified by packet size, with pseudorandom content.
diagram:
  In Range And Coerce[IncludeHighLimit=True](lower limit=1, upper limit=4061, x=$"packet size") -> (coerced(x)=w1)
  # For 802.11a the size of payload is limited by the size
  # of the signal field (12bits for length) reduced by the
  # MAC frame header (30 bytes) and the FCS (4 bytes)
  #
  # For 802.11ac the size of payload is limited by the size
  # of the MPDU length of the A-MPDU (current design
  # supports VHT single MPDU only) which is 12 bit in length.
  for (N = w1) {
    Random Number() -> (number (0 to 1)=w3)
    Multiply(w3, 255) -> w4
    Round To Nearest(number=w4) -> w5
    To Unsigned Byte Integer(number=w5) -> w6
    append w6 to w2
  }
  $"random array" <- w2
