vi "802.11 Set Power Calibration Offset.gvi"   [LabVIEW Communications System Design Suite 2.0.1]
# Sets the power calibration offset (RX reference level at minimum RX gain), which depends on the frequency.
inputs:
  "session": "802.11 Host Session.gtype"
    # Cluster containing all references the host uses during runtime. This cluster includes the following components:
    # FPGA interface: empty reference to the FPGA handle; needs to be cast each time it is used.
    # FlexRIO session: handle to the FlexRIO device. This component is valid only with FlexRIO devices.
    # FlexRIO TX Characterization Data: This component is valid only with FlexRIO sessions.
    # FlexRIO RX Characterization Data: This component is valid only with FlexRIO sessions.
    # USRP session: handle to the USRP device, including charaterization data. This component is valid only with USRP.
    # stop queue: handle to queue used to coordinate host shutdown between the loops.
    # send queue: handle to queue used to buffer TX packets to the target.
    # receive queue: handle to queue used to buffer RX packets from the target.
    # receive throughput queue: handle to queue used to buffer information about received RX packets (time and transferred bytes).
    # UDP receiver: handle to a UPD socket used to receive payload from outside the host.
    # PN packet: byte array used to stream payload inside the host.
  "frequency": f64  # RX freguency to gather for the offset.
  "error in": error
  "RX port": T1 = "RX2/RF 1"  # RX port to gather for the offset (affects USRP only).
outputs:
  "session dup": "802.11 Host Session.gtype"
    # Cluster containing all references the host uses during runtime. This cluster includes the following components:
    # FPGA interface: empty reference to the FPGA handle; needs to be cast each time it is used.
    # FlexRIO session: handle to the FlexRIO device. This component is valid only with FlexRIO devices.
    # FlexRIO TX Characterization Data: This component is valid only with FlexRIO sessions.
    # FlexRIO RX Characterization Data: This component is valid only with FlexRIO sessions.
    # USRP session: handle to the USRP device, including charaterization data. This component is valid only with USRP.
    # stop queue: handle to queue used to coordinate host shutdown between the loops.
    # send queue: handle to queue used to buffer TX packets to the target.
    # receive queue: handle to queue used to buffer RX packets from the target.
    # receive throughput queue: handle to queue used to buffer information about received RX packets (time and transferred bytes).
    # UDP receiver: handle to a UPD socket used to receive payload from outside the host.
    # PN packet: byte array used to stream payload inside the host.
  "error out": error
types:
  T1 = enum{"RX1/RF 0", "RX2/RF 0", "RX1/RF 1", "RX2/RF 1"}
  T2 = cluster{"Timestamp": u32, "Transferred Bytes": u32}
  T3 = cluster{"fpga ref": any, "bus instance": u32, "instruction FIFO depth": u32, "executing on FPGA target": bool, "show error call chain": bool}
  T4 = cluster{"Actual Gain [dB]": f64, "Attenuation Table Index": i32}
  T5 = cluster{"Attenuation Table [dB]": f64[][], "Frequencies [Hz]": f64[], "IQ Imbalance Table": "niUsrpRio Config v1 Host.lvlib__IQ Imbalance.gtype"[], "Gain Table": T4[][]}
  "niInstr Register Bus v0 Host.lvlib__Register Bus Session.gtype" = Queue<"niInstr Register Bus v0 Host.lvlib__Session Data.gtype">
  "Semaphore RefNum.gtype" = i32
  "niUsrpRio Config v1 Host.lvlib__DB Queue Reference.gtype" = Queue<"niUsrpRio Config v1 Host.lvlib__Daughterboard Data.gtype">
  "niUsrpRio Config v1 Host.lvlib__niUsrpRio Session.gtype" = cluster{"FPGA Interface": any, "RIO Interface Number": u32, "Data Clock Rate": u32, "FPGA Data Clock Rate": u32, "Global Settings Register Bus": "niInstr Register Bus v0 Host.lvlib__Register Bus Session.gtype", "Radio 0 Settings Register Bus": "niInstr Register Bus v0 Host.lvlib__Register Bus Session.gtype", "Radio 1 Settings Register Bus": "niInstr Register Bus v0 Host.lvlib__Register Bus Session.gtype", "Radio Settings Bus Semaphore": "Semaphore RefNum.gtype", "DB Queues": "niUsrpRio Config v1 Host.lvlib__DB Queue Reference.gtype"[], "Characterization Data Valid?": bool, "EEPROM Header": "niUsrpRio Config v1 Host.lvlib__EEPROM Header.gtype", "Device Data Header": "niUsrpRio Config v1 Host.lvlib__EEPROM Device Data Header.gtype", "EEPROM Characterization Header": "niUsrpRio Config v1 Host.lvlib__EEPROM Characterization Header.gtype", "Characterization Data": "niUsrpRio Config v1 Host.lvlib__Characterization Data.gtype"[], "FPGA Current Version": u32, "FPGA Oldest Compatible Version": u32, "Fixed Logic Current Version": u32, "Fixed Logic Oldest Compatible Version": u32, "FPGA Radio Settings Bus Current Version": u32, "FPGA Radio Settings Bus Oldest Compatible Version": u32, "FPGA Board Config Current Version": u32, "FPGA Board Config Oldest Compatible Version": u32, "Daughterboard Clock Rate": u32}
  "802.11 Host Session.gtype" = cluster{"FPGA interface": "802.11 FGPA Reference.gtype", "send queue": Queue<u8[]>, "receive queue": Queue<u8[]>, "receive throughput queue": Queue<T2>, "UDP Receiver": UdpNetworkConnectionRefnum, "PN packet": u8[], "FlexRIO session": Queue<T3>, "FlexRIO TX Characterization Data": T5, "FlexRIO RX Characterization Data": T5, "USRP session": "niUsrpRio Config v1 Host.lvlib__niUsrpRio Session.gtype", "RF loop clock frequency": f64}
diagram:
  $"session dup" <- $session
  call "802.11 Unbundle Session.gvi"(session=$session) -> (FPGA interface=w1)
  call "802.11 Determine RX Reference Level at Minimum Gain.gvi"(session=$session, RX frequency=$frequency, error in=$"error in", RX port=$"RX port") -> (error out=w2, reference level=w3)
  # ADC headroom = 12 dB: due to change from CFX 1.15 (USRP/FlexRIO out) to CFX 3.13 (802.11 baseband processing)
  w4 = 12  # ADC headroom
  Subtract(x=w3, y=w4) -> w5
  To Fixed Point(fixed-point type=FXP(10.3) 0, number=w5) -> w6: FXP(10.3) Saturate:Truncate
  Property Node(instance in=w1, "power calibration offset"=w6, error in=w2) -> (error out=w7)
  $"error out" <- w7
