vi "802.11 Setup DMA FIFOs.gvi"   [LabVIEW Communications System Design Suite 2.0.1]
# Configures and starts the DMA FIFO. The FIFOs are dimensioned to buffer the data for one second of operation in 802.11ac, with 40 MHz bandwidth and maximal throughput.
inputs:
  "FPGA interface": "802.11 FGPA Reference.gtype"  # Interface to the device's FPGA handle.
  "error in": error
outputs:
  "FPGA interface dup": "802.11 FGPA Reference.gtype"  # Interface to the device's FPGA handle.
  "error out": error
diagram:
  Host Fifo Configure Node[FifoName="802.11 AFW Resources.grsc\\T2H Events"](depth=1000000, error in=$"error in", reference in=$"FPGA interface") -> (error out=w1, reference out=w2)
  Host Fifo Start Node[FifoName="802.11 AFW Resources.grsc\\T2H Events"](error in=w1, reference in=w2) -> (error out=w3, reference out=w4)
  $"FPGA interface dup" <- w4
  Host Fifo Configure Node[FifoName="802.11 AFW Resources.grsc\\H2T RX Baseband"](depth=1000000, error in=$"error in", reference in=$"FPGA interface") -> (error out=w5, reference out=w6)
  Host Fifo Start Node[FifoName="802.11 AFW Resources.grsc\\H2T RX Baseband"](error in=w5, reference in=w6) -> (error out=w7)
  Host Fifo Configure Node[FifoName="802.11 AFW Resources.grsc\\T2H RX Power Spectrum"](depth=4000000, error in=$"error in", reference in=$"FPGA interface") -> (error out=w8, reference out=w9)
  Host Fifo Start Node[FifoName="802.11 AFW Resources.grsc\\T2H RX Power Spectrum"](error in=w8, reference in=w9) -> (error out=w10)
  # FIFO sizes depending on
  # size needed for 1 sec transmission of
  # 802.11 VHT40
  # 4000 bytes payload
  # ACK disabled
  #
  # but at least 1M elements
  Host Fifo Configure Node[FifoName="802.11 AFW Resources.grsc\\T2H Constellation"](depth=25000000, error in=$"error in", reference in=$"FPGA interface") -> (error out=w11, reference out=w12)
  Host Fifo Start Node[FifoName="802.11 AFW Resources.grsc\\T2H Constellation"](error in=w11, reference in=w12) -> (error out=w13)
  Host Fifo Configure Node[FifoName="802.11 AFW Resources.grsc\\T2H RX Bit Processing Output"](depth=1000000, error in=$"error in", reference in=$"FPGA interface") -> (error out=w14, reference out=w15)
  Host Fifo Start Node[FifoName="802.11 AFW Resources.grsc\\T2H RX Bit Processing Output"](error in=w14, reference in=w15) -> (error out=w16)
  Host Fifo Configure Node[FifoName="802.11 AFW Resources.grsc\\T2H RX Data"](depth=20000000, error in=$"error in", reference in=$"FPGA interface") -> (error out=w17, reference out=w18)
  Host Fifo Start Node[FifoName="802.11 AFW Resources.grsc\\T2H RX Data"](error in=w17, reference in=w18) -> (error out=w19)
  Host Fifo Configure Node[FifoName="802.11 AFW Resources.grsc\\H2T TX Data"](depth=4000000, error in=$"error in", reference in=$"FPGA interface") -> (error out=w20, reference out=w21)
  Host Fifo Start Node[FifoName="802.11 AFW Resources.grsc\\H2T TX Data"](error in=w20, reference in=w21) -> (error out=w22)
  Host Fifo Configure Node[FifoName="802.11 AFW Resources.grsc\\T2H TX Bit Processing Output"](depth=1000000, error in=$"error in", reference in=$"FPGA interface") -> (error out=w23, reference out=w24)
  Host Fifo Start Node[FifoName="802.11 AFW Resources.grsc\\T2H TX Bit Processing Output"](error in=w23, reference in=w24) -> (error out=w25)
  Host Fifo Configure Node[FifoName="802.11 AFW Resources.grsc\\T2H TX Baseband"](depth=1000000, error in=$"error in", reference in=$"FPGA interface") -> (error out=w26, reference out=w27)
  Host Fifo Start Node[FifoName="802.11 AFW Resources.grsc\\T2H TX Baseband"](error in=w26, reference in=w27) -> (error out=w28)
  Host Fifo Configure Node[FifoName="802.11 AFW Resources.grsc\\T2H Channel Estimation"](depth=2000000, error in=$"error in", reference in=$"FPGA interface") -> (error out=w29, reference out=w30)
  Host Fifo Start Node[FifoName="802.11 AFW Resources.grsc\\T2H Channel Estimation"](error in=w29, reference in=w30) -> (error out=w31)
  Merge Errors(w3, w7, w10, w13, w16, w19, w22, w25, w28, w31) -> (error out=w32)
  $"error out" <- w32
