vi "802.11 Events to String.gvi"   [LabVIEW Communications System Design Suite 2.0.1]
# Deserializes events encoded in U64 into human-readable strings.
# See also: 802.11 Read Event FIFO.gvi
inputs:
  "event data": u64[][]  # 2D array of event data and time stamps.
  "events to track": T1  # Mask of events to be processed in the result.
outputs:
  "event strings": string[]  # 1D array of events. Each element consists of a string containing the time stamp followed by a human-readable event description.
types:
  T1 = cluster{"PhyTxStart": bool, "PhyTxEnd": bool, "PhyRxStart": bool, "PhyRxEnd": bool, "MacChannelState": bool, "MacTxStatus": bool, "PhyCcaTiming": bool, "PhyRxGainChange": bool, "PhyRxAGCStateChange": bool}
diagram:
  w1 = 0  # number of valid events
  s1 = w1  # shift register
  for {
    w2 = each element of $"event data"
    # w4: event data
    Array Index(array=w2) -> (out0[0]=w5, out1[1]=w4)
    Logical Shift(x=w4, y=-56) -> w6
    # w6: event id
    To Byte Integer(number=w6) -> w7
    To Word Integer(number=w6) -> w8
    Logical Shift(x=1, y=w8) -> w9
    Property Node(instance in=$"events to track") -> ("PhyTxStart"=w10, "PhyTxEnd"=w11, "PhyRxStart"=w12, "PhyRxEnd"=w13, "MacChannelState"=w14, "MacTxStatus"=w15, "PhyCcaTiming"=w16, "PhyRxGainChange"=w17, "PhyRxAGCStateChange"=w18)
    Build Array(w10, w11, w12, w13, w14, w15, w16, w17, w18) -> w19
    Boolean Array To Number(Boolean array=w19) -> (number=w20)
    Logical And(w9, w20) -> w21
    Is Not Equal To 0(x=w21) -> w22
    # w5: Timestamp
    case (w22) {
      frame False, Default {
        w23 = EmptyString
        w24 = s1
      }
      frame True {
        case (w7) {
          frame -1, Default {
            Format Into String(formatString="unknown event: %d", w7) -> w25
          }
          frame 0 {
            Split Number(x=w4) -> (high(x)=w26, low(x)=w27)
            w28 = "PhyTxStart.req format: %s, bandwidth: %s, MCS: %d, TX Power Level: %d, Scrambler seed: %d, length: %d"
            Split Number(x=w26) -> (high(x)=w29, low(x)=w30)
            Split Number(x=w29) -> w31
            call "802.11 U8 to PHY Parameter.gvi"(sample=w31) -> (format=w32, bandwidth=w33, MCS=w34)
            Split Number(x=w30) -> (high(x)=w35, low(x)=w36)
            Format Into String(formatString=w28, w32, w33, w34, w35, w36, w27) -> w25
          }
          frame 1 {
            w25 = "PhyTxEnd.ind"
          }
          frame 2 {
            Split Number(x=w4) -> (high(x)=w37, low(x)=w38)
            w39 = "PhyRxStart.ind format: %s, bandwidth: %s, MCS: %d, PSDU length: %d"
            Split Number(x=w37) -> w40
            Split Number(x=w40) -> w41
            call "802.11 U8 to PHY Parameter.gvi"(sample=w41) -> (format=w42, bandwidth=w43, MCS=w44)
            Format Into String(formatString=w39, w42, w43, w44, w38) -> w25
          }
          frame 3 {
            Split Number(x=w4) -> (high(x)=w45, low(x)=w46)
            w47 = "PhyRxEnd.ind format violation: %d, timing valid: %d, Timing value: %d"
            Split Number(x=w45) -> w48
            Number To Boolean Array(number=w48) -> (Boolean array=w49)
            Array Index(array=w49) -> (out0[_]=w50, out1[_]=w51)
            Boolean To Integer(Boolean=w50) -> (0, 1=w52)
            Boolean To Integer(Boolean=w51) -> (0, 1=w53)
            Format Into String(formatString=w47, w52, w53, w46) -> w25
          }
          frame 4 {
            Split Number(x=w4) -> (high(x)=w54, low(x)=w55)
            w56 = "MAC Channel State.ind format CCA energy detect busy: %d, CCA signal detect busy: %d, Frame Timing use DIFS: %d, Timing value: %d"
            Split Number(x=w54) -> w57
            Split Number(x=w57) -> w58
            Number To Boolean Array(number=w58) -> (Boolean array=w59)
            Array Index(array=w59) -> (out0[_]=w60, out1[_]=w61, out2[_]=w62)
            Boolean To Integer(Boolean=w60) -> (0, 1=w63)
            Boolean To Integer(Boolean=w61) -> (0, 1=w64)
            Boolean To Integer(Boolean=w62) -> (0, 1=w65)
            Format Into String(formatString=w56, w63, w64, w65, w55) -> w25
          }
          frame 5 {
            w66 = "MAC TX Status.ind TX after SIFS pending: %d, TX after SIFS active: %d, TX after backoff pending: %d, TX after backoff active: %d, FCS add done: %d"
            Split Number(x=w4) -> w67
            Split Number(x=w67) -> w68
            Split Number(x=w68) -> w69
            Number To Boolean Array(number=w69) -> (Boolean array=w70)
            Array Index(array=w70) -> (out0[_]=w71, out1[_]=w72, out2[_]=w73, out3[_]=w74, out4[_]=w75)
            Boolean To Integer(Boolean=w71) -> (0, 1=w76)
            Boolean To Integer(Boolean=w72) -> (0, 1=w77)
            Boolean To Integer(Boolean=w73) -> (0, 1=w78)
            Boolean To Integer(Boolean=w74) -> (0, 1=w79)
            Boolean To Integer(Boolean=w75) -> (0, 1=w80)
            Format Into String(formatString=w66, w76, w77, w78, w79, w80) -> w25
          }
          frame 6 {
            w81 = "PHY CCA Timing.ind energy detection busy: %d,%d,%d,%d,%d,%d, signal detection busy: %d"
            Split Number(x=w4) -> w82
            Split Number(x=w82) -> w83
            Split Number(x=w83) -> w84
            Number To Boolean Array(number=w84) -> (Boolean array=w85)
            Array Index(array=w85) -> (out0[_]=w86, out1[_]=w87, out2[_]=w88, out3[_]=w89, out4[_]=w90, out5[_]=w91, out6[_]=w92)
            Boolean To Integer(Boolean=w86) -> (0, 1=w93)
            Boolean To Integer(Boolean=w87) -> (0, 1=w94)
            Boolean To Integer(Boolean=w88) -> (0, 1=w95)
            Boolean To Integer(Boolean=w89) -> (0, 1=w96)
            Boolean To Integer(Boolean=w90) -> (0, 1=w97)
            Boolean To Integer(Boolean=w91) -> (0, 1=w98)
            Boolean To Integer(Boolean=w92) -> (0, 1=w99)
            Format Into String(formatString=w81, w93, w94, w95, w96, w97, w98, w99) -> w25
          }
          frame 7 {
            Split Number(x=w4) -> w100
            To Fixed Point(number=w100) -> w101: UFXP(5.1) Saturate:ConvergentRounding
            To Double Precision Float(number=w101) -> w102
            Format Into String(formatString="PHY RX Gain Change.ind new gain value: %.1f", w102) -> w25
          }
          frame 8 {
            Split Number(x=w4) -> w103
            case (w103) {
              frame 0 {
                w104 = "Idle"
              }
              frame 1 {
                w104 = "Wait for second measurement"
              }
              frame 2 {
                w104 = "AGC active"
              }
              frame 3 {
                w104 = "Gain locked"
              }
              frame 4, Default {
                w104 = "undefined state"
              }
            }
            Format Into String(formatString="PHY AGC State Change.ind new state value: %s", w104) -> w25
          }
        }
        Number To Decimal String(number=w5) -> (decimal integer string=w105)
        Concatenate Strings(w105, " ", w25, EndOfLine) -> w23
        Increment(x=s1) -> w24
      }
    }
    append w23 to w3
    next s1 = w24
  }
  w106 = 0  # current index
  # initialize for valid number of event strings
  Initialize Array(element=EmptyString, size=s1) -> w107
  s2 = w107  # shift register
  s3 = w106  # shift register
  for {
    w108 = each element of w3
    Is Empty String Or Path(string/path=w108) -> w109
    case (w109) {
      frame False, Default {
        Replace Array Subset(inArray=s2, index=s3, new=w108) -> w110
        Increment(x=s3) -> w111
      }
      frame True {
        w110 = s2
        w111 = s3
      }
    }
    next s2 = w110
    next s3 = w111
  }
  $"event strings" <- s2
