vi "802.11 PHY Parameter to U8.gvi"   [LabVIEW Communications System Design Suite 2.0.1]
# Serializes format, bandwidth, and MCS into a U8 datatype.
inputs:
  "format": enum{"a", "ac"} = "a"  # The 802.11 format to use (currently a or ac).
  "bandwidth": enum{"20 MHz", "40 MHz", "80 MHz"} = "20 MHz"  # Bandwidth for the current packet. Enumeration type: 20 MHz, 40 MHz, 80 MHz
  "MCS": UFXP(4.0)  # Modulation and coding scheme index. Depending on the current 802.11 format (a or ac) and the bandwidth, valid indexes range from 0 to 7, 8 or 9.
outputs:
  "sample": u8  # Serialized data.
diagram:
  case ($format) {
    frame "a" {
      w1 = 0
    }
    frame "ac" {
      w1 = 1
    }
  }
  Number To Boolean Array(number=w1) -> (Boolean array=w2)
  case ($bandwidth) {
    frame "20 MHz" {
      w3 = 0
    }
    frame "40 MHz" {
      w3 = 1
    }
    frame "80 MHz" {
      w3 = 2
    }
  }
  Number To Boolean Array(number=w3) -> (Boolean array=w4)
  Number To Boolean Array(number=$MCS) -> (Boolean array=w5)
  Build Array[ConcatenateInputs=True](w2, w4, w5) -> w6
  Boolean Array To Number(Boolean array=w6) -> (number=w7: u8)
  $sample <- w7
