vi "802.11 Prepare Channel Estimation.gvi"   [LabVIEW Communications System Design Suite 2.0.1]
# Reads the channel estimation DMA FIFO and computes the channel estimation magnitude and phase. The DMA FIFO contains the channel estimates from L-LTF and VHT-LTF.
inputs:
  "FPGA interface": "802.11 FGPA Reference.gtype"  # Interface to the device's FPGA handle.
  "error in": error
  "channel subband": UFXP(2.0) = 1  # Channel sub-band that synchronizes on legacy frames. Only applies if the format is 802.11ac.
  "subcarrier format": i32 = "20 MHz (IEEE 802.11 a)"(0)  # Subcarrier format to use. This includes the 802.11 format (a and ac supported) as well as the bandwith (20 MHz (a and ac) or 40 Mhz (ac only)).
outputs:
  "error out": error
  "channel estimation": cluster{"Element 1": i32[], "Element 2": f64[]}[]  # A 2D array containing the channel estimation (both magnitude and phase).
  "update power spectrum": bool  # Determines whether the channel estimation array contains valid information.
diagram:
  Host Fifo Read Node[FifoName="802.11 AFW Resources.grsc\\T2H Channel Estimation"](error in=$"error in", number of elements=0, reference in=$"FPGA interface", timeout (ms)=-1) -> (elements remaining=w1, error out=w2, reference out=w3)
  Quotient And Remainder(x=w1, y=256) -> (floor(x/y)=w4)
  Is Greater Than 0(x=w4) -> w5
  $"update power spectrum" <- w5
  To Unsigned Byte Integer(number=$"channel subband") -> w6
  case ($"subcarrier format") {
    frame 0, Default {
      w7 = 53
      w8 = -26
    }
    frame 1 {
      # w9: DC offset
      case (w6) {
        frame 0, Default {
          w9 = -96
        }
        frame 1 {
          w9 = -32
        }
        frame 2 {
          w9 = 32
        }
        frame 3 {
          w9 = 96
        }
      }
      Add(-28, w9) -> w8
      w7 = 57
    }
    frame 2 {
      w7 = 117
      w8 = -58
    }
  }
  # w10: subcarrier
  # offset indizes
  for (N = 256) (iteration -> i1) {
    To Long Integer(number=i1) -> w11
    Subtract(x=w11, y=128) -> w12
    append w12 to w10
  }
  To Long Integer(number=256) -> w13
  # w14: index of first subcarrier
  # w7: visible subcarriers
  Add(128, w8) -> w14
  Multiply(w4, 256) -> w15
  Host Fifo Read Node[FifoName="802.11 AFW Resources.grsc\\T2H Channel Estimation"](error in=w2, number of elements=w15, reference in=w3, timeout (ms)=-1) -> (data=w16, error out=w17)
  case (w5) {
    frame False, Default {
      w18 = default
    }
    frame True {
      Array Subset(array=w10, index0=w14, length0=w7) -> w19
      Delete From Array(inArray=w16, length (1)=w13) -> w20
      Array Subset(array=w20, index0=w14, length0=w7) -> w21
      Split Number(x=w21) -> (high(x)=w22, low(x)=w23)
      To Long Integer(number=w23) -> w24
      Reinterpret Number[RestrictToSameWordLength=True](data in=w24, type=FXP(11.21) 0) -> (data out=w25)
      To Long Integer(number=w22) -> w26
      Reinterpret Number[RestrictToSameWordLength=True](data in=w26, type=FXP(11.21) 0) -> (data out=w27)
      Real And Imaginary To Complex(x=w25, y=w27) -> w28
      To Double Precision Complex(number=w28) -> w29
      Complex To Polar(r * e^(i*theta)=w29) -> (r=w30, theta=w31)
      Build Cluster(w19, w30) -> w32
      Build Cluster(w19, w31) -> w33
      Build Array(w32, w33) -> w18
    }
  }
  $"channel estimation" <- w18
  $"error out" <- w17
