vi "802.11 Prepare RX Power Spectrum.gvi"   [LabVIEW Communications System Design Suite 2.0.1]
# Reads the RX power spectrum DMA FIFO and computes a power spectrum from it. The DMA FIFO contains the IQ samples from the RX processing chain.
inputs:
  "FPGA interface": "802.11 FGPA Reference.gtype"  # Interface to the device's FPGA handle.
  "error in": error
outputs:
  "error out": error
  "RX power spectrum": T1  # FFT power spectrum of RX IQ samples.
  "update power spectrum": bool  # Determines whether the RX power spectrum array contains valid information.
types:
  T1 = cluster{"f0": f64, "df": f64, "magnitude": f64[]}
  T2 = enum{"No averaging", "Vector averaging", "RMS averaging", "Peak hold"}
  "Averaging Parameters.gtype" = cluster{"averaging mode": T2, "weighting mode": enum{"Linear", "Exponential"}, "number of averages": u32}
uses:
  NI::Analysis::Measurement::Power Spectrum for 1 Chan (CDB).gvi
diagram:
  Host Fifo Read Node[FifoName="802.11 AFW Resources.grsc\\T2H RX Power Spectrum"](error in=$"error in", number of elements=0, reference in=$"FPGA interface", timeout (ms)=-1) -> (elements remaining=w1, error out=w2, reference out=w3)
  Quotient And Remainder(x=w1, y=4096) -> (floor(x/y)=w4)
  Is Greater Than 0(x=w4) -> w5
  $"update power spectrum" <- w5
  To Long Integer(number=4096) -> w6
  Multiply(w4, 4096) -> w7
  Host Fifo Read Node[FifoName="802.11 AFW Resources.grsc\\T2H RX Power Spectrum"](error in=w2, number of elements=w7, reference in=w3, timeout (ms)=-1) -> (data=w8, error out=w9)
  case (w5) {
    frame False, Default {
      w10 = default
      w11 = w9
    }
    frame True {
      Array Subset(array=w8, length0=w6) -> w12
      call "U32 to CFX3.13.gvi"(data in=w12) -> (data out=w13)
      To Double Precision Complex(number=w13) -> w14
      Reciprocal(x=80000000) -> w15
      Property Node(instance in=waveform<c128> {dt=1, Y=[]}, "Y"=w14, "dt"=w15) -> (instance out=w16)
      w17 = "Averaging Parameters.gtype" {"averaging mode"="No averaging", "weighting mode"="Exponential", "number of averages"=10}
      call "Power Spectrum for 1 Chan (CDB).gvi"(signal=w16, window type="Hanning"(1), averaging parameters=w17, dB on=TRUE, error in=w9, restart averaging=FALSE) -> (power spectrum=w10, error out=w11)
    }
  }
  $"RX power spectrum" <- w10
  $"error out" <- w11
