vi "802.11 Prepare TX Power Spectrum.gvi"   [LabVIEW Communications System Design Suite 2.0.1]
# Reads the TX power spectrum DMA FIFO and computes a power spectrum from it. The DMA FIFO contains the I/Q samples from the TX processing chain.
inputs:
  "FPGA interface": "802.11 FGPA Reference.gtype"  # Interface to the device's FPGA handle.
  "error in": error
outputs:
  "error out": error
  "TX power spectrum": T1  # FFT power spectrum of TX IQ samples.
  "update power spectrum": bool  # Determines whether the TX power spectrum array contains valid information.
types:
  T1 = cluster{"f0": f64, "df": f64, "magnitude": f64[]}
  T2 = enum{"No averaging", "Vector averaging", "RMS averaging", "Peak hold"}
  "Averaging Parameters.gtype" = cluster{"averaging mode": T2, "weighting mode": enum{"Linear", "Exponential"}, "number of averages": u32}
uses:
  NI::Analysis::Measurement::Power Spectrum for 1 Chan (CDB).gvi
diagram:
  Host Fifo Read Node[FifoName="802.11 AFW Resources.grsc\\T2H TX Baseband"](error in=$"error in", number of elements=0, reference in=$"FPGA interface", timeout (ms)=-1) -> (elements remaining=w1, error out=w2, reference out=w3)
  Is Greater(x=w1, y=1024) -> w4
  $"update power spectrum" <- w4
  Host Fifo Read Node[FifoName="802.11 AFW Resources.grsc\\T2H TX Baseband"](error in=w2, number of elements=w1, reference in=w3, timeout (ms)=-1) -> (data=w5, error out=w6)
  To Long Integer(number=1024) -> w7
  case (w4) {
    frame False, Default {
      w8 = default
      w9 = w6
    }
    frame True {
      Delete From Array(inArray=w5, length (1)=w7) -> (deleted=w10)
      call "U32 to CFX3.13.gvi"(data in=w10) -> (data out=w11)
      To Double Precision Complex(number=w11) -> w12
      Reciprocal(x=80000000) -> w13
      Property Node(instance in=waveform<c128> {dt=1, Y=[]}, "Y"=w12, "dt"=w13) -> (instance out=w14)
      w15 = "Averaging Parameters.gtype" {"averaging mode"="No averaging", "weighting mode"="Exponential", "number of averages"=10}
      call "Power Spectrum for 1 Chan (CDB).gvi"(signal=w14, window type="Hanning"(1), averaging parameters=w15, dB on=TRUE, error in=w6, restart averaging=FALSE) -> (power spectrum=w8, error out=w9)
    }
  }
  $"TX power spectrum" <- w8
  $"error out" <- w9
