vi "802.11 Prepare Throughput Measurements.gvi"   [LabVIEW Communications System Design Suite 2.0.1]
# Reads the most recent transferred bytes count from the receiver throughput queue to calculate the current RX throughput rate. The MAC statistics are read to calculate a block error rate for the sent TX packets. Both results are smoothed with a moving average.
inputs:
  "reset": bool  # Resets internal averaging.
  "FPGA interface": "802.11 FGPA Reference.gtype"  # Interface to the device's FPGA handle.
  "receive throughput queue": Queue<T1>  # Queue containing an array of clusters with the time stamp and transferred byte count for each received RX packet.
  "error in": error
  "timing granularity": u32 = 100  # Sets the rate at which the node is called, in ms, to enable calculation of throughput per second. Default: 100
outputs:
  "packet rate": f64  # Number of RX packets transferred per second.
  "error out": error
  "TX block error rate": f64  # The error rate of sent TX packets versus received ACKs in a range of [0,1].
  "RX throughput": f64  # Throughput of the RX payload, in bits/s.
types:
  T1 = cluster{"Timestamp": u32, "Transferred Bytes": u32}
diagram:
  Flush Queue(error in=$"error in", queue=$"receive throughput queue") -> (error out=w1, remaining elements=w2)
  # keep this order because this
  # read delay prevents the BLER
  # to be lower than 0
  Property Node(instance in=$"FPGA interface", error in=w1) -> ("MAC TX statistics"=w3, "MAC RX statistics"=w4, error out=w5)
  $"error out" <- w5
  Property Node(instance in=w3) -> ("number of TX after backoff requests completed"=w6)
  Feedback Node(input=w6) -> w7
  Subtract(x=w6, y=w7) -> w8
  Is Equal To 0(x=w8) -> w9
  Property Node(instance in=w4) -> ("number of ACKs received"=w10)
  Feedback Node(input=w10) -> w11
  Subtract(x=w10, y=w11) -> w12
  To Double Precision Float(number=w12) -> w13
  To Double Precision Float(number=w8) -> w14
  Divide(x=w13, y=w14) -> w15
  Subtract(x=1, y=w15) -> w16
  Select(s=w9, t=0, f=w16) -> w17
  call "802.11 Moving Average.gvi"(sample=w17, samples to average=10, reset=$reset) -> (average=w18)
  $"TX block error rate" <- w18
  To Double Precision Float(number=$"timing granularity") -> w19
  Divide(x=1000, y=w19) -> w20
  Array Size(array=w2) -> (size(s)=w21)
  To Double Precision Float(number=w21) -> w22
  Multiply(w22, w20) -> w23
  $"packet rate" <- w23
  for {
    w24 = each element of w2
    Property Node(instance in=w24) -> ("Transferred Bytes"=w26)
    append w26 to w25
  }
  To Double Precision Float(number=w25) -> w27
  Add Array Elements(numeric array=w27) -> (sum=w28)
  Multiply(w28, 8) -> w29
  To Double Precision Float(number=w29) -> w30
  Multiply(w30, w20) -> w31
  call "802.11 Moving Average.gvi"(sample=w31, samples to average=10, reset=$reset) -> (average=w32)
  $"RX throughput" <- w32
