vi "802.11 Read Target Registers.gvi"   [LabVIEW Communications System Design Suite 2.0.1]
# Reads the target register relevant for exposure to the host front panel.
inputs:
  "FPGA interface": "802.11 FGPA Reference.gtype"  # Interface to the device's FPGA handle.
  "error in": error
outputs:
  "error out": error
  "target FIFO overflow": bool  # Checks the target to host FIFOs for overflow. If one of the target to host FIFOs overflows, its information is no longer reliable.
  "compensated CFO": f64  # Compensation applied to the center frequency offset, in Hz.
  "RF input power": f64[][]  # A 2D-array containing the RF input power, in dBm, currently being measured, as well as at the most recent packet start.
  "MAC RX statistics": T1  # Counters relevant for MAC RX.
  "MAC TX statistics": T2  # Counters relevant for MAC TX.
  "signal power at packet start": f64  # Baseband power at the most recent packet start, in dB.
types:
  T1 = cluster{"number of frames detected": u32, "number of subframes received": u32, "number of valid subframes received": u32, "number of ACKs received": u32}
  T2 = cluster{"number of TX after SIFS requests detected": u32, "number of TX after SIFS requests completed": u32, "number of TX after backoff requests detected": u32, "number of TX after backoff requests completed": u32}
diagram:
  Property Node(instance in=$"FPGA interface", error in=$"error in") -> ("RF input power at packet start"=w1, "T2H RX Data overflow"=w2, "T2H Constallation overflow"=w3, "T2H RX Power Spectrum overflow"=w4, "T2H Channel Estimation overflow"=w5, "signal power at packet start"=w6, "TX to RF FIFO overflow"=w7, "RF input power"=w8, "compensated CFO"=w9, "MAC RX statistics"=w10, "MAC TX statistics"=w11, error out=w12)
  $"error out" <- w12
  Add(w2, w3, w4, w5, w7) -> w13
  Is Not Equal To 0(x=w13) -> w14
  $"target FIFO overflow" <- w14
  To Double Precision Float(number=w6) -> w15
  $"signal power at packet start" <- w15
  To Double Precision Float(number=w1) -> w16
  To Double Precision Float(number=w8) -> w17
  Is Less(x=w17, y=-200) -> w18
  Select(s=w18, t=NaN, f=w17) -> w19
  Build Array(w19, w16) -> w20
  Build Array(w20) -> w21
  $"RF input power" <- w21
  To Double Precision Float(number=w9) -> w22
  Multiply(w22, -80000000) -> w23
  $"compensated CFO" <- w23
  $"MAC TX statistics" <- w11
  Property Node(instance in=w10) -> ("number of frames detected"=w24, "number of subframes received"=w25, "number of valid subframes received"=w26, "number of ACKs received"=w27)
  Property Node(instance in=T1 {all zero or empty}, "number of frames detected"=w24, "number of subframes received"=w25, "number of valid subframes received"=w26, "number of ACKs received"=w27) -> (instance out=w28)
  $"MAC RX statistics" <- w28
