vi "802.11 Subcarrier Format to Configuration.gvi"   [LabVIEW Communications System Design Suite 2.0.1]
# Extracts modulation, coding rate, format, and bandwidth from the MCS and subcarrier format.
inputs:
  "MCS": UFXP(4.0)  # Modulation and coding scheme index.
  "subcarrier format": i32 = "20 MHz (IEEE 802.11 a)"(0)  # Subcarrier format to use. This includes the 802.11 format (a and ac supported) as well as the bandwith (20 MHz (a and ac) or 40 Mhz (ac only)).
  "error in": error
outputs:
  "modulation and coding rate": string  # Modulation and coding rate, which are dependent on the MCS and subcarrier format. MCS has different meanings depending on the format and bandwidth you use. Refer to Table 18-4 of IEEE Standard 802.11-2012, and Table 22-30 and Table 22-38 of IEEE Standard 802.11ac-2013.
  "error out": error
  "format": enum{"a", "ac"}  # The format according to the subcarrier format.
  "bandwidth": enum{"20 MHz", "40 MHz", "80 MHz"}  # The bandwidth according to the subcarrier format.
  "valid configuration": bool  # Signals whether MCS points to a valid configuration according to subcarrier format.
diagram:
  case ($"subcarrier format") {
    frame 0, Default {
      # 802.11a 20MHz (802.11-2012 table 18-4)
      w6 = ["BPSK", "BPSK", "QPSK", "QPSK", "16-QAM", "16-QAM", "64-QAM", "64-QAM", "64-QAM"]
      To Long Integer(number=$MCS) -> w7
      Array Index(array=w6) -> (out0[w7]=w1)
      w8 = ["1/2", "3/4", "1/2", "3/4", "1/2", "3/4", "2/3", "3/4", "5/6"]
      Array Index(array=w8) -> (out0[w7]=w3)
      w2 = 7
      w4 = "a"
      w5 = "20 MHz"
    }
    frame 1 {
      # 802.11ac 20MHz (802.11ac-2013 table 22-30)
      w9 = ["BPSK", "QPSK", "QPSK", "16-QAM", "16-QAM", "64-QAM", "64-QAM", "64-QAM", "256-QAM"]
      To Long Integer(number=$MCS) -> w10
      Array Index(array=w9) -> (out0[w10]=w1)
      w11 = ["1/2", "1/2", "3/4", "1/2", "3/4", "2/3", "3/4", "5/6", "3/4"]
      Array Index(array=w11) -> (out0[w10]=w3)
      w2 = 8
      w4 = "ac"
      w5 = "20 MHz"
    }
    frame 2 {
      # 802.11ac 40MHz (802.11ac-2013 table 22-38)
      w12 = ["BPSK", "QPSK", "QPSK", "16-QAM", "16-QAM", "64-QAM", "64-QAM", "64-QAM", "256-QAM", "256-QAM"]
      To Long Integer(number=$MCS) -> w13
      Array Index(array=w12) -> (out0[w13]=w1)
      w14 = ["1/2", "1/2", "3/4", "1/2", "3/4", "2/3", "3/4", "5/6", "3/4", "5/6"]
      Array Index(array=w14) -> (out0[w13]=w3)
      w2 = 9
      w4 = "ac"
      w5 = "40 MHz"
    }
  }
  Is Greater(x=$MCS, y=w2) -> w15
  Format Into String(formatString="%s (%s)", errIn=$"error in", w1, w3) -> (outString=w16, errOut=w17)
  Select(s=w15, t="invalid", f=w16) -> w18
  $"modulation and coding rate" <- w18
  Not(x=w15) -> w19
  $"valid configuration" <- w19
  $format <- w4
  $bandwidth <- w5
  $"error out" <- w17
