vi "802.11 U8 to PHY Parameter.gvi"   [LabVIEW Communications System Design Suite 2.0.1]
# Deserializes format, bandwidth, and MCS from a U8 data type.
inputs:
  "sample": u8  # Serialized data.
outputs:
  "format": enum{"a", "ac"}  # The 802.11 format to use (currently a or ac).
  "bandwidth": enum{"20 MHz", "40 MHz", "80 MHz"}  # Bandwidth for the current packet. Enumeration type: 20 MHz, 40 MHz, 80 MHz
  "MCS": u8  # Modulation and coding scheme index. Depending on the current 802.11 format (a or ac) and the bandwidth, valid indexes range from 0 to 7, 8 or 9.
diagram:
  Number To Boolean Array(number=$sample) -> (Boolean array=w1)
  Array Index(array=w1) -> (out0[_]=w2, out1[_]=w3, out2[_]=w4, out3[_]=w5, out4[_]=w6, out5[_]=w7, out6[_]=w8, out7[_]=w9)
  Build Array(w2, w3) -> w10
  Boolean Array To Number(Boolean array=w10) -> (number=w11: u8)
  case (w11) {
    frame 0, Default {
      w12 = "a"
    }
    frame 1 {
      w12 = "ac"
    }
  }
  $format <- w12
  Build Array(w4, w5) -> w13
  Boolean Array To Number(Boolean array=w13) -> (number=w14: u8)
  case (w14) {
    frame 0, Default {
      w15 = "20 MHz"
    }
    frame 1 {
      w15 = "40 MHz"
    }
    frame 2 {
      w15 = "80 MHz"
    }
  }
  $bandwidth <- w15
  Build Array(w6, w7, w8, w9) -> w16
  Boolean Array To Number(Boolean array=w16) -> (number=w17: u8)
  $MCS <- w17
