vi "802.11 Unpack RX Constellation.gvi"   [LabVIEW Communications System Design Suite 2.0.1]
# Deserializes a 1D array of U64 to IQ data, field map, subcarrier indices, and the orthogonal frequency-division multiplexing (OFDM) symbol index. Each sample contains the I/Q data in the high 32 bit, and the meta data in the lower 32 bit.
# The IQ data is decoded as 1-signed 16 bit casted to 2.14 complex fixed points, where I is in the low 16 bit and Q is in the high 16 bit.
# In the meta data, the high 16 bit contains the subcarrier indices (high 8 bit) and OFDM symbol index (low 8 bit). The field map is encoded into the low 16 bit.
inputs:
  "data": u64[]  # 1D array of U64 samples.
outputs:
  "IQ data": c128[]  # 1D array of I/Q samples decoded from data.
  "field map": T1[]  # 1D array of field maps decoded from data.
  "subcarrier indices": u8[]  # 1D array of subcarrier indices decoded from data.
  "OFDM symbol": u8[]  # 1D array of orthogonal frequency-division multiplexing (OFDM) symbol indices decoded from data.
types:
  T1 = cluster{"L-STF-1": bool, "L-STF-2": bool, "L-LTF-1": bool, "L-LTF-2": bool, "L-SIG": bool, "L-Data": bool, "L-Pilot": bool, "VHT-SIG-A-1": bool, "VHT-SIG-A-2": bool, "VHT-STF": bool, "VHT-LTF": bool, "VHT-SIG-B": bool, "VHT-Data": bool, "VHT-Pilot": bool}
diagram:
  Split Number(x=$data) -> (high(x)=w1, low(x)=w2)
  Split Number(x=w1) -> (high(x)=w3, low(x)=w4)
  To Word Integer(number=w4) -> w5
  # convert back to 2.14
  Reinterpret Number[RestrictToSameWordLength=True](data in=w5, type=FXP(2.14) 0) -> (data out=w6)
  To Word Integer(number=w3) -> w7
  Reinterpret Number[RestrictToSameWordLength=True](data in=w7, type=FXP(2.14) 0) -> (data out=w8)
  Real And Imaginary To Complex(x=w6, y=w8) -> w9
  To Double Precision Complex(number=w9) -> w10
  $"IQ data" <- w10
  Split Number(x=w2) -> (high(x)=w11, low(x)=w12)
  Split Number(x=w11) -> (high(x)=w13, low(x)=w14)
  $"subcarrier indices" <- w13
  $"OFDM symbol" <- w14
  # restore field map
  for {
    w15 = each element of w12
    Number To Boolean Array(number=w15) -> (Boolean array=w17)
    Array To Cluster[NumberOfClusterElements=14](array=w17) -> (cluster=w18)
    Type Cast(type=T1 {all zero or empty}, x=w18) -> w19
    append w19 to w16
  }
  $"field map" <- w16
