vi "802.11 Send TX ICP_2.gvi"   [LabVIEW Communications System Design Suite 2.0.1]
# Receives the payload and serializes it into ICP packets. The encoded ICP packets are transmitted to the target TX using the TX Data DMA FIFO.
inputs:
  "FPGA interface": "802.11 FGPA Reference.gtype"  # Interface to the device's FPGA handle.
  "MCS": UFXP(4.0)  # Modulation and coding scheme index. Depending on the current 802.11 format (a or ac) and the bandwidth, valid indexes range from 0 to 7, 8 or 9.
  "device MAC address": u8[6] = [71, 111, 75, 117, 109, 97]  # Device MAC address used in the MAC frame header during transmission.
  "error in": error
  "destination MAC address": u8[6] = [71, 111, 75, 117, 109, 98]  # Destination MAC address used in the MAC frame header during transmission.
  "payload": u8[]  # Payload to be transferred to the target MAC TX.
  "format": enum{"a", "ac"} = "a"  # The 802.11 format to use (currently a or ac).
  "bandwidth": enum{"20 MHz", "40 MHz", "80 MHz"} = "20 MHz"  # Bandwidth for the current packet. Enumeration type: 20 MHz, 40 MHz, 80 MHz
outputs:
  "dropped?": bool  # Indicates that the payload was not forwarded to TX Data DMA FIFO because the FIFO was full.
  "error out": error
  "FPGA Interface dup": "802.11 FGPA Reference.gtype"  # Interface to the device's FPGA handle.
diagram:
  # Leave space
  # for more than
  # one A-MPDU.
  Feedback Node(initial value=0xFFFFFFFF, input=w1) -> w2
  Is Greater(x=w2, y=10000) -> w3
  case (w3) {
    frame False, Default {
      # Write empty array
      # to figure out free
      # elements.
      Host Fifo Write Node[FifoName="802.11 AFW Resources.grsc\\H2T TX Data"](data=u8[] [], error in=$"error in", reference in=$"FPGA interface", timeout (ms)=5000) -> (empty elements remaining=w1, error out=w4, reference out=w5)
      w6 = default
    }
    frame True {
      w7 = path "C:\\Users\\letheyue\\Downloads\\Victor-Yue-Project\\WiMAC-project\\record file\\stream 2.txt"
      w8 = 2  # ID
      Get Current Time() -> (current time=w9)
      Get Date And Time String(date format (0)=2, time stamp=w9, want seconds? (F)=TRUE) -> (date string=w10, time string=w11)
      Array Size(array=$payload) -> (size(s)=w12)
      Format Into File(inputFile=w7, formatString="%d, %s, %s, %d", errIn=$"error in", w8, w10, w11, w12) -> (outputFile=w6, errOut=w13)
      w14 = 1  # power level
      w15 = 1  # scrambler seed
      # Create MPDU
      call "802.11 PHY Parameter to U8.gvi"(format=$format, bandwidth=$bandwidth, MCS=$MCS) -> (sample=w16)
      Build Array[ConcatenateInputs=True](w16, w14, w15, $"device MAC address", $"destination MAC address", $payload, w8) -> w17
      Array Size(array=w17) -> (size(s)=w18)
      To Unsigned Long Integer(number=w18) -> w19
      Split Number(x=w19) -> (high(x)=w20, low(x)=w21)
      # prepend packet size
      Split Number(x=w20) -> (high(x)=w22, low(x)=w23)
      Split Number(x=w21) -> (high(x)=w24, low(x)=w25)
      Build Array[ConcatenateInputs=True](w22, w23, w24, w25, w17) -> w26
      Host Fifo Write Node[FifoName="802.11 AFW Resources.grsc\\H2T TX Data"](data=w26, error in=$"error in", reference in=$"FPGA interface", timeout (ms)=5000) -> (empty elements remaining=w1, error out=w27, reference out=w5)
      Merge Errors(w27, w13) -> (error out=w4)
    }
  }
  $"FPGA Interface dup" <- w5
  $"error out" <- w4
  Close File(refnum=w6)
  Not(x=w3) -> w28
  $"dropped?" <- w28
