vi "Check Stop.gvi"   [LabVIEW Communications System Design Suite 2.0.1]
# Tests the stop notifier for elements. If so or the error wire indicates an error the stop indicator is enabled. Loops on host top level use the stop indicator for their loop teminate terminal.
inputs:
  "error in": error
outputs:
  "error out": error
  "stop": bool  # Indicates caller should stop excuting.
diagram:
  Call Chain() -> (callchain=w1)
  Delete From Array(inArray=w1) -> (deleted=w2)
  Format Into String(formatString="%s:stop notifier", errIn=$"error in", w2) -> (outString=w3, errOut=w4)
  Obtain Notifier(create if not found?=FALSE, element data type=string "", error in=w4, name=w3) -> (error out=w5, notifier out=w6)
  Wait On Notification With Notifier History(error in (no error)=w5, ignore previous (F)=FALSE, notifier=w6, timeout in ms (-1)=0) -> (error out=w7, notification=w8, notifier out=w9)
  Release Notifier(error in (no error)=w7, notifier=w9) -> (error out=w10)
  $"error out" <- w10
  Is Equal(x=w8, y="done") -> w11
  Property Node(instance in=w10) -> ("status"=w12)
  Logical Or(w12, w11) -> w13
  $stop <- w13
