vi "Create Stop Notifier.gvi"   [LabVIEW Communications System Design Suite 2.0.1]
inputs:
  "error in": error
outputs:
  "error out": error
  "stop notifier": Notifier<string>
diagram:
  Call Chain() -> (callchain=w1)
  Delete From Array(inArray=w1) -> (deleted=w2)
  Format Into String(formatString="%s:stop notifier", errIn=$"error in", w2) -> (outString=w3, errOut=w4)
  Obtain Notifier(create if not found?=TRUE, element data type=string "", error in=w4, name=w3) -> (error out=w5, notifier out=w6)
  $"stop notifier" <- w6
  $"error out" <- w5
