vi "Create Stop.gvi"   [LabVIEW Communications System Design Suite 2.0.1]
# Enqueue an element into the stop notifier if stop in indicates an event of the stop button.
inputs:
  "error in": error, required
  "stop in": bool  # Indicates to send an element into the stop notifier.
outputs:
  "error out": error, required
diagram:
  case ($"stop in") {
    frame False, Default {
      w1 = $"error in"
    }
    frame True {
      Call Chain() -> (callchain=w2)
      Delete From Array(inArray=w2) -> (deleted=w3)
      Format Into String(formatString="%s:stop notifier", errIn=$"error in", w3) -> (outString=w4, errOut=w5)
      Obtain Notifier(create if not found?=FALSE, element data type=string "", error in=w5, name=w4) -> (error out=w6, notifier out=w7)
      Send Notification(error in (no error)=w6, notification="done", notifier=w7) -> (error out=w8, notifier out=w9)
      Release Notifier(error in (no error)=w8, notifier=w9) -> (error out=w1)
    }
  }
  $"error out" <- w1
