vi "DTP Add Header and CRC.gvi"   [LabVIEW Communications System Design Suite 2.0.1]
inputs:
  "counter": u16 = 52
  "U8 input data array": u8[] = [1, 0, 3, 4, 5, 6, 0, 8, 0, 0, 17, 18]
outputs:
  "U8 header array": u8[]
  "U8 data array": u8[]
  "CRC": u32
diagram:
  call "DTP Header.gvi"() -> (DTP sync word=w1, DTP packet determination=w2)
  Split Number(x=w1) -> (high(x)=w3, low(x)=w4)
  Split Number(x=w3) -> (high(x)=w5, low(x)=w6)
  Split Number(x=w4) -> (high(x)=w7, low(x)=w8)
  Array Size(array=$"U8 input data array") -> (size(s)=w9)
  To Unsigned Word Integer(number=w9) -> w10
  Join Numbers(high(x)=$counter, low(x)=w10) -> w11
  Split Number(x=w11) -> (high(x)=w12, low(x)=w13)
  Split Number(x=w12) -> (high(x)=w14, low(x)=w15)
  Split Number(x=w13) -> (high(x)=w16, low(x)=w17)
  Logical Exclusive Or(w11, w1) -> w18
  Split Number(x=w18) -> (high(x)=w19, low(x)=w20)
  Split Number(x=w19) -> (high(x)=w21, low(x)=w22)
  Split Number(x=w20) -> (high(x)=w23, low(x)=w24)
  Build Array(w5, w6, w7, w8, w14, w15, w16, w17, w21, w22, w23, w24) -> w25
  $"U8 header array" <- w25
  $CRC <- w18
  Split Number(x=w2) -> (high(x)=w26, low(x)=w27)
  Split Number(x=w26) -> (high(x)=w28, low(x)=w29)
  Split Number(x=w27) -> (high(x)=w30, low(x)=w31)
  Build Array(w28, w29, w30, w31) -> w32
  Build Array[ConcatenateInputs=True](w25, $"U8 input data array", w32) -> w33
  $"U8 data array" <- w33
