vi "DTP Check Header and CRC.gvi"   [LabVIEW Communications System Design Suite 2.0.1]
inputs:
  "input data array": u8[]
  "array header offset": i32
outputs:
  "counter": u16
  "length": u16
  "header CRC ok": bool
  "header found": bool
diagram:
  call "DTP Header.gvi"() -> (DTP sync word=w1, sync word length=w2)
  To Long Integer(number=w2) -> w3
  Array Subset(array=$"input data array", index0=$"array header offset", length0=w3) -> w4
  Type Cast(type=u32 0x0, x=w4) -> w5
  Is Equal(x=w1, y=w5) -> w6
  $"header found" <- w6
  Add($"array header offset", 4) -> w7
  Array Subset(array=$"input data array", index0=w7, length0=4) -> w8
  Type Cast(type=u32 0x0, x=w8) -> w9
  Split Number(x=w9) -> (high(x)=w10, low(x)=w11)
  $counter <- w10
  $length <- w11
  Add($"array header offset", 8) -> w12
  Array Subset(array=$"input data array", index0=w12, length0=4) -> w13
  Type Cast(type=u32 0x0, x=w13) -> w14
  Logical Exclusive Or(w5, w9) -> w15
  Is Equal(x=w15, y=w14) -> w16
  $"header CRC ok" <- w16
