vi "Get Socket Option.gvi"   [LabVIEW Communications System Design Suite 2.0.1]
# Wrapper around getsockopt Windows winsock API call. The wrapper supports calls that return an U32 only.
inputs:
  "connection in": UdpNetworkConnectionRefnum  # Reference to UDP socket
  "level": i32 = 65535  # The level at which the option is defined, e.g. SOL_SOCKET (0xFFFF).
  "error in": error
  "option name": i32 = 4098  # The socket option for which the value is to be retrieved, e.g. SO_RCVBUF (0x1002). The option name value must be a socket option defined within the specified level, or behavior is undefined.
outputs:
  "connection out": UdpNetworkConnectionRefnum  # Reference to UDP socket
  "error out": error
  "value": u32  # The value for the requested option.
diagram:
  $"connection out" <- $"connection in"
  disable {
    frame OS != "Win", Default {
      w1 = default
      w2 = $"error in"
    }
    frame OS == "Win" {
      Type Cast(type=u32 0, x=$"connection in") -> w3
      Native Method Call(error in=$"error in", nc=w3) -> (error out=w4, rawnetobject out=w5, return=w6)
      Is Equal To 0(x=w6) -> w7
      case (w7) {
        frame False, Default {
          Call Chain() -> (callchain=w8)
          Concatenate Strings(w8) -> w9
          Format Into String(formatString="NCGetRawObjectName failed: error code %d\r\nCall chain: %s", w6, w9) -> w10
          Property Node(instance in=no error, "status"=TRUE, "code"=-1, "source"=w10) -> (instance out=w11)
          Merge Errors(w4, w11) -> (error out=w2)
          w1 = default
        }
        frame True {
          Native Method Call(error in=w4, protocol=$level, selector=$"option name", size in=4, socket=w5, value in=0) -> (error out=w12, return=w13, value out=w14)
          Is Equal To 0(x=w13) -> w15
          case (w15) {
            frame True {
              w1 = w14
              w2 = w12
            }
            frame False {
              Call Chain() -> (callchain=w16)
              Concatenate Strings(w16) -> w17
              Format Into String(formatString="getsockopt failed: error code %d\r\nCall chain: %s", w13, w17) -> w18
              Property Node(instance in=no error, "status"=TRUE, "code"=-1, "source"=w18) -> (instance out=w19)
              Merge Errors(w12, w19) -> (error out=w2)
              w1 = default
            }
          }
        }
      }
    }
  }
  $"error out" <- w2
  $value <- w1
