vi "PN9 Sequence Generator.gvi"   [LabVIEW Communications System Design Suite 2.0.1]
inputs:
  "samples": u16 = 511
  "seed": u16 = 511
outputs:
  "sequence": u8[]
diagram:
  To Long Integer(number=$samples) -> w1
  Number To Boolean Array(number=$seed) -> (Boolean array=w2)
  Array Index(array=w2) -> (out0[_]=w3, out1[_]=w4, out2[_]=w5, out3[_]=w6, out4[_]=w7, out5[_]=w8, out6[_]=w9, out7[_]=w10, out8[_]=w11)
  s1 = w3  # shift register
  s1.prev1 = w4  # shift register
  s1.prev2 = w5  # shift register
  s1.prev3 = w6  # shift register
  s1.prev4 = w7  # shift register
  s1.prev5 = w8  # shift register
  s1.prev6 = w9  # shift register
  s1.prev7 = w10  # shift register
  s1.prev8 = w11  # shift register
  for (N = w1) {
    Build Array(s1, s1.prev1, s1.prev2, s1.prev3, s1.prev4, s1.prev5, s1.prev6, s1.prev7) -> w13
    Reverse 1D Array(array=w13) -> (reversed array=w14)
    Boolean Array To Number(Boolean array=w14) -> (number=w15)
    To Unsigned Byte Integer(number=w15) -> w16
    Logical Exclusive Or(s1.prev3, s1.prev8) -> w17
    append w16 to w12
    next s1 = w17
  }
  $sequence <- w12
