vi "Random Unsigned.gvi"   [LabVIEW Communications System Design Suite 2.0.1]
inputs:
  "seed": i32 = 1
  "number of samples": i32 = 2
  "max": u32 = 1
  "error in": error
  "reset": bool = TRUE
outputs:
  "samples": u32[]
  "error out": error
uses:
  NI::Analysis::Generation::Uniform White Noise.gvi
diagram:
  Is Equal To 0(x=$"number of samples") -> w1
  case (w1) {
    frame True {
      # do not call randomizer for empty arrays
      w2 = f64[] []
      w3 = $"error in"
    }
    frame False {
      To Double Precision Float(number=$max) -> w4
      Divide(x=w4, y=2) -> w5
      call "Uniform White Noise.gvi"(samples=$"number of samples", amplitude=w5, seed=$seed, reset=$reset, error in=$"error in", offset=w5) -> (uniform white noise=w6, error out=w3)
      Round To Nearest(number=w6) -> w2
    }
  }
  To Unsigned Long Integer(number=w2) -> w7
  $samples <- w7
  $"error out" <- w3
