vi "Set Socket Option.gvi"   [LabVIEW Communications System Design Suite 2.0.1]
# Wrapper around setsockopt Windows winsock API call. The wrapper supports calls that use a U32 value only.
inputs:
  "connection in": UdpNetworkConnectionRefnum  # Reference to UDP socket
  "level": i32 = 65535  # The level at which the option is defined, e.g. SOL_SOCKET (0xFFFF).
  "option name": i32 = 4098  # The socket option for which the value is to be set, e.g. SO_RCVBUF (0x1002). The option name value must be a socket option defined within the specified level, or behavior is undefined.
  "value": u32  # The value for the requested option.
  "error in": error
outputs:
  "error out": error
  "connection out": UdpNetworkConnectionRefnum  # Reference to UDP socket
diagram:
  $"connection out" <- $"connection in"
  disable {
    frame OS != "Win", Default {
      w1 = $"error in"
    }
    frame OS == "Win" {
      Type Cast(type=u32 0, x=$"connection in") -> w2
      Native Method Call(error in=$"error in", nc=w2) -> (error out=w3, rawnetobject out=w4, return=w5)  # LabVIEW:NCGetRawNetObject
      Is Equal To 0(x=w5) -> w6
      case (w6) {
        frame False, Default {
          Call Chain() -> (callchain=w7)
          Concatenate Strings(w7) -> w8
          Format Into String(formatString="NCGetRawObjectName failed: error code %d\r\nCall chain: %s", w5, w8) -> w9
          Property Node(instance in=no error, "status"=TRUE, "code"=-1, "source"=w9) -> (instance out=w10)
          Merge Errors(w3, w10) -> (error out=w1)
        }
        frame True {
          Native Method Call(error in=w3, protocol=$level, selector=$"option name", size=4, socket=w4, value in=$value) -> (error out=w11, return=w12)
          Is Equal To 0(x=w12) -> w13
          case (w13) {
            frame True {
              w1 = w11
            }
            frame False {
              Call Chain() -> (callchain=w14)
              Concatenate Strings(w14) -> w15
              Format Into String(formatString="setsockopt failed: error code %d\r\nCall chain: %s", w12, w15) -> w16
              Property Node(instance in=no error, "status"=TRUE, "code"=-1, "source"=w16) -> (instance out=w17)
              Merge Errors(w11, w17) -> (error out=w1)
            }
          }
        }
      }
    }
  }
  $"error out" <- w1
