vi "Stop On Error.gvi"   [LabVIEW Communications System Design Suite 2.0.1]
# Enqueue an element into the stop notifier if error in indicates an error. Call after each loop on host top level to synchronize host shut down in case of any error.
inputs:
  "error in": error
outputs:
  "error out": error
diagram:
  call "Is Error.gvi"(error in=$"error in") -> (is error?=w1)
  call "Create Stop.gvi"(error in=no error, stop in=w1) -> (error out=w2)
  # create stop in case of an error
  Merge Errors($"error in", w2) -> (error out=w3)
  $"error out" <- w3
