vi "U32 to CFX1.15.gvi"   [LabVIEW Communications System Design Suite 2.0.1]
inputs:
  "data in": u32[]
outputs:
  "data out": CFXP(1.15)[]
diagram:
  Split Number(x=$"data in") -> (high(x)=w1, low(x)=w2)
  To Word Integer(number=w2) -> w3
  Reinterpret Number[RestrictToSameWordLength=True](data in=w3, type=FXP(1.15) 0) -> (data out=w4)
  To Word Integer(number=w1) -> w5
  Reinterpret Number[RestrictToSameWordLength=True](data in=w5, type=FXP(1.15) 0) -> (data out=w6)
  Real And Imaginary To Complex(x=w4, y=w6) -> w7
  $"data out" <- w7
