vi "U32 to CFX2.14.gvi"   [LabVIEW Communications System Design Suite 2.0.1]
# Converts unsigned 32 bit integer to CFX2.14.
# The upper 16 bit are mapped to the imaginary part
# and the lower 16 bit to the real part.
# no latency
inputs:
  "data in": u32[]  # value as as unsigned 32 bit integer
outputs:
  "data out": CFXP(2.14)[]  # conversion result CFX2.14
diagram:
  Split Number(x=$"data in") -> (high(x)=w1, low(x)=w2)
  To Word Integer(number=w2) -> w3
  Reinterpret Number[RestrictToSameWordLength=True](data in=w3, type=FXP(2.14) 0) -> (data out=w4)
  To Word Integer(number=w1) -> w5
  Reinterpret Number[RestrictToSameWordLength=True](data in=w5, type=FXP(2.14) 0) -> (data out=w6)
  Real And Imaginary To Complex(x=w4, y=w6) -> w7
  $"data out" <- w7
