vi "U32 to CFX3.13.gvi"   [LabVIEW Communications System Design Suite 2.0.1]
# Converts a U32 to a 3.13 complex fix point. The real part is taken from the low 16 bit whereas the imaginary component is taken from the high 16 bit.
inputs:
  "data in": u32[]  # value as as unsigned 32 bit integer
outputs:
  "data out": CFXP(3.13)[]  # conversion result CFX3.13
diagram:
  Split Number(x=$"data in") -> (high(x)=w1, low(x)=w2)
  To Word Integer(number=w2) -> w3
  Reinterpret Number[RestrictToSameWordLength=True](data in=w3, type=FXP(3.13) 0) -> (data out=w4)
  To Word Integer(number=w1) -> w5
  Reinterpret Number[RestrictToSameWordLength=True](data in=w5, type=FXP(3.13) 0) -> (data out=w6)
  Real And Imaginary To Complex(x=w4, y=w6) -> w7
  $"data out" <- w7
