vi "U64 to CFX10.15.gvi"   [LabVIEW Communications System Design Suite 2.0.1]
# Converts unsigned 32 bit integer to CFX2.14.
# The upper 16 bit are mapped to the imaginary part
# and the lower 16 bit to the real part.
# no latency
inputs:
  "data in": u64[]  # value as as unsigned 32 bit integer
outputs:
  "data out": CFXP(10.15)[]  # conversion result CFX2.14
diagram:
  Split Number(x=$"data in") -> (high(x)=w1, low(x)=w2)
  To Long Integer(number=w2) -> w3
  Reinterpret Number[RestrictToSameWordLength=True](data in=w3, type=FXP(17.15) 0) -> (data out=w4)
  To Fixed Point(number=w4) -> w5: FXP(10.15)[] Wrap:Truncate
  To Long Integer(number=w1) -> w6
  Reinterpret Number[RestrictToSameWordLength=True](data in=w6, type=FXP(17.15) 0) -> (data out=w7)
  To Fixed Point(number=w7) -> w8: FXP(10.15)[] Wrap:Truncate
  Real And Imaginary To Complex(x=w5, y=w8) -> w9
  $"data out" <- w9
