vi "Read Device Bandwidth.gvi"   [LabVIEW Communications System Design Suite 2.0.1]
inputs:
  "FPGA reference": any
  "error in": error
outputs:
  "error out": error
  "bandwidth": string
  "rio interface number": u32
diagram:
  call "getRioInterfaceNumberFromFpgaRef.gvi"(FPGA VI reference=$"FPGA reference", error in=$"error in") -> (rio interface number=w1, error out=w2)
  call "niusrprio_open.gvi"(rio interface number=w1, error in=w2) -> (handle=w3, error out=w4)
  w5 = 0x9209  # properties subsystem
  w6 = 2  # bandwidth property
  call "niusrprio_read.gvi"(handle=w3, subsystem=w5, offset=w6, size=16, error in=w4) -> (handle 2=w7, data=w8, error out=w9)
  Search 1D Array(1D array=w8, element=0) -> (index of element=w10)
  Split 1D Array(array=w8, index=w10) -> (first subarray=w11)
  Byte Array To String(encoding="Extended ASCII", error in=w9, unsigned byte array=w11) -> (error out=w12, string=w13)
  call "niusrprio_close.gvi"(handle=w7, error in=w12) -> (error out=w14)
  $"error out" <- w14
  $bandwidth <- w13
  $"rio interface number" <- w1
