vi "802.11 FPGA STA.gvi"   [LabVIEW Communications System Design Suite 2.0.1]
panel controls:
  "reg.host read.go rcvd 0": bool
  "reg.notify host.go rcvd 0": bool
  "reg.reset 0": bool
  "RF 0/Rx/Enable": bool
  "RF 0/Tx/Enable": bool
  "RF 1/Rx/Enable": bool
  "RF 1/Tx/Enable": bool
  "ATR State": enum{"Idle", "Rx", "Tx", "Duplex"} = "Idle"
  "Radio Control Destination": T1 = "Radio 0 Config"
  "lo lpf enable": bool
  "power enable": bool
  "mixer enable": bool
  "tx.configuration": T2 = {"power enable"=TRUE, "mixer enable"=TRUE, "gain"=0}
  "RX data source": T3 = "RF"
  "packet start sample index": u16
  "rearm packet start generator": bool
  "bypass synchronization": bool
  "reset MAC RX statistics": bool
  "noise coefficient": FXP(8.8) = 10
  "mute RX while TX active?": bool = TRUE
  "number of samples to capture": u16 = 1024
  "produce silent samples": bool
  "MPDU filter config": T7 = {"remove header"=TRUE, "block unsupported frame types"=TRUE, "block FCS errors"=TRUE, "block address mismatch"=TRUE, "block header recognize error"=TRUE}
  "power calibration offset": FXP(10.3)
  "CCA energy detect threshold": FXP(10.3) = -62
  "RF gain": FXP(10.3)
  "number of samples before trigger": u16
  "synchronization settings": T8 = {"maximal normalization threshold"=65536, "peak timing metric threshold"=0.5, "consecutive samples over threshold"=10, "valley timing metric threshold"=-0.5, "consecutive samples under threshold"=10, "autocorelation threshold"=0.5, "expected peak valley distance"=608, "maximum peak valley distance deviation"=64, "samples to shift frame start"=-32, "use static CFO?"=FALSE, "static CFO"=0}
  "trigger condition": T9 = "Immediate"
  "manual trigger": bool
  "AGC tresholds": T10
  "AGC timeout": i32 = 3500
  "enable AGC": bool
  "manual PhyTxStart.req": cluster{"TX vector": T11, "Valid": bool}
  "bypass MAC TX": bool
  "RX TX turnaround time": u32 = 24
  "reset MAC TX statistics": bool
  "suppress ACK": bool
  "backoff value": u16
  "ACK bandwidth": enum{"20 MHz", "40 MHz", "80 MHz"} = "20 MHz"
  "rx.reset": bool = TRUE
  "rx.output sample rate": UFXP(1.47)
  "rx.delay": FXP(0.16)
  "rx 0.frequency shift": FXP(0.48)
  "rx 0.phase": FXP(0.21)
  "rx 0.impairments": T13 = {"inline gain I"=-1, "inline gain Q"=0.999992370605, "cross gain I"=0.999992370605, "cross gain Q"=0, "pre-gain offset I"=0, "pre-gain offset Q"=-1, "post-gain offset I"=0, "post-gain offset Q"=0.999992370605}
  "rx.abort": bool
  "tx.abort": bool
  "tx.reset": bool = TRUE
  "tx.input sample rate": UFXP(1.47)
  "tx.delay": FXP(0.18)
  "tx 0.frequency shift": FXP(0.48)
  "tx 0.phase": FXP(0.21)
  "tx 0.impairments": T13 = {"inline gain I"=0.999992370605, "inline gain Q"=0.999992370605, "post-gain offset I"=0.999992370605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}
  "tx 0.gain": T14 = {"gain I"=1, "gain Q"=1}
  "rx 1.impairments": T13 = {"inline gain I"=-0.999992370605, "inline gain Q"=0.999992370605, "cross gain I"=-0.999992370605, "cross gain Q"=0, "pre-gain offset I"=-1, "pre-gain offset Q"=0, "post-gain offset I"=0, "post-gain offset Q"=0}
  "rx 1.frequency shift": FXP(0.48)
  "rx 1.phase": FXP(0.21)
  "tx 1.impairments": T13 = {"inline gain I"=0.999992370605, "inline gain Q"=0.999992370605, "post-gain offset I"=-1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}
  "tx 1.frequency shift": FXP(0.48)
  "tx 1.phase": FXP(0.21)
  "tx 1.gain": T14 = {"gain I"=1, "gain Q"=1}
  "rx 0.stream enable": bool
  "rx 1.stream enable": bool
  "tx 0.stream enable": bool
  "tx 1.stream enable": bool
  "Data clock cycles per tick (0.1us)": u16 = 20
  "Data clock cycles per OFDM symbol": u16 = 480
  "rx.rf channel": UFXP(1.0)
  "tx.rf channel": UFXP(1.0)
  "enable DC offset correction": bool = TRUE
  "data clock locked?": bool
  "format": enum{"a", "ac"} = "a"
  "channel selector": UFXP(2.0)
  "device MAC address": u8[6]
  "DC centered signal": bool = TRUE
  "daughterboard": "niUsrpRio Config v1 Host.lvlib__DB Types.gtype" = "sbx"
  "antenna configuration": "niUsrpRio Config v1 Host.lvlib__Antenna Configuration.gtype" = "TX1 RX1 transmits and RX2 receives"
  "spi address": u8 = 7
  "cpld enable": bool = TRUE
  "time to wait for CCA signal detect": u32
  "time to wait for decoding packet": u32
panel indicators:
  "reg.notify host.go 0": bool
  "reg.host read.data 0": cluster{"go": bool, "data": u32}
  "compensated CFO": FXP(0.48)
  "MAC RX statistics": T4
  "PhyRxStart.ind": T5
  "PhyRxEnd.ind": T6
  "T2H RX Data overflow": u16
  "T2H Constallation overflow": u16
  "T2H RX Bit Processing Output FIFO overflow": u16
  "T2H RX Power Spectrum overflow": u16
  "T2H Channel Estimation overflow": u16
  "last applied gain": UFXP(5.1)
  "RF input power at packet start": FXP(10.3)
  "signal power at packet start": FXP(10.3)
  "RF input power": FXP(10.3)
  "signal power": FXP(10.3)
  "out of range?": bool
  "MAC TX statistics": T12
  "PhyTxStart.req": cluster{"TX vector": T11, "Valid": bool}
  "PhyTxEnd.ind": cluster{"Valid": bool}
  "internal loopback FIFO overflow": u16
  "TX to RF FIFO overflow": u16
  "T2H TX Baseband FIFO overflow": u16
  "T2H TX Bit Processing Output FIFO overflow": u16
  "rx.samples processed": u32
  "rx.number of IQ data overflows": u64
  "rx.number of overflows": u32
  "tx.samples processed": u32
  "tx.underflows": u32
  "tx.number of IQ data overflows": u64
  "rx.dsp reset done": bool
  "tx.dsp reset done": bool
  "tx.state": "Stream Control State.gtype"
  "rx.state": "Stream Control State.gtype"
  "Timestamp": u32
  "DC average": CFXP(1.17)
types:
  T1 = enum{"Identification", "Board Config", "Global Config", "Radio 0 Config", "Radio 1 Config", "Synchronization", "Time", "Future Events"}
  T2 = cluster{"power enable": bool, "mixer enable": bool, "gain": u8}
  T3 = enum{"RF", "BB Data From Host", "Internal Loopback"}
  T4 = cluster{"number of frames detected": u32, "number of subframes received": u32, "number of valid subframes received": u32, "number of ACKs received": u32, "valid": bool}
  T5 = cluster{"Format": enum{"a", "ac"}, "Bandwidth": enum{"20 MHz", "40 MHz", "80 MHz"}, "PSDU Length": u32, "MCS": UFXP(4.0), "valid": bool}
  T6 = cluster{"Format Violation": bool, "Timing valid": bool, "Timing value": u32, "valid": bool}
  T7 = cluster{"remove header": bool, "block unsupported frame types": bool, "block FCS errors": bool, "block address mismatch": bool, "block header recognize error": bool}
  T8 = cluster{"maximal normalization threshold": UFXP(19.15), "peak timing metric threshold": FXP(2.6), "consecutive samples over threshold": u8, "valley timing metric threshold": FXP(2.6), "consecutive samples under threshold": u8, "autocorelation threshold": UFXP(2.14), "expected peak valley distance": u16, "maximum peak valley distance deviation": u8, "samples to shift frame start": i8, "use static CFO?": bool, "static CFO": FXP(0.48)}
  T9 = enum{"Immediate", "RX Packet Start", "TX Paket Start", "CCA energy detected"}
  T10 = cluster{"AGC active threshold": FXP(10.3), "AGC threshold 1": FXP(10.3), "AGC threshold 2": FXP(10.3), "AGC threshold 3": FXP(10.3)}
  T11 = cluster{"format": enum{"a", "ac"}, "bandwidth": enum{"20 MHz", "40 MHz", "80 MHz"}, "length": u32, "MCS": UFXP(4.0), "TX power level": UFXP(4.0), "Scrambler seed": UFXP(7.0)}
  T12 = cluster{"number of TX after SIFS requests detected": u32, "number of TX after SIFS requests completed": u32, "number of TX after backoff requests detected": u32, "number of TX after backoff requests completed": u32}
  T13 = cluster{"inline gain I": FXP(1.17), "inline gain Q": FXP(1.17), "cross gain I": FXP(1.17), "cross gain Q": FXP(1.17), "pre-gain offset I": FXP(1.17), "pre-gain offset Q": FXP(1.17), "post-gain offset I": FXP(1.17), "post-gain offset Q": FXP(1.17)}
  T14 = cluster{"gain I": FXP(3.21), "gain Q": FXP(3.21)}
  "Stream Control State.gtype" = enum{"Idle", "Active"}
  "niUsrpRio Config v1 Host.lvlib__DB Types.gtype" = enum{"sbx", "cbx", "wbx", "unknown", "ubx"}
  "niUsrpRio Config v1 Host.lvlib__Antenna Configuration.gtype" = enum{"TX1 RX1 transmits and RX2 receives", "TX1 RX1 receives and RX2 is unused"}
  T15 = cluster{"CCA energy detection busy": u8, "CCA signal detection busy": bool, "frame timing valid": bool, "frame timing value": u32, "frame timing use DIFS": bool}
  T16 = cluster{"MPDU subtype": enum{"ACK"}, "destination MAC address": u8[6], "valid": bool}
  T17 = cluster{"5 MHz": bool, "10 MHz": bool, "20 MHz": bool, "40 MHz": bool, "80 Mhz": bool, "160 MHz": bool}
  T18 = cluster{"format": enum{"a", "ac"}, "channel selector": UFXP(2.0), "device MAC address": u8[6], "DC centered signal": bool, "supported bandwidths": T17}
  T19 = cluster{"CCA energy detection busy": u8, "CCA signal detection busy": bool}
  T20 = cluster{"global timestamp": RegisterDataType<u32>, "OFDM symbol pulse": RegisterDataType<bool>, "TX active": RegisterDataType<bool>, "channel state indication": RegisterDataType<T15>, "MPDU generation request": RegisterDataType<T16>, "shared properties": RegisterDataType<T18>, "PHY CCA indication": RegisterDataType<T19>, "TX after backoff done": RegisterDataType<bool>}
  T21 = cluster{"CCA energy detection busy": u8, "CCA signal betection busy": bool}
  T22 = enum{"Idle", "Wait for second measurement", "AGC active", "Gain locked"}
  T23 = cluster{"trigger gain setting": bool, "gain": UFXP(5.1)}
  "802.11 PHY-SAP.gtype" = cluster{"PSDU (RX)": any, "PSDU (TX)": any, "CCA detection": RegisterDataType<T19>, "PhyRxStart.req": HandshakeDataType<T5>, "PhyRxEnd.ind": HandshakeDataType<T6>, "channel state indication": HandshakeDataType<T15>, "PhyTxStart.req": HandshakeDataType<cluster{"TX vector": T11, "Valid": bool}>, "PhyTxEnd.ind": HandshakeDataType<cluster{"Valid": bool}>, "PHY RX AGC state indication": HandshakeDataType<cluster{"AGC state": T22, "AGC enabled": bool}>, "PHY RX Gain change indication": HandshakeDataType<T23>}
  "H2T TX Data FIFOs.gtype" = cluster{"H2T TX Data 0": any, "H2T TX Data 1": any, "H2T TX Data 2": any, "H2T TX Data 3": any, "H2T TX Data 4": any}
  T24 = cluster{"RF to RX FIFO": any, "internal loopback FIFO": any, "TX to RF FIFO": any, "Gain Settings FIFO": any}
  T25 = cluster{"output sample rate": UFXP(1.47), "delay": FXP(0.16), "frequency shift": FXP(0.48), "impairments": T13, "phase": FXP(0.21)}
  T26 = cluster{"frequency shift": FXP(0.48), "impairments": T13, "phase": FXP(0.21), "input sample rate": UFXP(1.47), "gain": T14, "delay": FXP(0.18)}
diagram:
  Register Create(initial value=0) -> (reference out=w1)
  Register Create(initial value=FALSE) -> (reference out=w2)
  w3 = T16 {"MPDU subtype"="ACK", "destination MAC address"=[0, 0, 0, 0, 0, 0], "valid"=FALSE}
  Register Create(initial value=w3) -> (reference out=w4)
  Register Create(initial value=FALSE) -> (reference out=w5)
  Register Create(initial value=T15 {all zero or empty}) -> (reference out=w6)
  w7 = T18 {"format"="a", "channel selector"=0, "device MAC address"=[0, 0, 0, 0, 0, 0], "DC centered signal"=FALSE, "supported bandwidths"={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}}
  Register Create(initial value=w7) -> (reference out=w8)
  Register Create(initial value=T21 {all zero or empty}) -> (reference out=w9)
  Register Create(initial value=FALSE) -> (reference out=w10)
  Property Node(instance in=T20 {all zero or empty}, "global timestamp"=w1, "MPDU generation request"=w4, "channel state indication"=w6, "TX active"=w5, "OFDM symbol pulse"=w2, "shared properties"=w8, "PHY CCA indication"=w9, "TX after backoff done"=w10) -> (instance out=w11)
  FIFO Create(data type=u8 0) -> (reference out=w12)
  FIFO Create(data type=u8 0) -> (reference out=w13)
  Register Create(initial value=T19 {all zero or empty}) -> (reference out=w14)
  Handshake Create(data type=T5 {all zero or empty}) -> (reference out=w15)
  Handshake Create(data type=T6 {all zero or empty}) -> (reference out=w16)
  Handshake Create(data type=T15 {all zero or empty}) -> (reference out=w17)
  Handshake Create(data type=cluster{"TX vector": T11, "Valid": bool} {all zero or empty}) -> (reference out=w18)
  Handshake Create(data type=cluster{"Valid": bool} {all zero or empty}) -> (reference out=w19)
  w20 = cluster{"AGC state": T22, "AGC enabled": bool} {all zero or empty}
  Handshake Create(data type=w20) -> (reference out=w21)
  Handshake Create(data type=T23 {all zero or empty}) -> (reference out=w22)
  Property Node(instance in="802.11 PHY-SAP.gtype" {all zero or empty}, "PSDU (RX)"=w12, "PSDU (TX)"=w13, "CCA detection"=w14, "PhyRxStart.req"=w15, "PhyRxEnd.ind"=w16, "channel state indication"=w17, "PhyTxStart.req"=w18, "PhyTxEnd.ind"=w19, "PHY RX AGC state indication"=w21, "PHY RX Gain change indication"=w22) -> (instance out=w23)
  clock-driven loop (clock = "802.11 AFW Resources.grsc\\MAC") forever {
    call "802.11 PHY-SAP Read MAC.gcdl"(PHY-SAP=w23) -> (CCA detection=w24, PSDU=w25, PSDU valid=w26, PhyRxStart.req=w27, PhyTxEnd.ind=w28, PhyRxEnd.ind=w29, PHY RX AGC state indication=w30, PHY RX Gain change indication=w31)
    Property Node(instance in=w27) -> ("valid"=w32)
    Feedback Node(enable?=w32, initial value=u8[6] default, input=w33) -> w34
    call "802.11 MAC RX.gcdl"(PSDU=w25, input valid=w26, PHY RX start indication=w27, PHY RX end indication=w29, PHY CCA timing indication=w24, reset MAC RX statistics=$"reset MAC RX statistics", device MAC address=w34, MPDU filter config=$"MPDU filter config") -> (MAC RX statistics=w35, channel state indication=w36, ICP SDU=w37, output valid=w38, MPDU generation request=w39, ACK Received Pulse=w40)
    call "802.11 RX Data Sink.gcdl"(ICP SDU=w37, input valid=w38, FIFO reference="802.11 AFW Resources.grsc\\T2H RX Data") -> (FIFO overflow count=w41)
    $"T2H RX Data overflow" <- w41
    w42 = "H2T TX Data FIFOs.gtype" {"H2T TX Data 0"="802.11 AFW Resources.grsc\\H2T TX Data 0", "H2T TX Data 1"="802.11 AFW Resources.grsc\\H2T TX Data 1", "H2T TX Data 2"="802.11 AFW Resources.grsc\\H2T TX Data 2", "H2T TX Data 3"="802.11 AFW Resources.grsc\\H2T TX Data 3", "H2T TX Data 4"="802.11 AFW Resources.grsc\\H2T TX Data 4"}
    Feedback Node(input=w43) -> w44
    call "FPGA MAC Scheduler.gcdl"(Force manual ID=FALSE, Number of TX FIFOs=5, H2T TX Data Queues=w42, Ready for scheduling=w44) -> (H2T TX Data=w45)
    Property Node(instance in=w11) -> ("shared properties"=w46, "global timestamp"=w47, "channel state indication"=w48, "PHY CCA indication"=w49, "TX after backoff done"=w50)
    Register Read(reference in=w47) -> (data=w51)
    # w52: channel state indication
    Register Write(data=w36, reference in=w48) -> (reference out=w52)
    # w51: global time reference
    Register Read(reference in=w52) -> (data=w53)
    Register Read(reference in=w46) -> (data=w54)
    Property Node(instance in=w54) -> ("format"=w55, "device MAC address"=w33)
    # w39: MPDU request
    Feedback Node(input=w56) -> w57
    call "802.11 Prepare ACK.gcdl"(format=w55, bandwidth=$"ACK bandwidth", MPDU generation request=w39, MAC ready=w57, suppress=$"suppress ACK") -> (MPDU block=w58, output valid=w59, TX after SIFS request=w60)
    call "802.11 TX Data Source.gcdl"(ready for output=w44, H2T TX Data=w45, bypass MAC TX=$"bypass MAC TX") -> (ICP data=w61, output valid=w62, elements available=w63)
    Feedback Node(input=w64) -> w65
    Feedback Node(input=w66) -> w67
    call "802.11 Prepare MPDU.gcdl"(ICP=w61, input valid=w62, elements available=w63, MAC ready for input=w65, TX status indication=w67, backoff value=$"backoff value") -> (MPDU block=w68, ready for input=w43, output valid=w69, TX after backoff request=w70)
    Logical Or(w58, w68) -> w71
    Logical Or(w59, w69) -> w72
    Feedback Node(input=w73) -> w74
    call "802.11 MAC TX.gcdl"(TX after backoff request=w70, TX after SIFS request=w60, channel state indication=w53, global clock value=w51, RX TX turnaround time in global clock ticks=$"RX TX turnaround time", PSDU data ready for input=w74, PHY TX end indication=w28, MPDU block=w71, input valid=w72, reset MAC TX statistics=$"reset MAC TX statistics") -> (MPDU=w75, output valid=w76, PHY TX start request=w77, TX after SIFS data ready for input=w56, TX after backoff data ready for input=w64, TX status indication=w66, MAC TX statistics=w78)
    call "802.11 TX MAC Bypass.gcdl"(ready for output=w74, TX data FIFO reference=w45, bypass MAC TX=$"bypass MAC TX", manual PhyTxStart.req=$"manual PhyTxStart.req", MPDU=w75, input valid=w76, request in=w77) -> (PSDU=w79, output valid=w80, request out=w81)
    call "802.11 PHY-SAP Write MAC.gcdl"(PHY-SAP=w23, PhyTxStart.req=w81, PSDU=w79, PSDU valid=w80, channel state indication=w36) -> (PSDU TX ready for input=w73)
    $"MAC RX statistics" <- w35
    call "802.11 Write RX Events.gcdl"(global timestamp=w51, PHY RX start indication=w27, PHY RX end indication=w29, MAC channel state indication=w36, PHY CCA timing indication=w24, T2H FIFO reference="802.11 AFW Resources.grsc\\T2H Events", PHY RX Gain change indication=w31, PHY RX AGC state indication=w30)
    $"MAC TX statistics" <- w78
    Register Read(reference in=w49) -> (data=w82)
    Register Read(reference in=w50) -> (data=w83)
    call "Check ACK Received.gcdl"(ACK Received Pluse In=w40, TX after backoff done=w83, time to wait for CCA signal detect=$"time to wait for CCA signal detect", time to wait for decoding packet=$"time to wait for decoding packet", global clock counter=w51, PHY CCA indication=w82) -> (ID and Counter=w84)
    call "calculator.gcdl"(ID and Counter=w84)
    call "802.11 Capture PHY TX Indications.gcdl"(PHY TX end indication in=w28, PHY TX start request in=w81) -> (PHY TX start request out=w85, PHY TX end indication out=w86)
    $"PhyTxStart.req" <- w85
    $"PhyTxEnd.ind" <- w86
    call "802.11 Write TX Events.gcdl"(global time reference=w51, PHY TX end indication=w28, PHY TX start request=w81, TX status indication=w66, T2H FIFO reference="802.11 AFW Resources.grsc\\T2H Events")
  }
  FIFO Create(data type=CFXP(3.13) 0+0i, depth=17) -> (reference out=w87)
  FIFO Create(data type=CFXP(3.13) 0+0i, depth=1025) -> (reference out=w88)
  FIFO Create(data type=CFXP(3.13) 0+0i, depth=1025) -> (reference out=w89)
  FIFO Create(data type=UFXP(5.1) 0, depth=17) -> (reference out=w90)
  Property Node(instance in=T24 {all zero or empty}, "RF to RX FIFO"=w87, "internal loopback FIFO"=w88, "TX to RF FIFO"=w89, "Gain Settings FIFO"=w90) -> (instance out=w91)
  clock-driven loop (clock = "802.11 AFW Resources.grsc\\PHY") forever {
    Property Node(instance in=w11) -> ("global timestamp"=w92, "shared properties"=w93, "TX active"=w94, "OFDM symbol pulse"=w95)
    Register Read(reference in=w92) -> (data=w96)
    Property Node(instance in=w91) -> ("RF to RX FIFO"=w97, "internal loopback FIFO"=w98, "TX to RF FIFO"=w99, "Gain Settings FIFO"=w100)
    Register Read(reference in=w95) -> (data=w101, reference out=w102)
    Register Read(reference in=w93) -> (data=w103)
    # w101: Symbol trigger
    Property Node(instance in=w103) -> ("supported bandwidths"=w104, "DC centered signal"=w105, "channel selector"=w106)
    Feedback Node(input=w107) -> w108
    call "802.11 PHY-SAP Read PHY.gcdl"(PHY-SAP=w23, ready for output=w108) -> (PSDU=w109, PSDU valid=w110, PhyTxStart.req=w111)
    call "niInstr Basic Elements v1 FPGA.lvlib__Detect Rising Edge.gcdl"(signal=w101) -> (edge detected=w112)
    call "802.11 PHY TX Request Handler.gcdl"(symbol trigger in=w112, PhyTxStart.req=w111, supported bandwidths=w104) -> (symbol index=w113, symbol trigger out=w114, start of packet=w115, TX vector out=w116, PhyTxEnd.ind=w117, TX active=w118)
    Register Write(data=w118, reference in=w94) -> (reference out=w119)
    call "802.11 RX Data Source.gcdl"(RX data source=$"RX data source", mute RX while TX active?=$"mute RX while TX active?", TX active register=w119, RF to RX FIFO=w97, internal loopback FIFO=w98, OFDM symbol trigger register=w102, produce silent samples=$"produce silent samples", H2T FIFO="802.11 AFW Resources.grsc\\H2T RX Baseband") -> (sample=w120, output valid=w121)
    call "802.11 Signal Filter.gcdl"(sample in=w120, input valid=w121, configuration=w103) -> (20MHz sample out=w122, output valid=w123, 40MHz sample out=w124, 80MHz sample out=w125)
    Feedback Node(input=w126) -> w127
    call "802.11 Synchronization.gcdl"(bypass synchronization=$"bypass synchronization", rearm packet start generator=$"rearm packet start generator", packet start sample index=$"packet start sample index", synchronization settings=$"synchronization settings", rearm sychronization=w127, sample in=w120, input valid=w121, filtered sample=w122, filtered sample valid=w123) -> (sample out=w128, output valid=w129, packet start=w130, compensated CFO=w131, CCA signal detected=w132)
    w133 = T18 {"format"="a", "channel selector"=0, "device MAC address"=[0, 0, 0, 0, 0, 0], "DC centered signal"=FALSE, "supported bandwidths"={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}}
    Feedback Node(enable?=w130, initial value=w133, input=w103) -> w134
    Property Node(instance in=w134) -> ("format"=w135, instance out=w136)
    Feedback Node(input=w137) -> w138
    call "802.11 RX IQ Processing.gcdl"(sample=w128, input valid=w129, packet start=w130, configuration=w138) -> (subcarrier=w139, subcarrier timing=w140, subcarrier field map=w141, last sample received=w142, channel estimate=w143, channel estimate timing=w144)
    Feedback Node(input=w145) -> w146
    call "802.11 RX Bit Processing.gcdl"(subcarrier timing=w140, subcarrier=w139, field map=w141, configuration=w146, noise coefficient=$"noise coefficient") -> (current OFDM symbol=w147, PSDU=w148, bit=w149, bit valid=w150, last byte decoded=w151, PSDU valid=w152)
    call "802.11 RX PHY State Machine.gcdl"(bit=w149, bit valid=w150, shared properties=w136, current OFDM symbol=w147, last bit of packet decoded=w151, last sample of packet received=w142, global timestamp=w96) -> (RX bit processing configuration=w145, RX IQ processing configuration=w137, PhyRxStart.ind=w153, PhyRxEnd.ind=w154)
    Property Node(instance in=w154) -> ("valid"=w126)
    Feedback Node(input=w155) -> w156
    To Fixed Point(number=w156) -> w157: FXP(10.3) Saturate:ConvergentRounding
    Select(s=$"enable AGC", t=w157, f=$"RF gain") -> w158
    call "802.11 Power Measurement.gcdl"(sample=w125, input valid=w123, CCA energy detect threshold=$"CCA energy detect threshold", power calibration offset=$"power calibration offset", RF gain=w158, sample 20MHz filtered=w122, sample 40MHz filtered=w124) -> (signal power=w159, output valid=w160, out of range?=w161, CCA energy detect=w162, RF input power=w163)
    Property Node(instance in=T19 {all zero or empty}, "CCA energy detection busy"=w162, "CCA signal detection busy"=w132) -> (instance out=w164)
    call "802.11 AGC.gcdl"(signal power=w159, packet start=w130, rearm AGC=w127, AGC thresholds=$"AGC tresholds", AGC timeout=$"AGC timeout", signal power valid=w160, enable AGC=$"enable AGC") -> (gain=w165, trigger gain setting=w166, state=w167, last applied gain=w155)
    Property Node(instance in=T23 {all zero or empty}, "trigger gain setting"=w166, "gain"=w165) -> (instance out=w168)
    w169 = cluster{"AGC state": T22, "AGC enabled": bool} {all zero or empty}
    Property Node(instance in=w169, "AGC state"=w167, "AGC enabled"=$"enable AGC") -> (instance out=w170)
    call "802.11 PHY-SAP Write PHY.gcdl"(PHY-SAP=w23, PSDU valid=w152, PSDU=w148, CCA detection=w164, PhyRxEnd.ind=w154, PhyRxStart.ind=w153, PhyTxEnd.ind=w117, PHY RX Gain change indication=w168, PHY RX AGC state indication=w170)
    call "802.11 Prepare RX IQ Data for T2H.gcdl"(subcarrier=w139, timing=w140, field map=w141, FIFO reference="802.11 AFW Resources.grsc\\T2H Constellation") -> (FIFO overflow count=w171)
    $"T2H Constallation overflow" <- w171
    call "802.11 Prepare Channel Estimation for T2H.gcdl"(channel estimate=w143, timing=w144, format=w135, FIFO reference="802.11 AFW Resources.grsc\\T2H Channel Estimation") -> (FIFO overflow count=w172)
    $"T2H Channel Estimation overflow" <- w172
    call "802.11 Trigger Capture RX Samples.gcdl"(trigger condition=$"trigger condition", manual trigger=$"manual trigger", RX packet start=w130, TX active register=w119, CCA energy detected=w162) -> (trigger=w173)
    call "802.11 Capture RX Samples.gcdl"(sample=w128, input valid=w129, trigger=w173, number of samples to capture=$"number of samples to capture", FIFO reference="802.11 AFW Resources.grsc\\T2H RX Power Spectrum", number of samples before trigger=$"number of samples before trigger") -> (FIFO overflow count=w174)
    $"T2H RX Power Spectrum overflow" <- w174
    call "802.11 TX Bit Processing.gcdl"(symbol trigger=w114, OFDM symbol index=w113, TX vector=w116, PSDU=w109, input valid=w110) -> (bit=w175, output valid=w176, ready for input=w107, modulation=w177)
    call "802.11 TX IQ Processing.gcdl"(symbol trigger=w114, OFDM symbol index=w113, TX vector=w116, channel selector=w106, start of packet=w115, bit valid=w176, bit=w175, bit processing modulation=w177, DC centered signal=w105, supported bandwidths=w104) -> (data out=w178, output valid=w179)
    call "802.11 TX Data Sink.gcdl"(TX to RF FIFO=w99, internal loopback FIFO=w98, sample=w178, input valid=w179, T2H FIFO="802.11 AFW Resources.grsc\\T2H TX Baseband") -> (T2H FIFO overflow count=w180, TX to RF FIFO overflow count=w181, internal loopback FIFO overflow count=w182)
    $"T2H TX Baseband FIFO overflow" <- w180
    $"TX to RF FIFO overflow" <- w181
    $"compensated CFO" <- w131
    $"internal loopback FIFO overflow" <- w182
    call "802.11 RX Bit Processing Data Sink.gcdl"(PSDU=w148, input valid=w152, FIFO reference="802.11 AFW Resources.grsc\\T2H RX Bit Processing Output") -> (FIFO overflow count=w183)
    $"T2H RX Bit Processing Output FIFO overflow" <- w183
    call "802.11 TX Bit Processing Data Sink.gcdl"(bit=w175, input valid=w176, modulation=w177, FIFO reference="802.11 AFW Resources.grsc\\T2H TX Bit Processing Output") -> (FIFO overflow count=w184)
    $"T2H TX Bit Processing Output FIFO overflow" <- w184
    call "802.11 Capture PHY RX Indications.gcdl"(PHY RX start indication in=w153, PHY RX end indication in=w154) -> (PHY RX start indication out=w185, PHY RX end indication out=w186)
    $"PhyRxStart.ind" <- w185
    $"PhyRxEnd.ind" <- w186
    $"RF input power" <- w163
    Feedback Node(enable?=w130, input=w163) -> w187
    $"RF input power at packet start" <- w187
    $"signal power" <- w159
    Feedback Node(enable?=w130, input=w159) -> w188
    $"signal power at packet start" <- w188
    $"out of range?" <- w161
    FIFO Write(Control Protocol Input=w166, data=w165, reference in=w100)
    $"last applied gain" <- w155
  }
  call "Create Resources.gvi"() -> (config.resources=w189, sync.resources=w190, time.resources=w191)
  clock-driven loop (clock = "40 MHz Onboard Clock") {
    Io Write(data=$"RF 1/Rx/Enable", reference in="RF 1/Rx/Enable")
    Io Write(data=$"RF 0/Tx/Enable", reference in="RF 0/Tx/Enable")
    Io Write(data=$"RF 0/Rx/Enable", reference in="RF 0/Rx/Enable")
    Feedback Node(input=w192) -> w193
    Property Node(instance in=w91) -> ("Gain Settings FIFO"=w194)
    FIFO Read(Control Protocol Input=TRUE, reference in=w194) -> (Control Protocol Output=w192, data=w195)
    Feedback Node(enable?=w192, input=w195) -> w196
    To Fixed Point(number=w196) -> w197: UFXP(6.1) Wrap:Truncate
    # Register Bus and Required Controls/Indicators
    Scale By Power Of 2(n=1, x=w197) -> w198
    To Unsigned Byte Integer(number=w198) -> w199
    Property Node(instance in=T2 {"power enable"=TRUE, "mixer enable"=TRUE, "gain"=0}, "power enable"=$"power enable", "mixer enable"=$"mixer enable", "gain"=w199) -> (instance out=w200)
    call "Set Gain.gcdl"(ATR State=$"ATR State", Radio Control Destination=$"Radio Control Destination", FPGA.Fifo="802.11 AFW Resources.grsc\\AGC Reg Bus 0 Access FIFO", daughterboard=$daughterboard, antenna configuration=$"antenna configuration", Write ATR?=w193, lo lpf enable=$"lo lpf enable", rx.configuration=w200, tx.configuration=$"tx.configuration", spi address=$"spi address", cpld enable=$"cpld enable")
    Io Write(data=$"RF 1/Tx/Enable", reference in="RF 1/Tx/Enable")
    Feedback Node(input=w201) -> w202
    Property Node(instance in=w202) -> ("ready for port 0 input"=w203, "ready for port 1 input"=w204)
    Feedback Node(input=w205) -> w206
    call "niInstr Register Bus v1 FPGA.lvlib__Process.gcdl"(reg.notify host.go rcvd=$"reg.notify host.go rcvd 0", reg.host read.go rcvd=$"reg.host read.go rcvd 0", read completion=w206, reg.reset=$"reg.reset 0", reg.host instruction fifo="niInstr Register Bus v0.grsc\\reg.host instruction fifo 0", ready for output=w204) -> (reg.notify host.go=w207, reg.host read.data=w208, register instruction=w209)
    $"reg.notify host.go 0" <- w207
    $"reg.host read.data 0" <- w208
    FIFO Read(Control Protocol Input=w203, reference in="802.11 AFW Resources.grsc\\AGC Reg Bus 0 Access FIFO") -> (Control Protocol Output=w210, data=w211)
    call "Retrieve FPGA Scoped Instruction.gcdl"(number=w211, valid=w210) -> (output cluster=w212)
    Feedback Node(input=w213) -> w214
    call "niInstr Register Bus v1 FPGA.lvlib__Register Instruction Arbiter (2 inputs).gcdl"(port 0=w212, port 1=w209, reset=FALSE, ready for output=w214) -> (register instr out=w215, ready for input=w201)
    call "Registers.gcdl"(register instruction=w215, config.resources=w189, sync.resources=w190, time.resources=w191) -> (read completion out=w205, ready for input=w213)
    stop if FALSE
  }
  clock-driven loop (clock = "Data Clock") forever {
    # Baseband to/from RF conversion
    # Data Reception from Antenna, downconversion to baseband sample rate, received data will be written into RX baseband input FIFO
    # Reading of TX baseband FIFO, upconversion and transmission to antenna
    Property Node(instance in=w11) -> ("shared properties"=w216, "global timestamp"=w217, "OFDM symbol pulse"=w218)
    call "Mod N Indexer U16 v2.gcdl"(N=$"Data clock cycles per tick (0.1us)", enable=$"data clock locked?") -> (wrap back?=w219)
    call "niInstr Basic Elements v1 FPGA.lvlib__Count Up U32.gcdl"(increment=w219, reset=FALSE) -> (count out=w220)
    Register Write(data=w220, reference in=w217)
    call "Mod N Indexer U16 v2.gcdl"(N=$"Data clock cycles per OFDM symbol", enable=$"data clock locked?") -> (wrap back?=w221)
    Register Write(data=w221, reference in=w218)
    w222 = T17 {"5 MHz"=FALSE, "10 MHz"=FALSE, "20 MHz"=TRUE, "40 MHz"=TRUE, "80 Mhz"=FALSE, "160 MHz"=FALSE}
    w223 = T18 {"format"="a", "channel selector"=0, "device MAC address"=[0, 0, 0, 0, 0, 0], "DC centered signal"=FALSE, "supported bandwidths"={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}}
    Property Node(instance in=w223, "format"=$format, "channel selector"=$"channel selector", "device MAC address"=$"device MAC address", "DC centered signal"=$"DC centered signal", "supported bandwidths"=w222) -> (instance out=w224)
    Register Write(data=w224, reference in=w216)
    $Timestamp <- w220
    Property Node(instance in=w91) -> ("TX to RF FIFO"=w225, "RF to RX FIFO"=w226)
    Build Array($"rx 0.stream enable", $"rx 1.stream enable") -> w227
    w228 = T25 {"0x800000000000", 0, 0, "0x1FFFF", "0x1FFFF", 0, 0, 0, 0, 0, 0, 0}
    Property Node(instance in=w228, "impairments"=$"rx 0.impairments", "frequency shift"=$"rx 0.frequency shift", "phase"=$"rx 0.phase", "output sample rate"=$"rx.output sample rate", "delay"=$"rx.delay") -> (instance out=w229)
    w230 = T25 {"0x800000000000", 0, 0, "0x1FFFF", "0x1FFFF", 0, 0, 0, 0, 0, 0, 0}
    Property Node(instance in=w230, "delay"=$"rx.delay", "output sample rate"=$"rx.output sample rate", "impairments"=$"rx 1.impairments", "frequency shift"=$"rx 1.frequency shift", "phase"=$"rx 1.phase") -> (instance out=w231)
    Build Array(w229, w231) -> w232
    call "802.11 USRP Stream RX.gcdl"(RF to RX FIFO reference=w226, enable DC offset correction=$"enable DC offset correction", rx.reset=$"rx.reset", rx.rf channel=$"rx.rf channel", rx. stream enabled=w227, rx.abort=$"rx.abort", DDC parameters=w232) -> (rx.number of IQ data overflows=w233, rx.dsp reset done=w234, DC average=w235, rx.state=w236, rx.samples processed=w237, rx.number of overflows=w238)
    $"rx.number of IQ data overflows" <- w233
    Build Array($"tx 0.stream enable", $"tx 1.stream enable") -> w239
    w240 = T26 {0, "0x1FFFF", "0x1FFFF", 0, 0, 0, 0, 0, 0, 0, 0, "0x200000", "0x200000", 0}
    Property Node(instance in=w240, "gain"=$"tx 0.gain", "frequency shift"=$"tx 0.frequency shift", "phase"=$"tx 0.phase", "impairments"=$"tx 0.impairments", "input sample rate"=$"tx.input sample rate", "delay"=$"tx.delay") -> (instance out=w241)
    w242 = T26 {0, "0x1FFFF", "0x1FFFF", 0, 0, 0, 0, 0, 0, 0, 0, "0x200000", "0x200000", 0}
    Property Node(instance in=w242, "delay"=$"tx.delay", "input sample rate"=$"tx.input sample rate", "gain"=$"tx 1.gain", "frequency shift"=$"tx 1.frequency shift", "phase"=$"tx 1.phase", "impairments"=$"tx 1.impairments") -> (instance out=w243)
    Build Array(w241, w243) -> w244
    call "802.11 USRP Stream TX.gcdl"(tx.enable streams=w239, tx.reset=$"tx.reset", tx.rf channel=$"tx.rf channel", TX to RF FIFO reference=w225, tx.abort=$"tx.abort", DUC parameters=w244) -> (tx.state=w245, tx.samples processed=w246, tx.underflows=w247, tx.number of IQ data overflows=w248, tx.dsp reset done=w249)
    $"tx.state" <- w245
    $"rx.dsp reset done" <- w234
    $"tx.samples processed" <- w246
    $"rx.state" <- w236
    $"tx.underflows" <- w247
    $"rx.samples processed" <- w237
    $"tx.number of IQ data overflows" <- w248
    $"rx.number of overflows" <- w238
    $"tx.dsp reset done" <- w249
    $"DC average" <- w235
  }
  call "LEDs.gvi"()
  call "niUsrpRio Config v1 FPGA.lvlib__Process.gvi"(resources=w189)
