vi "802.11 Apply RX Gain.gvi"   [LabVIEW Communications System Design Suite 2.0.1]
# Applies RX gain to the target device.
inputs:
  "session": "802.11 Host Session.gtype"
  "RX gain": f64  # RX gain value to apply.
  "RX port": T1 = "RX2/RF 1"  # RX port to use for RX gain settings (USRP only).
  "RX frequency": f64 = 2437000000  # RX frequency at which the gain is applied (FlexRIO only).
  "error in": error
outputs:
  "session dup": "802.11 Host Session.gtype"
  "error out": error
  "coerced RX gain": f64  # RX gain value actually applied.
types:
  T1 = enum{"RX1/RF 0", "RX2/RF 0", "RX1/RF 1", "RX2/RF 1"}
  T2 = cluster{"Timestamp": u32, "Transferred Bytes": u32}
  T3 = cluster{"fpga ref": any, "bus instance": u32, "instruction FIFO depth": u32, "executing on FPGA target": bool, "show error call chain": bool}
  T4 = cluster{"Actual Gain [dB]": f64, "Attenuation Table Index": i32}
  T5 = cluster{"Attenuation Table [dB]": f64[][], "Frequencies [Hz]": f64[], "IQ Imbalance Table": "niUsrpRio Config v1 Host.lvlib__IQ Imbalance.gtype"[], "Gain Table": T4[][]}
  "niInstr Register Bus v0 Host.lvlib__Register Bus Session.gtype" = Queue<"niInstr Register Bus v0 Host.lvlib__Session Data.gtype">
  "Semaphore RefNum.gtype" = i32
  "niUsrpRio Config v1 Host.lvlib__DB Queue Reference.gtype" = Queue<"niUsrpRio Config v1 Host.lvlib__Daughterboard Data.gtype">
  "niUsrpRio Config v1 Host.lvlib__niUsrpRio Session.gtype" = cluster{"FPGA Interface": any, "RIO Interface Number": u32, "Data Clock Rate": u32, "FPGA Data Clock Rate": u32, "Global Settings Register Bus": "niInstr Register Bus v0 Host.lvlib__Register Bus Session.gtype", "Radio 0 Settings Register Bus": "niInstr Register Bus v0 Host.lvlib__Register Bus Session.gtype", "Radio 1 Settings Register Bus": "niInstr Register Bus v0 Host.lvlib__Register Bus Session.gtype", "Radio Settings Bus Semaphore": "Semaphore RefNum.gtype", "DB Queues": "niUsrpRio Config v1 Host.lvlib__DB Queue Reference.gtype"[], "Characterization Data Valid?": bool, "EEPROM Header": "niUsrpRio Config v1 Host.lvlib__EEPROM Header.gtype", "Device Data Header": "niUsrpRio Config v1 Host.lvlib__EEPROM Device Data Header.gtype", "EEPROM Characterization Header": "niUsrpRio Config v1 Host.lvlib__EEPROM Characterization Header.gtype", "Characterization Data": "niUsrpRio Config v1 Host.lvlib__Characterization Data.gtype"[], "FPGA Current Version": u32, "FPGA Oldest Compatible Version": u32, "Fixed Logic Current Version": u32, "Fixed Logic Oldest Compatible Version": u32, "FPGA Radio Settings Bus Current Version": u32, "FPGA Radio Settings Bus Oldest Compatible Version": u32, "FPGA Board Config Current Version": u32, "FPGA Board Config Oldest Compatible Version": u32, "Daughterboard Clock Rate": u32}
  "802.11 Host Session.gtype" = cluster{"FPGA interface": "802.11 FGPA Reference.gtype", "send queue": Queue<u8[]>, "receive queue": Queue<u8[]>, "receive throughput queue": Queue<T2>, "UDP Receiver": UdpNetworkConnectionRefnum, "PN packet": u8[], "FlexRIO session": Queue<T3>, "FlexRIO TX Characterization Data": T5, "FlexRIO RX Characterization Data": T5, "USRP session": "niUsrpRio Config v1 Host.lvlib__niUsrpRio Session.gtype", "RF loop clock frequency": f64}
diagram:
  $"session dup" <- $session
  call "802.11 Unbundle Session.gvi"(session=$session) -> (USRP session=w1)
  Type Cast(type=u16 0, x=$"RX port") -> w2
  Quotient And Remainder(x=w2, y=2) -> (floor(x/y)=w3)
  Format Into String(formatString="rx/RF %d", errIn=$"error in", w3) -> (outString=w4, errOut=w5)
  call "niUsrpRio Config v1 Host.lvlib__Configure Gain.gvi"(niusrprio session in=w1, gain=$"RX gain", error in=w5, scope=w4) -> (coerced gain=w6, error out=w7)
  $"coerced RX gain" <- w6
  $"error out" <- w7
