vi "802.11 Configure AGC Registers.gvi"   [LabVIEW Communications System Design Suite 2.0.1]
# Configures the automatic gain control registers on the FPGA and starts or stops the AGC.
inputs:
  "TX Port": enum{"TX1/RF 0", "TX1/RF 1"} = "TX1/RF 0"
  "enable AGC": bool  # Enables or disables the automatic gain control on the FPGA.
  "session": "802.11 Host Session.gtype"
  "RX port": T1 = "RX2/RF 1"
  "RX scope": string
  "error in": error
outputs:
  "error out": error
  "session dup": "802.11 Host Session.gtype"
types:
  T1 = enum{"RX1/RF 0", "RX2/RF 0", "RX1/RF 1", "RX2/RF 1"}
  T2 = cluster{"Timestamp": u32, "Transferred Bytes": u32}
  T3 = cluster{"fpga ref": any, "bus instance": u32, "instruction FIFO depth": u32, "executing on FPGA target": bool, "show error call chain": bool}
  T4 = cluster{"Actual Gain [dB]": f64, "Attenuation Table Index": i32}
  T5 = cluster{"Attenuation Table [dB]": f64[][], "Frequencies [Hz]": f64[], "IQ Imbalance Table": "niUsrpRio Config v1 Host.lvlib__IQ Imbalance.gtype"[], "Gain Table": T4[][]}
  "niInstr Register Bus v0 Host.lvlib__Register Bus Session.gtype" = Queue<"niInstr Register Bus v0 Host.lvlib__Session Data.gtype">
  "Semaphore RefNum.gtype" = i32
  "niUsrpRio Config v1 Host.lvlib__DB Queue Reference.gtype" = Queue<"niUsrpRio Config v1 Host.lvlib__Daughterboard Data.gtype">
  "niUsrpRio Config v1 Host.lvlib__niUsrpRio Session.gtype" = cluster{"FPGA Interface": any, "RIO Interface Number": u32, "Data Clock Rate": u32, "FPGA Data Clock Rate": u32, "Global Settings Register Bus": "niInstr Register Bus v0 Host.lvlib__Register Bus Session.gtype", "Radio 0 Settings Register Bus": "niInstr Register Bus v0 Host.lvlib__Register Bus Session.gtype", "Radio 1 Settings Register Bus": "niInstr Register Bus v0 Host.lvlib__Register Bus Session.gtype", "Radio Settings Bus Semaphore": "Semaphore RefNum.gtype", "DB Queues": "niUsrpRio Config v1 Host.lvlib__DB Queue Reference.gtype"[], "Characterization Data Valid?": bool, "EEPROM Header": "niUsrpRio Config v1 Host.lvlib__EEPROM Header.gtype", "Device Data Header": "niUsrpRio Config v1 Host.lvlib__EEPROM Device Data Header.gtype", "EEPROM Characterization Header": "niUsrpRio Config v1 Host.lvlib__EEPROM Characterization Header.gtype", "Characterization Data": "niUsrpRio Config v1 Host.lvlib__Characterization Data.gtype"[], "FPGA Current Version": u32, "FPGA Oldest Compatible Version": u32, "Fixed Logic Current Version": u32, "Fixed Logic Oldest Compatible Version": u32, "FPGA Radio Settings Bus Current Version": u32, "FPGA Radio Settings Bus Oldest Compatible Version": u32, "FPGA Board Config Current Version": u32, "FPGA Board Config Oldest Compatible Version": u32, "Daughterboard Clock Rate": u32}
  "802.11 Host Session.gtype" = cluster{"FPGA interface": "802.11 FGPA Reference.gtype", "send queue": Queue<u8[]>, "receive queue": Queue<u8[]>, "receive throughput queue": Queue<T2>, "UDP Receiver": UdpNetworkConnectionRefnum, "PN packet": u8[], "FlexRIO session": Queue<T3>, "FlexRIO TX Characterization Data": T5, "FlexRIO RX Characterization Data": T5, "USRP session": "niUsrpRio Config v1 Host.lvlib__niUsrpRio Session.gtype", "RF loop clock frequency": f64}
  T6 = cluster{"AGC active threshold": FXP(10.3), "AGC threshold 1": FXP(10.3), "AGC threshold 2": FXP(10.3), "AGC threshold 3": FXP(10.3)}
diagram:
  $"session dup" <- $session
  call "802.11 Unbundle Session.gvi"(session=$session) -> (FPGA interface=w1, USRP session=w2)
  case ($"RX port") {
    frame "RX1/RF 0", Default {
      w3 = "Radio 0 Config"
      w4 = "TX1 RX1 receives and RX2 is unused"
    }
    frame "RX2/RF 0" {
      w3 = "Radio 0 Config"
      w4 = "TX1 RX1 transmits and RX2 receives"
    }
    frame "RX1/RF 1" {
      w3 = "Radio 1 Config"
      w4 = "TX1 RX1 receives and RX2 is unused"
    }
    frame "RX2/RF 1" {
      w3 = "Radio 1 Config"
      w4 = "TX1 RX1 transmits and RX2 receives"
    }
  }
  case ($"TX Port") {
    frame "TX1/RF 0", Default {
      case ($"RX port") {
        frame "RX1/RF 0", Default {
          w5 = "Duplex"
        }
        frame "RX2/RF 0" {
          w5 = "Duplex"
        }
        frame "RX1/RF 1" {
          w5 = "Rx"
        }
        frame "RX2/RF 1" {
          w5 = "Rx"
        }
      }
    }
    frame "TX1/RF 1" {
      case ($"RX port") {
        frame "RX1/RF 0", Default {
          w5 = "Rx"
        }
        frame "RX2/RF 0" {
          w5 = "Rx"
        }
        frame "RX1/RF 1" {
          w5 = "Duplex"
        }
        frame "RX2/RF 1" {
          w5 = "Duplex"
        }
      }
    }
  }
  call "niUsrpRio Config v1 Host.lvlib__Dequeue DB Data.gvi"(niusrprio session in=w2, error in=$"error in", scope=$"RX scope") -> (niusrprio session out=w6, daughterboard data=w7, error out=w8)
  call "niUsrpRio Config v1 Host.lvlib__Enqueue DB Data.gvi"(niusrprio session in=w6, daughterboard data=w7, error in=w8, scope=$"RX scope") -> (niusrprio session out=w9, error out=w10)
  call "niUsrpRio Config v1 Host.lvlib__Parse Scope.gvi"(niusrprio session in=w9, error in=w10, scope=$"RX scope") -> (niusrprio session out=w11, error out=w12, daughterboard index=w13)
  call "niUsrpRio Config v1 Host.lvlib__Decode Daughterboard Names.gvi"(niusrprio session in=w11, error in=w12) -> (daughterboard names=w14, error out=w15)
  Property Node(instance in=w7) -> ("ATR state data"=w16)
  Type Cast(type=u16 0, x=w5) -> w17
  To Long Integer(number=w17) -> w18
  Array Index(array=w16) -> (out0[w18]=w19)
  Property Node(instance in=w19) -> ("lo lpf enable"=w20, "rx.configuration:power enable"=w21, "rx.configuration:mixer enable"=w22, "tx.configuration"=w23, "ubx spi address"=w24, "ubx cpld enable"=w25)
  w26 = T6 {"AGC active threshold"=-15, "AGC threshold 1"=-10, "AGC threshold 2"=0, "AGC threshold 3"=5}
  To Long Integer(number=w13) -> w27
  Array Index(array=w14) -> (out0[w27]=w28)
  Type Cast(type=enum{"sbx", "cbx", "wbx", "unknown", "ubx"} "sbx", x=w28) -> w29
  # 14 us
  Property Node(instance in=w1, "ATR State"=w5, "Radio Control Destination"=w3, "antenna configuration"=w4, "lo lpf enable"=w20, "daughterboard"=w29, "power enable"=w21, "mixer enable"=w22, "tx.configuration"=w23, "enable AGC"=$"enable AGC", "AGC tresholds"=w26, "AGC timeout"=3500, "spi address"=w24, "cpld enable"=w25, error in=w15) -> (error out=w30)
  $"error out" <- w30
