vi "802.11 Configure RF Streams.gvi"   [LabVIEW Communications System Design Suite 2.0.1]
# Configures the RX and TX streams on the target.
inputs:
  "TX port": enum{"TX1/RF 0", "TX1/RF 1"} = "TX1/RF 0"  # TX port to be used (USRP only).
  "RX port": T1 = "RX2/RF 1"  # RX port to be used (USRP only).
  "session": "802.11 Host Session.gtype"
  "error in": error
outputs:
  "session dup": "802.11 Host Session.gtype"
  "error out": error
types:
  T1 = enum{"RX1/RF 0", "RX2/RF 0", "RX1/RF 1", "RX2/RF 1"}
  T2 = cluster{"Timestamp": u32, "Transferred Bytes": u32}
  T3 = cluster{"fpga ref": any, "bus instance": u32, "instruction FIFO depth": u32, "executing on FPGA target": bool, "show error call chain": bool}
  T4 = cluster{"Actual Gain [dB]": f64, "Attenuation Table Index": i32}
  T5 = cluster{"Attenuation Table [dB]": f64[][], "Frequencies [Hz]": f64[], "IQ Imbalance Table": "niUsrpRio Config v1 Host.lvlib__IQ Imbalance.gtype"[], "Gain Table": T4[][]}
  "niInstr Register Bus v0 Host.lvlib__Register Bus Session.gtype" = Queue<"niInstr Register Bus v0 Host.lvlib__Session Data.gtype">
  "Semaphore RefNum.gtype" = i32
  "niUsrpRio Config v1 Host.lvlib__DB Queue Reference.gtype" = Queue<"niUsrpRio Config v1 Host.lvlib__Daughterboard Data.gtype">
  "niUsrpRio Config v1 Host.lvlib__niUsrpRio Session.gtype" = cluster{"FPGA Interface": any, "RIO Interface Number": u32, "Data Clock Rate": u32, "FPGA Data Clock Rate": u32, "Global Settings Register Bus": "niInstr Register Bus v0 Host.lvlib__Register Bus Session.gtype", "Radio 0 Settings Register Bus": "niInstr Register Bus v0 Host.lvlib__Register Bus Session.gtype", "Radio 1 Settings Register Bus": "niInstr Register Bus v0 Host.lvlib__Register Bus Session.gtype", "Radio Settings Bus Semaphore": "Semaphore RefNum.gtype", "DB Queues": "niUsrpRio Config v1 Host.lvlib__DB Queue Reference.gtype"[], "Characterization Data Valid?": bool, "EEPROM Header": "niUsrpRio Config v1 Host.lvlib__EEPROM Header.gtype", "Device Data Header": "niUsrpRio Config v1 Host.lvlib__EEPROM Device Data Header.gtype", "EEPROM Characterization Header": "niUsrpRio Config v1 Host.lvlib__EEPROM Characterization Header.gtype", "Characterization Data": "niUsrpRio Config v1 Host.lvlib__Characterization Data.gtype"[], "FPGA Current Version": u32, "FPGA Oldest Compatible Version": u32, "Fixed Logic Current Version": u32, "Fixed Logic Oldest Compatible Version": u32, "FPGA Radio Settings Bus Current Version": u32, "FPGA Radio Settings Bus Oldest Compatible Version": u32, "FPGA Board Config Current Version": u32, "FPGA Board Config Oldest Compatible Version": u32, "Daughterboard Clock Rate": u32}
  "802.11 Host Session.gtype" = cluster{"FPGA interface": "802.11 FGPA Reference.gtype", "send queue": Queue<u8[]>, "receive queue": Queue<u8[]>, "receive throughput queue": Queue<T2>, "UDP Receiver": UdpNetworkConnectionRefnum, "PN packet": u8[], "FlexRIO session": Queue<T3>, "FlexRIO TX Characterization Data": T5, "FlexRIO RX Characterization Data": T5, "USRP session": "niUsrpRio Config v1 Host.lvlib__niUsrpRio Session.gtype", "RF loop clock frequency": f64}
diagram:
  $"session dup" <- $session
  call "802.11 Unbundle Session.gvi"(session=$session) -> (FPGA interface=w1, USRP session=w2)
  Type Cast(type=u16 0, x=$"TX port") -> w3
  To Fixed Point(fixed-point type=UFXP(1.0) 0, number=w3) -> w4
  Type Cast(type=u16 0, x=$"RX port") -> w5
  Quotient And Remainder(x=w5, y=2) -> (floor(x/y)=w6)
  To Fixed Point(fixed-point type=UFXP(1.0) 0, number=w6) -> w7
  Format Into String(formatString="rx/RF %d", errIn=$"error in", w6) -> (outString=w8, errOut=w9)
  call "Initiate Stream.gvi"(niusrprio session in=w2, error in=w9, scope=w8) -> (error out=w10)
  Format Into String(formatString="tx/RF %d", errIn=$"error in", w3) -> (outString=w11, errOut=w12)
  call "Initiate Stream.gvi"(niusrprio session in=w2, error in=w12, scope=w11) -> (error out=w13)
  Merge Errors(w13, w10) -> (error out=w14)
  Property Node(instance in=w1, "tx.rf channel"=w4, "rx.rf channel"=w7, "enable DC offset correction"=TRUE, error in=w14) -> (error out=w15)
  $"error out" <- w15
