vi "802.11 Configure RX RF.gvi"   [LabVIEW Communications System Design Suite 2.0.1]
# Configures the RX RF front end on the target.
inputs:
  "RX frequency": f64 = 1000000000  # RX frequency to configure on the target, in Hz.
  "session": "802.11 Host Session.gtype"
  "RX gain": f64  # RX gain to configure on the target, in dB.
  "error in": error
  "RX port": T1 = "RX2/RF 1"  # RX port to be used (USRP only).
outputs:
  "error out": error
  "session dup": "802.11 Host Session.gtype"
  "coerced RX gain": f64  # RX gain actually configured on the target, in dB.
  "coerced LO frequency": f64  # LO frequency actually configured for RX on the target, in Hz.
types:
  T1 = enum{"RX1/RF 0", "RX2/RF 0", "RX1/RF 1", "RX2/RF 1"}
  T2 = cluster{"Timestamp": u32, "Transferred Bytes": u32}
  T3 = cluster{"fpga ref": any, "bus instance": u32, "instruction FIFO depth": u32, "executing on FPGA target": bool, "show error call chain": bool}
  T4 = cluster{"Actual Gain [dB]": f64, "Attenuation Table Index": i32}
  T5 = cluster{"Attenuation Table [dB]": f64[][], "Frequencies [Hz]": f64[], "IQ Imbalance Table": "niUsrpRio Config v1 Host.lvlib__IQ Imbalance.gtype"[], "Gain Table": T4[][]}
  "niInstr Register Bus v0 Host.lvlib__Register Bus Session.gtype" = Queue<"niInstr Register Bus v0 Host.lvlib__Session Data.gtype">
  "Semaphore RefNum.gtype" = i32
  "niUsrpRio Config v1 Host.lvlib__DB Queue Reference.gtype" = Queue<"niUsrpRio Config v1 Host.lvlib__Daughterboard Data.gtype">
  "niUsrpRio Config v1 Host.lvlib__niUsrpRio Session.gtype" = cluster{"FPGA Interface": any, "RIO Interface Number": u32, "Data Clock Rate": u32, "FPGA Data Clock Rate": u32, "Global Settings Register Bus": "niInstr Register Bus v0 Host.lvlib__Register Bus Session.gtype", "Radio 0 Settings Register Bus": "niInstr Register Bus v0 Host.lvlib__Register Bus Session.gtype", "Radio 1 Settings Register Bus": "niInstr Register Bus v0 Host.lvlib__Register Bus Session.gtype", "Radio Settings Bus Semaphore": "Semaphore RefNum.gtype", "DB Queues": "niUsrpRio Config v1 Host.lvlib__DB Queue Reference.gtype"[], "Characterization Data Valid?": bool, "EEPROM Header": "niUsrpRio Config v1 Host.lvlib__EEPROM Header.gtype", "Device Data Header": "niUsrpRio Config v1 Host.lvlib__EEPROM Device Data Header.gtype", "EEPROM Characterization Header": "niUsrpRio Config v1 Host.lvlib__EEPROM Characterization Header.gtype", "Characterization Data": "niUsrpRio Config v1 Host.lvlib__Characterization Data.gtype"[], "FPGA Current Version": u32, "FPGA Oldest Compatible Version": u32, "Fixed Logic Current Version": u32, "Fixed Logic Oldest Compatible Version": u32, "FPGA Radio Settings Bus Current Version": u32, "FPGA Radio Settings Bus Oldest Compatible Version": u32, "FPGA Board Config Current Version": u32, "FPGA Board Config Oldest Compatible Version": u32, "Daughterboard Clock Rate": u32}
  "802.11 Host Session.gtype" = cluster{"FPGA interface": "802.11 FGPA Reference.gtype", "send queue": Queue<u8[]>, "receive queue": Queue<u8[]>, "receive throughput queue": Queue<T2>, "UDP Receiver": UdpNetworkConnectionRefnum, "PN packet": u8[], "FlexRIO session": Queue<T3>, "FlexRIO TX Characterization Data": T5, "FlexRIO RX Characterization Data": T5, "USRP session": "niUsrpRio Config v1 Host.lvlib__niUsrpRio Session.gtype", "RF loop clock frequency": f64}
diagram:
  $"session dup" <- $session
  w1 = -1  # LO frequency
  w2 = 80000000  # sample rate
  call "802.11 Unbundle Session.gvi"(session=$session) -> (USRP session=w3)
  Type Cast(type=u16 0, x=$"RX port") -> w4
  Quotient And Remainder(x=w4, y=2) -> (floor(x/y)=w5, x-y*floor(x/y)=w6)
  Increment(x=w6) -> w7
  Format Into String(formatString="RX%d", errIn=$"error in", w7) -> (outString=w8, errOut=w9)
  Format Into String(formatString="rx/RF %d", errIn=w9, w5) -> (outString=w10, errOut=w11)
  call "Configure Signal (Gain).gvi"(niusrprio session in=w3, sample rate [s/s]=w2, frequency [hz]=$"RX frequency", gain [db]=$"RX gain", error in=w11, scope=w10, correct impairments?=TRUE, active antenna=w8, lo frequency [hz]=w1) -> (coerced gain [db]=w12, error out=w13, coerced lo frequency [hz]=w14)
  $"error out" <- w13
  $"coerced RX gain" <- w12
  $"coerced LO frequency" <- w14
