vi "802.11 Configure TX RF.gvi"   [LabVIEW Communications System Design Suite 2.0.1]
# Configures TX RF front end on the target.
inputs:
  "TX port": enum{"TX1/RF 0", "TX1/RF 1"} = "TX1/RF 0"  # TX port to be used (USRP only).
  "session": "802.11 Host Session.gtype"
  "TX frequency": f64 = 2450000000  # TX frequency to configure on the target, in Hz.
  "TX power level": f64 = -10  # TX power level to configure on the target, in dBm.
  "error in": error
outputs:
  "session dup": "802.11 Host Session.gtype"
  "error out": error
  "coerced TX power level": f64  # TX power level actually configured on the target, in dBm.
  "coerced LO frequency": f64  # LO frequency actually configured for TX on the target, in Hz.
types:
  T1 = cluster{"Timestamp": u32, "Transferred Bytes": u32}
  T2 = cluster{"fpga ref": any, "bus instance": u32, "instruction FIFO depth": u32, "executing on FPGA target": bool, "show error call chain": bool}
  T3 = cluster{"Actual Gain [dB]": f64, "Attenuation Table Index": i32}
  T4 = cluster{"Attenuation Table [dB]": f64[][], "Frequencies [Hz]": f64[], "IQ Imbalance Table": "niUsrpRio Config v1 Host.lvlib__IQ Imbalance.gtype"[], "Gain Table": T3[][]}
  "niInstr Register Bus v0 Host.lvlib__Register Bus Session.gtype" = Queue<"niInstr Register Bus v0 Host.lvlib__Session Data.gtype">
  "Semaphore RefNum.gtype" = i32
  "niUsrpRio Config v1 Host.lvlib__DB Queue Reference.gtype" = Queue<"niUsrpRio Config v1 Host.lvlib__Daughterboard Data.gtype">
  "niUsrpRio Config v1 Host.lvlib__niUsrpRio Session.gtype" = cluster{"FPGA Interface": any, "RIO Interface Number": u32, "Data Clock Rate": u32, "FPGA Data Clock Rate": u32, "Global Settings Register Bus": "niInstr Register Bus v0 Host.lvlib__Register Bus Session.gtype", "Radio 0 Settings Register Bus": "niInstr Register Bus v0 Host.lvlib__Register Bus Session.gtype", "Radio 1 Settings Register Bus": "niInstr Register Bus v0 Host.lvlib__Register Bus Session.gtype", "Radio Settings Bus Semaphore": "Semaphore RefNum.gtype", "DB Queues": "niUsrpRio Config v1 Host.lvlib__DB Queue Reference.gtype"[], "Characterization Data Valid?": bool, "EEPROM Header": "niUsrpRio Config v1 Host.lvlib__EEPROM Header.gtype", "Device Data Header": "niUsrpRio Config v1 Host.lvlib__EEPROM Device Data Header.gtype", "EEPROM Characterization Header": "niUsrpRio Config v1 Host.lvlib__EEPROM Characterization Header.gtype", "Characterization Data": "niUsrpRio Config v1 Host.lvlib__Characterization Data.gtype"[], "FPGA Current Version": u32, "FPGA Oldest Compatible Version": u32, "Fixed Logic Current Version": u32, "Fixed Logic Oldest Compatible Version": u32, "FPGA Radio Settings Bus Current Version": u32, "FPGA Radio Settings Bus Oldest Compatible Version": u32, "FPGA Board Config Current Version": u32, "FPGA Board Config Oldest Compatible Version": u32, "Daughterboard Clock Rate": u32}
  "802.11 Host Session.gtype" = cluster{"FPGA interface": "802.11 FGPA Reference.gtype", "send queue": Queue<u8[]>, "receive queue": Queue<u8[]>, "receive throughput queue": Queue<T1>, "UDP Receiver": UdpNetworkConnectionRefnum, "PN packet": u8[], "FlexRIO session": Queue<T2>, "FlexRIO TX Characterization Data": T4, "FlexRIO RX Characterization Data": T4, "USRP session": "niUsrpRio Config v1 Host.lvlib__niUsrpRio Session.gtype", "RF loop clock frequency": f64}
diagram:
  $"session dup" <- $session
  w1 = 80000000  # sample rate [S/s]
  w2 = -1  # LO frequency [Hz]
  w3 = TRUE  # correctiImpairments?
  call "802.11 Unbundle Session.gvi"(session=$session) -> (USRP session=w4)
  Format Into String(formatString="tx/RF %d", errIn=$"error in", $"TX port") -> (outString=w5, errOut=w6)
  call "Configure Signal (Level).gvi"(niusrprio session in=w4, sample rate [s/s]=w1, frequency [hz]=$"TX frequency", level [dbm]=$"TX power level", error in=w6, scope=w5, correct impairments?=w3, active antenna="TX1", lo frequency [hz]=w2) -> (coerced level [dbm]=w7, error out=w8, coerced lo frequency [hz]=w9)
  $"error out" <- w8
  $"coerced TX power level" <- w7
  $"coerced LO frequency" <- w9
