vi "802.11 Gain Control.gvi"   [LabVIEW Communications System Design Suite 2.0.1]
# Controls the RX gain setting. You can either apply a manual gain, or you can configure and enable the automatic gain control.
inputs:
  "initialize": bool  # Forces application of the manual gain value which is otherwise only applied when the value changes.
  "RX Port (USRP only)": T1 = "RX2/RF 1"  # The RF port used for the receiver (USPR only).
  "session": "802.11 Host Session.gtype"
  "AGC": bool = TRUE  # Enables or disables the automatic gain control.
  "error in": error
  "Manual RX gain [dB]": f64 = 37.5  # Manual RX gain level that is applied if you disable the automatic gain control.
  "RX Frequency [Hz]": f64 = 2437000000  # Current RX frequency, in Hz.
  "TX Port (USRP only)": enum{"TX1/RF 0", "TX1/RF 1"} = "TX1/RF 0"  # The RF port used for the transmitter (USRP only).
outputs:
  "Applied RX Gain [dB]": f64  # The applied gain value, which is either the coerced gain value after applying the manual gain, or the reported AGC gain read from the FPGA.
  "error out": error
types:
  T1 = enum{"RX1/RF 0", "RX2/RF 0", "RX1/RF 1", "RX2/RF 1"}
  T2 = cluster{"Timestamp": u32, "Transferred Bytes": u32}
  T3 = cluster{"fpga ref": any, "bus instance": u32, "instruction FIFO depth": u32, "executing on FPGA target": bool, "show error call chain": bool}
  T4 = cluster{"Actual Gain [dB]": f64, "Attenuation Table Index": i32}
  T5 = cluster{"Attenuation Table [dB]": f64[][], "Frequencies [Hz]": f64[], "IQ Imbalance Table": "niUsrpRio Config v1 Host.lvlib__IQ Imbalance.gtype"[], "Gain Table": T4[][]}
  "niInstr Register Bus v0 Host.lvlib__Register Bus Session.gtype" = Queue<"niInstr Register Bus v0 Host.lvlib__Session Data.gtype">
  "Semaphore RefNum.gtype" = i32
  "niUsrpRio Config v1 Host.lvlib__DB Queue Reference.gtype" = Queue<"niUsrpRio Config v1 Host.lvlib__Daughterboard Data.gtype">
  "niUsrpRio Config v1 Host.lvlib__niUsrpRio Session.gtype" = cluster{"FPGA Interface": any, "RIO Interface Number": u32, "Data Clock Rate": u32, "FPGA Data Clock Rate": u32, "Global Settings Register Bus": "niInstr Register Bus v0 Host.lvlib__Register Bus Session.gtype", "Radio 0 Settings Register Bus": "niInstr Register Bus v0 Host.lvlib__Register Bus Session.gtype", "Radio 1 Settings Register Bus": "niInstr Register Bus v0 Host.lvlib__Register Bus Session.gtype", "Radio Settings Bus Semaphore": "Semaphore RefNum.gtype", "DB Queues": "niUsrpRio Config v1 Host.lvlib__DB Queue Reference.gtype"[], "Characterization Data Valid?": bool, "EEPROM Header": "niUsrpRio Config v1 Host.lvlib__EEPROM Header.gtype", "Device Data Header": "niUsrpRio Config v1 Host.lvlib__EEPROM Device Data Header.gtype", "EEPROM Characterization Header": "niUsrpRio Config v1 Host.lvlib__EEPROM Characterization Header.gtype", "Characterization Data": "niUsrpRio Config v1 Host.lvlib__Characterization Data.gtype"[], "FPGA Current Version": u32, "FPGA Oldest Compatible Version": u32, "Fixed Logic Current Version": u32, "Fixed Logic Oldest Compatible Version": u32, "FPGA Radio Settings Bus Current Version": u32, "FPGA Radio Settings Bus Oldest Compatible Version": u32, "FPGA Board Config Current Version": u32, "FPGA Board Config Oldest Compatible Version": u32, "Daughterboard Clock Rate": u32}
  "802.11 Host Session.gtype" = cluster{"FPGA interface": "802.11 FGPA Reference.gtype", "send queue": Queue<u8[]>, "receive queue": Queue<u8[]>, "receive throughput queue": Queue<T2>, "UDP Receiver": UdpNetworkConnectionRefnum, "PN packet": u8[], "FlexRIO session": Queue<T3>, "FlexRIO TX Characterization Data": T5, "FlexRIO RX Characterization Data": T5, "USRP session": "niUsrpRio Config v1 Host.lvlib__niUsrpRio Session.gtype", "RF loop clock frequency": f64}
diagram:
  call "802.11 Unbundle Session.gvi"(session=$session) -> (FPGA interface=w1)
  Type Cast(type=u16 0, x=$"RX Port (USRP only)") -> w2
  Quotient And Remainder(x=w2, y=2) -> (floor(x/y)=w3)
  Format Into String(formatString="rx/RF %d", errIn=$"error in", w3) -> (outString=w4, errOut=w5)
  Property Node(instance in=w1, error in=w5) -> ("last applied gain"=w6, error out=w7, instance out=w8)
  To Double Precision Float(number=w6) -> w9
  Feedback Node(initial value=FALSE, input=$AGC) -> w10
  Is Not Equal(x=w10, y=$AGC) -> w11
  Logical Or(w11, $initialize) -> w12
  # apply manual gain of 0 dB once when AGC is enabled
  # to configure second attenuator to zero gain
  case (w12) {
    frame False, Default {
      w13 = w5
    }
    frame True {
      call "802.11 Apply RX Gain.gvi"(session=$session, RX gain=0, RX port=$"RX Port (USRP only)", RX frequency=$"RX Frequency [Hz]", error in=w5) -> (session dup=w14, error out=w15)
      call "802.11 Configure AGC Registers.gvi"(TX Port=$"TX Port (USRP only)", enable AGC=$AGC, session=w14, RX port=$"RX Port (USRP only)", RX scope=w4, error in=w15) -> (error out=w13)
    }
  }
  Merge Errors(w7, w13) -> (error out=w16)
  Is Not Equal(x=$"Manual RX gain [dB]", y=$"Applied RX Gain [dB]") -> w17
  Logical Or(w17, w11, $initialize) -> w18
  Logical And(w18, not $AGC) -> w19
  case (w19) {
    frame False {
      w20 = w16
      w21 = $"Manual RX gain [dB]"
    }
    frame True {
      call "802.11 Apply RX Gain.gvi"(session=$session, RX gain=$"Manual RX gain [dB]", RX port=$"RX Port (USRP only)", RX frequency=$"RX Frequency [Hz]", error in=w16) -> (error out=w20, coerced RX gain=w21)
    }
  }
  Select(s=$AGC, t=w9, f=w21) -> w22
  $"Applied RX Gain [dB]" <- w22
  To Fixed Point(number=w22) -> w23: FXP(10.3) Saturate:ConvergentRounding
  Property Node(instance in=w8, "RF gain"=w23, error in=w20) -> (error out=w24)
  $"error out" <- w24
