vi "802.11 Setup FPGA Target.gvi"   [LabVIEW Communications System Design Suite 2.0.1]
# Opens a reference to the target device.
inputs:
  "Reference Clock": string = "Internal"  # reference clock source
  "session in": "802.11 Host Session.gtype"
  "error in": error
outputs:
  "session out": "802.11 Host Session.gtype"
  "error out": error
panel controls:
  "FPGA reference": any
types:
  T1 = cluster{"Timestamp": u32, "Transferred Bytes": u32}
  T2 = cluster{"fpga ref": any, "bus instance": u32, "instruction FIFO depth": u32, "executing on FPGA target": bool, "show error call chain": bool}
  T3 = cluster{"Actual Gain [dB]": f64, "Attenuation Table Index": i32}
  T4 = cluster{"Attenuation Table [dB]": f64[][], "Frequencies [Hz]": f64[], "IQ Imbalance Table": "niUsrpRio Config v1 Host.lvlib__IQ Imbalance.gtype"[], "Gain Table": T3[][]}
  "niInstr Register Bus v0 Host.lvlib__Register Bus Session.gtype" = Queue<"niInstr Register Bus v0 Host.lvlib__Session Data.gtype">
  "Semaphore RefNum.gtype" = i32
  "niUsrpRio Config v1 Host.lvlib__DB Queue Reference.gtype" = Queue<"niUsrpRio Config v1 Host.lvlib__Daughterboard Data.gtype">
  "niUsrpRio Config v1 Host.lvlib__niUsrpRio Session.gtype" = cluster{"FPGA Interface": any, "RIO Interface Number": u32, "Data Clock Rate": u32, "FPGA Data Clock Rate": u32, "Global Settings Register Bus": "niInstr Register Bus v0 Host.lvlib__Register Bus Session.gtype", "Radio 0 Settings Register Bus": "niInstr Register Bus v0 Host.lvlib__Register Bus Session.gtype", "Radio 1 Settings Register Bus": "niInstr Register Bus v0 Host.lvlib__Register Bus Session.gtype", "Radio Settings Bus Semaphore": "Semaphore RefNum.gtype", "DB Queues": "niUsrpRio Config v1 Host.lvlib__DB Queue Reference.gtype"[], "Characterization Data Valid?": bool, "EEPROM Header": "niUsrpRio Config v1 Host.lvlib__EEPROM Header.gtype", "Device Data Header": "niUsrpRio Config v1 Host.lvlib__EEPROM Device Data Header.gtype", "EEPROM Characterization Header": "niUsrpRio Config v1 Host.lvlib__EEPROM Characterization Header.gtype", "Characterization Data": "niUsrpRio Config v1 Host.lvlib__Characterization Data.gtype"[], "FPGA Current Version": u32, "FPGA Oldest Compatible Version": u32, "Fixed Logic Current Version": u32, "Fixed Logic Oldest Compatible Version": u32, "FPGA Radio Settings Bus Current Version": u32, "FPGA Radio Settings Bus Oldest Compatible Version": u32, "FPGA Board Config Current Version": u32, "FPGA Board Config Oldest Compatible Version": u32, "Daughterboard Clock Rate": u32}
  "802.11 Host Session.gtype" = cluster{"FPGA interface": "802.11 FGPA Reference.gtype", "send queue": Queue<u8[]>, "receive queue": Queue<u8[]>, "receive throughput queue": Queue<T1>, "UDP Receiver": UdpNetworkConnectionRefnum, "PN packet": u8[], "FlexRIO session": Queue<T2>, "FlexRIO TX Characterization Data": T4, "FlexRIO RX Characterization Data": T4, "USRP session": "niUsrpRio Config v1 Host.lvlib__niUsrpRio Session.gtype", "RF loop clock frequency": f64}
diagram:
  Property Node(instance in=$"session in") -> ("FPGA interface"=w1, instance out=w2)
  case ($"Reference Clock") {
    frame "Internal", Default {
      w3 = $"Reference Clock"
      w4 = default
    }
    frame "REF IN / ClkIn" {
      w3 = "REF IN"
      w4 = default
    }
    frame "GPS" {
      w3 = $"Reference Clock"
      w4 = default
    }
    frame "PXI_CLK" {
      w5 = error {"status"=TRUE, "code"=1, "source"="PXI_CLK reference clock not supported for USRP target"}
      w3 = "Internal"
      w4 = w5
    }
  }
  Type Cast(type=$"FPGA reference", x=w1) -> w6
  Merge Errors($"error in", w4) -> (error out=w7)
  call "niUsrpRio Config v1 Host.lvlib__Open 2.gvi"(fpga ref=w6, error in=w7, reference frequency source=w3, gpsdo power enable=TRUE, timeout=1, scope="") -> (niusrprio session out=w8, error out=w9)
  Property Node(instance in=w2, "USRP session"=w8) -> (instance out=w10)
  $"session out" <- w10
  Property Node(instance in=w6, "data clock locked?"=TRUE, error in=w9) -> (error out=w11)
  $"error out" <- w11
