vi "LEDs.gvi"   [LabVIEW Communications System Design Suite 2.0.1]
diagram:
  clock-driven loop (clock = "40 MHz Onboard Clock") {
    Io Read(reference in="Clock Chip Locked") -> (data=w1)
    Select(s=w1, t="Green", f="Off") -> w2
    case (w2) {
      frame "Off" {
        w3 = 0
      }
      frame "Green" {
        w3 = 1
      }
    }
    Io Write(data=w3, reference in="LED/REF")
    Io Read(reference in="GPS Locked") -> (data=w4)
    Select(s=w4, t="Green", f="Off") -> w5
    case (w5) {
      frame "Off" {
        w6 = 0
      }
      frame "Green" {
        w6 = 1
      }
    }
    Io Write(data=w6, reference in="LED/GPS")
    stop if FALSE
  }
  clock-driven loop (clock = "Data Clock") {
    Io Read(reference in="PPS Trig In") -> (data=w7)
    Select(s=w7, t="Green", f="Off") -> w8
    case (w8) {
      frame "Off" {
        w9 = 0
      }
      frame "Green" {
        w9 = 1
      }
    }
    Io Write(data=w9, reference in="LED/PPS")
    stop if FALSE
  }
