vi "Calculate Sample Rate.gvi"   [LabVIEW Communications System Design Suite 2.0.1]
# Calculates the sample rate value to write to the DSP blocks of the device for a requested sample rate, in samples per second.
inputs:
  "data clock rate": f64 = 120000000, required
  "sample rate": f64 = 10000000, required
outputs:
  "decimation sample rate": UFXP(1.47)
  "coerced sample rate": f64
diagram:
  To Double Precision Float(number=$"data clock rate") -> w1
  # Fractional resampling is enabled.  You can use any I/Q rate within the valid range.
  # Compute the coerced I/Q rate.  The I/Q rate is coerced based upon the resolution of the fractional decimator.  When you coerce the value, always round up to guarantee enough signal bandwidth to accommodate the desired I/Q rate. This guarantees that we have enough signal bandwidth to accommodate the desired I/Q rate.  Notice that the coercion math uses extended precision. This provides enough precision to ensure that values round properly. The VI uses the following coercion algorithm:
  #
  # 1.  Compute the desired decimation output sample rate (using extended precision).
  # 2.  Convert the decimation output sample rate to fixed point.  Use the Truncate rounding mode.
  # 3.  Compare the fixed point decimation output sample rate with the original extended precision value.  If they differ, add one LSB to the fixed point number.  This ensures that we round up to the next highest value.
  # 4.  Calculate the coerced I/Q rate using the coerced decimation output sample rate.
  To Double Precision Float(number=$"sample rate") -> w2
  w3 = 65536  # max decimation factor
  To Double Precision Float(number=w3) -> w4
  Divide(x=w1, y=w4) -> w5
  # w5: minimum iq rate
  In Range And Coerce[IncludeHighLimit=True](lower limit=w5, upper limit=w1, x=w2) -> (coerced(x)=w6)
  Divide(x=w6, y=w1) -> w7
  To Fixed Point(fixed-point type=UFXP(1.47) 0, number=w7) -> w8: UFXP(1.47) Saturate:Truncate
  To Double Precision Float(number=w8) -> w9
  Is Equal(x=w7, y=w9) -> w10
  case (w10) {
    frame False, Default {
      Add(w8, 7.1054273576e-15) -> w11: UFXP(1.47) Saturate:ConvergentRounding
    }
    frame True {
      w11 = w8
    }
  }
  To Double Precision Float(number=w11) -> w12
  Multiply(w1, w12) -> w13
  To Double Precision Float(number=w13) -> w14
  $"coerced sample rate" <- w14
  $"decimation sample rate" <- w11
