vi "Configure Frequency.gvi"   [LabVIEW Communications System Design Suite 2.0.1]
# Configures the DSP frequency shift and the mixer (RF upconverter/downconverter) by enabling the LO, setting the LO frequency, configuring the LO filter, and making any necessary routes. Input Parameters niUsrpRio Session is the object created by the Open VI and used as the session handle for the USRP RIO design library. scope is the channel to configure the frequency for. The options are "rx/RF 0", "rx/RF 1", "tx/RF 0", and "tx/RF 1". Wait for LO to lock blocks and waits until the local oscillator locks. LO Frequency is the frequency, in hertz, to tune the local oscillator to. The default value of -1 sets the LO to the value of the 'Frequency' input. If the value is not -1, the LO will be set to that value, and the DSP will handle the difference between the 'Frequency' and the 'LO Frequency'. Frequency is the frequency, in hertz, to acquire from/generate at. error in describes error conditions that occur before this node runs. This input provides standard 'error in' functionality. Output Parameters niUsrpRio Session (out) is the niUsrpRio session used in all subsequent USRP RIO design library host VIs. Coerced LO Frequency is the actual frequency, in hertz, of the local oscillator. error out contains error information. This output provides standard 'error out' functionality.
inputs:
  "niusrprio session in": "niUsrpRio Config v1 Host.lvlib__niUsrpRio Session.gtype", required
  "wait for lo to lock": bool = TRUE
  "lo frequency": f64 = -1  # Tune this channel's LO to a specific frequency. Setting the value to -1 will tune the LO to the Frequency value.
  "frequency": f64 = 2450000000, required  # Set this channel's RF frequency.
  "error in": error
  "scope": string = "rx", required  # is the channel to configure the frequency for. The options are "rx/RF 0", "rx/RF 1", "tx/RF 0", and "tx/RF 1".
outputs:
  "niusrprio session out": "niUsrpRio Config v1 Host.lvlib__niUsrpRio Session.gtype"
  "coerced lo frequency": f64
  "coerced frequency": f64
  "error out": error
types:
  "niInstr Register Bus v0 Host.lvlib__Register Bus Session.gtype" = Queue<"niInstr Register Bus v0 Host.lvlib__Session Data.gtype">
  "Semaphore RefNum.gtype" = i32
  "niUsrpRio Config v1 Host.lvlib__DB Queue Reference.gtype" = Queue<"niUsrpRio Config v1 Host.lvlib__Daughterboard Data.gtype">
  "niUsrpRio Config v1 Host.lvlib__EEPROM Header.gtype" = cluster{"Checksum": u32, "Product Code": u16, "Hardware Current Version": u16, "Hardware Oldest Compatible Version": u16, "EEPROM Map Current Version": u16, "EEPROM Map Oldest Compatible Version": u16, "User Password": string, "Pointer to Factory Header": u32, "Pointer to User Header": u32, "Recommended Interval": u16, "Number of Reserved Bytes": i32, "Number of Daughterboards": u8, "Daughterboard IDs": u16[], "Daughterboard Serial Numbers": string[]}
  "niUsrpRio Config v1 Host.lvlib__EEPROM Device Data Header.gtype" = cluster{"Checksum": u32, "Number of Channels": u8, "Number of Gain Settings": u16[], "Pointer to Characterization Data": u32[], "Number of Reserved Bytes": i32, "Number of Frequencies": u16[]}
  "niUsrpRio Config v1 Host.lvlib__EEPROM Characterization Header.gtype" = cluster{"Checksum": u32, "Date": timestamp, "Temperature": f32, "Misc. Info": string, "Pointer to Device Data Header": u32, "Number of Reserved Bytes": i32}
  "niUsrpRio Config v1 Host.lvlib__Characterization Data.gtype" = cluster{"Gains[dB]": f64[], "Frequencies [Hz]": f64[], "IQ Imbalance Table": "niUsrpRio Config v1 Host.lvlib__IQ Imbalance.gtype"[], "Measured Gains[dB]": f64[][]}
  "niUsrpRio Config v1 Host.lvlib__niUsrpRio Session.gtype" = cluster{"FPGA Interface": any, "RIO Interface Number": u32, "Data Clock Rate": u32, "FPGA Data Clock Rate": u32, "Global Settings Register Bus": "niInstr Register Bus v0 Host.lvlib__Register Bus Session.gtype", "Radio 0 Settings Register Bus": "niInstr Register Bus v0 Host.lvlib__Register Bus Session.gtype", "Radio 1 Settings Register Bus": "niInstr Register Bus v0 Host.lvlib__Register Bus Session.gtype", "Radio Settings Bus Semaphore": "Semaphore RefNum.gtype", "DB Queues": "niUsrpRio Config v1 Host.lvlib__DB Queue Reference.gtype"[], "Characterization Data Valid?": bool, "EEPROM Header": "niUsrpRio Config v1 Host.lvlib__EEPROM Header.gtype", "Device Data Header": "niUsrpRio Config v1 Host.lvlib__EEPROM Device Data Header.gtype", "EEPROM Characterization Header": "niUsrpRio Config v1 Host.lvlib__EEPROM Characterization Header.gtype", "Characterization Data": "niUsrpRio Config v1 Host.lvlib__Characterization Data.gtype"[], "FPGA Current Version": u32, "FPGA Oldest Compatible Version": u32, "Fixed Logic Current Version": u32, "Fixed Logic Oldest Compatible Version": u32, "FPGA Radio Settings Bus Current Version": u32, "FPGA Radio Settings Bus Oldest Compatible Version": u32, "FPGA Board Config Current Version": u32, "FPGA Board Config Oldest Compatible Version": u32, "Daughterboard Clock Rate": u32}
diagram:
  case ($"lo frequency") {
    frame Default {
      w1 = $"lo frequency"
    }
    frame -1 {
      w1 = $frequency
    }
  }
  call "niUsrpRio Config v1 Host.lvlib__Enable Front End.gvi"(niusrprio session in=$"niusrprio session in", enable=TRUE, error in=$"error in", scope=$scope) -> (niusrprio session out=w2, error out=w3)
  call "niUsrpRio Config v1 Host.lvlib__Configure LO.gvi"(niusrprio session in=w2, frequency=w1, error in=w3, scope=$scope) -> (niusrprio session out=w4, coerced frequency=w5, error out=w6)
  Subtract(x=$frequency, y=w5) -> w7
  case ($"wait for lo to lock") {
    frame False, Default {
      w8 = w6
      w9 = w4
    }
    frame True {
      call "niUsrpRio Config v1 Host.lvlib__Wait until Done.gvi"(niusrprio session in=w4, what to wait for="LO Locked", timeout=10, error in=w6, scope=$scope) -> (niusrprio session out=w9, error out=w8)
    }
  }
  Property Node(instance in=w9) -> ("Data Clock Rate"=w10)
  call "Configure Frequency Shift.gvi"(niusrprio session in=w9, clock rate=w10, frequency shift=w7, error in=w8, scope=$scope) -> (niusrprio session out=w11, coerced frequency shift=w12, error out=w13)
  $"niusrprio session out" <- w11
  $"error out" <- w13
  $"coerced lo frequency" <- w5
  Add(w5, w12) -> w14
  $"coerced frequency" <- w14
