vi "Configure Signal (Level).gvi"   [LabVIEW Communications System Design Suite 2.0.1]
# Configures the DSP and signal path for the channel based on the input signal parameters. Input Parameters Sample Rate the requested rate, in samples per second, the signal will be sampled at. Frequency is the requested frequency, in hertz, to acquire the signal from/generate the signal at. Level is the requested power level, in dBm, of the signal. Gain is the requested amount of gain, in dB. LO Frequency is the requested frequency, in hertz, to tune the local oscillator to. The default value of -1 sets the LO to the value of the 'Frequency' input. If the value is not -1, the LO will be set to that value, and the DSP will handle the difference between the 'Frequency' and the 'LO Frequency'. Active Antenna is the antenna to use for this channel. Correct Impairments applies the correction information of the device to the signal.
inputs:
  "niusrprio session in": "niUsrpRio Config v1 Host.lvlib__niUsrpRio Session.gtype", required
  "sample rate [s/s]": f64 = 10000000
  "frequency [hz]": f64 = 2450000000
  "level [dbm]": f64 = -10  # Reference Level on Rx and Output Power on Tx.
  "error in": error
  "scope": string = "rx", required
  "correct impairments?": bool = TRUE
  "active antenna": string = "RX1"  # is the antenna to use for this channel.
  "lo frequency [hz]": f64 = -1
outputs:
  "niusrprio session out": "niUsrpRio Config v1 Host.lvlib__niUsrpRio Session.gtype"
  "coerced sample rate [s/s]": f64
  "coerced frequency [hz]": f64
  "coerced level [dbm]": f64  # Reference Level on Rx and Output Power on Tx.
  "error out": error
  "coerced vertical range [vpp]": f64  # Valid on Rx only.
  "coerced lo frequency [hz]": f64
types:
  "niInstr Register Bus v0 Host.lvlib__Register Bus Session.gtype" = Queue<"niInstr Register Bus v0 Host.lvlib__Session Data.gtype">
  "Semaphore RefNum.gtype" = i32
  "niUsrpRio Config v1 Host.lvlib__DB Queue Reference.gtype" = Queue<"niUsrpRio Config v1 Host.lvlib__Daughterboard Data.gtype">
  "niUsrpRio Config v1 Host.lvlib__EEPROM Header.gtype" = cluster{"Checksum": u32, "Product Code": u16, "Hardware Current Version": u16, "Hardware Oldest Compatible Version": u16, "EEPROM Map Current Version": u16, "EEPROM Map Oldest Compatible Version": u16, "User Password": string, "Pointer to Factory Header": u32, "Pointer to User Header": u32, "Recommended Interval": u16, "Number of Reserved Bytes": i32, "Number of Daughterboards": u8, "Daughterboard IDs": u16[], "Daughterboard Serial Numbers": string[]}
  "niUsrpRio Config v1 Host.lvlib__EEPROM Device Data Header.gtype" = cluster{"Checksum": u32, "Number of Channels": u8, "Number of Gain Settings": u16[], "Pointer to Characterization Data": u32[], "Number of Reserved Bytes": i32, "Number of Frequencies": u16[]}
  "niUsrpRio Config v1 Host.lvlib__EEPROM Characterization Header.gtype" = cluster{"Checksum": u32, "Date": timestamp, "Temperature": f32, "Misc. Info": string, "Pointer to Device Data Header": u32, "Number of Reserved Bytes": i32}
  "niUsrpRio Config v1 Host.lvlib__Characterization Data.gtype" = cluster{"Gains[dB]": f64[], "Frequencies [Hz]": f64[], "IQ Imbalance Table": "niUsrpRio Config v1 Host.lvlib__IQ Imbalance.gtype"[], "Measured Gains[dB]": f64[][]}
  "niUsrpRio Config v1 Host.lvlib__niUsrpRio Session.gtype" = cluster{"FPGA Interface": any, "RIO Interface Number": u32, "Data Clock Rate": u32, "FPGA Data Clock Rate": u32, "Global Settings Register Bus": "niInstr Register Bus v0 Host.lvlib__Register Bus Session.gtype", "Radio 0 Settings Register Bus": "niInstr Register Bus v0 Host.lvlib__Register Bus Session.gtype", "Radio 1 Settings Register Bus": "niInstr Register Bus v0 Host.lvlib__Register Bus Session.gtype", "Radio Settings Bus Semaphore": "Semaphore RefNum.gtype", "DB Queues": "niUsrpRio Config v1 Host.lvlib__DB Queue Reference.gtype"[], "Characterization Data Valid?": bool, "EEPROM Header": "niUsrpRio Config v1 Host.lvlib__EEPROM Header.gtype", "Device Data Header": "niUsrpRio Config v1 Host.lvlib__EEPROM Device Data Header.gtype", "EEPROM Characterization Header": "niUsrpRio Config v1 Host.lvlib__EEPROM Characterization Header.gtype", "Characterization Data": "niUsrpRio Config v1 Host.lvlib__Characterization Data.gtype"[], "FPGA Current Version": u32, "FPGA Oldest Compatible Version": u32, "Fixed Logic Current Version": u32, "Fixed Logic Oldest Compatible Version": u32, "FPGA Radio Settings Bus Current Version": u32, "FPGA Radio Settings Bus Oldest Compatible Version": u32, "FPGA Board Config Current Version": u32, "FPGA Board Config Oldest Compatible Version": u32, "Daughterboard Clock Rate": u32}
  "Configure Signal Parameters.gtype" = cluster{"gain/level": f64, "sample rate [S/s]": f64, "frequency [Hz]": f64, "LO frequency [Hz]": f64, "active antenna": string}
diagram:
  w1 = "Configure Signal Parameters.gtype" {"gain/level"=0, "sample rate [S/s]"=10000000, "frequency [Hz]"=2450000000, "LO frequency [Hz]"=-1, "active antenna"="RX1"}
  Property Node(instance in=w1, "gain/level"=$"level [dbm]", "sample rate [S/s]"=$"sample rate [s/s]", "frequency [Hz]"=$"frequency [hz]", "LO frequency [Hz]"=$"lo frequency [hz]", "active antenna"=$"active antenna") -> (instance out=w2)
  call "Configure Signal (Common).gvi"(niusrprio session=$"niusrprio session in", signal parameters=w2, configure signal mode="Level", error in=$"error in", scope=$scope, correct impairments?=$"correct impairments?") -> (niusrprio session 2=w3, coerced signal parameters=w4, error out=w5)
  $"niusrprio session out" <- w3
  $"error out" <- w5
  Property Node(instance in=w4) -> ("gain/level"=w6, "sample rate [S/s]"=w7, "frequency [Hz]"=w8, "LO frequency [Hz]"=w9)
  Divide(x=w6, y=10) -> w10
  Power Of 10(x=w10) -> w11
  Divide(x=w11, y=10) -> w12
  Square Root(x=w12) -> w13
  Multiply(w13, 2) -> w14
  $"coerced vertical range [vpp]" <- w14
  $"coerced level [dbm]" <- w6
  $"coerced sample rate [s/s]" <- w7
  $"coerced frequency [hz]" <- w8
  $"coerced lo frequency [hz]" <- w9
