vi "Configure Stream.gvi"   [LabVIEW Communications System Design Suite 2.0.1]
# Configures the stream. This includes configuring the DMA FIFO and the Rx/Tx stream size (in samples).
# Input Parameters
# host FIFO depth is the number of samples of buffering to request on the host. This value is optional and defaults to eight times the 'number of samples'.
# number of samples is finite is used to flag whether this is a continuous acquisition/generation or a finite acquisition/generation.
# number of samples to acquire/generate.
inputs:
  "niusrprio session in": "niUsrpRio Config v1 Host.lvlib__niUsrpRio Session.gtype", required
  "host fifo depth": u32 = 1000000  # is the number of samples of buffering to request on the host. This value is optional and defaults to eight times the number of samples.
  "number of samples is finite": bool  # is used to flag whether this is a continuous acquisition/generation or a finite acquisition/generation.
  "number of samples": u32 = 8192  # to acquire/generate.
  "error in": error
  "scope": string = "rx", required
outputs:
  "niusrprio session out": "niUsrpRio Config v1 Host.lvlib__niUsrpRio Session.gtype"
  "error out": error
panel controls:
  "ConstantData": any
types:
  "niInstr Register Bus v0 Host.lvlib__Register Bus Session.gtype" = Queue<"niInstr Register Bus v0 Host.lvlib__Session Data.gtype">
  "Semaphore RefNum.gtype" = i32
  "niUsrpRio Config v1 Host.lvlib__DB Queue Reference.gtype" = Queue<"niUsrpRio Config v1 Host.lvlib__Daughterboard Data.gtype">
  "niUsrpRio Config v1 Host.lvlib__EEPROM Header.gtype" = cluster{"Checksum": u32, "Product Code": u16, "Hardware Current Version": u16, "Hardware Oldest Compatible Version": u16, "EEPROM Map Current Version": u16, "EEPROM Map Oldest Compatible Version": u16, "User Password": string, "Pointer to Factory Header": u32, "Pointer to User Header": u32, "Recommended Interval": u16, "Number of Reserved Bytes": i32, "Number of Daughterboards": u8, "Daughterboard IDs": u16[], "Daughterboard Serial Numbers": string[]}
  "niUsrpRio Config v1 Host.lvlib__EEPROM Device Data Header.gtype" = cluster{"Checksum": u32, "Number of Channels": u8, "Number of Gain Settings": u16[], "Pointer to Characterization Data": u32[], "Number of Reserved Bytes": i32, "Number of Frequencies": u16[]}
  "niUsrpRio Config v1 Host.lvlib__EEPROM Characterization Header.gtype" = cluster{"Checksum": u32, "Date": timestamp, "Temperature": f32, "Misc. Info": string, "Pointer to Device Data Header": u32, "Number of Reserved Bytes": i32}
  "niUsrpRio Config v1 Host.lvlib__Characterization Data.gtype" = cluster{"Gains[dB]": f64[], "Frequencies [Hz]": f64[], "IQ Imbalance Table": "niUsrpRio Config v1 Host.lvlib__IQ Imbalance.gtype"[], "Measured Gains[dB]": f64[][]}
  "niUsrpRio Config v1 Host.lvlib__niUsrpRio Session.gtype" = cluster{"FPGA Interface": any, "RIO Interface Number": u32, "Data Clock Rate": u32, "FPGA Data Clock Rate": u32, "Global Settings Register Bus": "niInstr Register Bus v0 Host.lvlib__Register Bus Session.gtype", "Radio 0 Settings Register Bus": "niInstr Register Bus v0 Host.lvlib__Register Bus Session.gtype", "Radio 1 Settings Register Bus": "niInstr Register Bus v0 Host.lvlib__Register Bus Session.gtype", "Radio Settings Bus Semaphore": "Semaphore RefNum.gtype", "DB Queues": "niUsrpRio Config v1 Host.lvlib__DB Queue Reference.gtype"[], "Characterization Data Valid?": bool, "EEPROM Header": "niUsrpRio Config v1 Host.lvlib__EEPROM Header.gtype", "Device Data Header": "niUsrpRio Config v1 Host.lvlib__EEPROM Device Data Header.gtype", "EEPROM Characterization Header": "niUsrpRio Config v1 Host.lvlib__EEPROM Characterization Header.gtype", "Characterization Data": "niUsrpRio Config v1 Host.lvlib__Characterization Data.gtype"[], "FPGA Current Version": u32, "FPGA Oldest Compatible Version": u32, "Fixed Logic Current Version": u32, "Fixed Logic Oldest Compatible Version": u32, "FPGA Radio Settings Bus Current Version": u32, "FPGA Radio Settings Bus Oldest Compatible Version": u32, "FPGA Board Config Current Version": u32, "FPGA Board Config Oldest Compatible Version": u32, "Daughterboard Clock Rate": u32}
diagram:
  call "niUsrpRio Config v1 Host.lvlib__Parse Scope.gvi"(niusrprio session in=$"niusrprio session in", error in=$"error in", scope=$scope) -> (niusrprio session out=w1, device subfunction=w2, device subfunction channel=w3, error out=w4)
  $"niusrprio session out" <- w1
  Property Node(instance in=w1) -> ("FPGA Interface"=w5)
  Dynamic Fpga Interface Cast(reference in=w5, type=$ConstantData) -> (reference out=w6)
  Select(s=$"number of samples is finite", t=$"number of samples", f=0) -> w7
  Multiply($"number of samples", 8) -> w8
  Max And Min(x=w8, y=$"host fifo depth") -> (max(x,y)=w9: u32)
  case (w2) {
    frame "tx" {
      Property Node(instance in=w6, "tx.samples to generate"=w7, error in=w4) -> (error out=w12, instance out=w13)
      # Host-to-Target DMA FIFOs are automatically cleared when they are started.  The Host Tx Stream FIFO must be stopped before starting to be cleared.
      case (w3) {
        frame "0", Default {
          Host Fifo Configure Node[FifoName="USRP Resources.grsc\\Tx Stream 0"](depth=w9, error in=w12, reference in=w13) -> (actual depth=w11, error out=w14, reference out=w15)
          Host Fifo Stop Node[FifoName="USRP Resources.grsc\\Tx Stream 0"](error in=w14, reference in=w15) -> (error out=w16, reference out=w17)
          Host Fifo Start Node[FifoName="USRP Resources.grsc\\Tx Stream 0"](error in=w16, reference in=w17) -> (error out=w10)
        }
        frame "1" {
          Host Fifo Configure Node[FifoName="USRP Resources.grsc\\Tx Stream 1"](depth=w9, error in=w12, reference in=w13) -> (actual depth=w11, error out=w18, reference out=w19)
          Host Fifo Stop Node[FifoName="USRP Resources.grsc\\Tx Stream 1"](error in=w18, reference in=w19) -> (error out=w20, reference out=w21)
          Host Fifo Start Node[FifoName="USRP Resources.grsc\\Tx Stream 1"](error in=w20, reference in=w21) -> (error out=w10)
        }
      }
    }
    frame "rx", Default {
      Property Node(instance in=w6, "rx.samples to acquire"=w7, error in=w4) -> (error out=w22, instance out=w23)
      # Reset the DMA FIFO.  Target-to-Host DMA FIFOs are reset when they transition from the started to the stopped state.
      case (w3) {
        frame "0", Default {
          Host Fifo Start Node[FifoName="USRP Resources.grsc\\Rx Stream 0"](error in=w22, reference in=w23) -> (error out=w24, reference out=w25)
          Host Fifo Stop Node[FifoName="USRP Resources.grsc\\Rx Stream 0"](error in=w24, reference in=w25) -> (error out=w26, reference out=w27)
          Host Fifo Configure Node[FifoName="USRP Resources.grsc\\Rx Stream 0"](depth=w9, error in=w26, reference in=w27) -> (actual depth=w11, error out=w28, reference out=w29)
          Host Fifo Start Node[FifoName="USRP Resources.grsc\\Rx Stream 0"](error in=w28, reference in=w29) -> (error out=w10)
        }
        frame "1" {
          Host Fifo Start Node[FifoName="USRP Resources.grsc\\Rx Stream 1"](error in=w22, reference in=w23) -> (error out=w30, reference out=w31)
          Host Fifo Stop Node[FifoName="USRP Resources.grsc\\Rx Stream 1"](error in=w30, reference in=w31) -> (error out=w32, reference out=w33)
          Host Fifo Configure Node[FifoName="USRP Resources.grsc\\Rx Stream 1"](depth=w9, error in=w32, reference in=w33) -> (actual depth=w11, error out=w34, reference out=w35)
          Host Fifo Start Node[FifoName="USRP Resources.grsc\\Rx Stream 1"](error in=w34, reference in=w35) -> (error out=w10)
        }
      }
    }
  }
  Is Greater Or Equal(x=w11, y=w9) -> w36
  w37 = """-1: Unable to allocate enough memory for the host FIFO.

Requested FIFO size to allocate: %d samples
Actual FIFO size allocated: %d samples

Retry with a smaller number of samples to acquire/generate or provide a value for the host FIFO depth input. Note that host FIFO size must be greater-than-or-equal to the number of samples to acquire/generate."""
  Format Into String(formatString=w37, w9, w11) -> w38
  call "Error Cluster From Error Code.gvi"(error code=-1, error message=w38, show call chain?=TRUE, is warning?=FALSE) -> (error out=w39)
  Select(s=w36, t=no error, f=w39) -> w40
  Merge Errors(w10, w40) -> (error out=w41)
  $"error out" <- w41
