vi "Initiate Stream.gvi"   [LabVIEW Communications System Design Suite 2.0.1]
# Initiates the stream. This is required before you acquire/generate data with the Fetch Rx Data or Write Tx Data VIs. Initiation includes resetting the Rx/Tx streams and the DSP. Multi-device usage: Initiate the master device last, after initiating all the slave devices. Input Parameters niUsrpRio Session is the object created by the Open VI and used as the session handle for the USRP RIO design library. scope is the channel on which stream is to be initiated. The options are "rx/RF 0", "rx/RF 1", "tx/RF 0", and "tx/RF 1". error in describes error conditions that occur before this node runs. This input provides standard 'error in' functionality. Output Parameters niUsrpRio Session (out) is the niUsrpRio session used in all subsequent USRP RIO design library host VIs. error out contains error information. This output provides standard 'error out' functionality.
inputs:
  "niusrprio session in": "niUsrpRio Config v1 Host.lvlib__niUsrpRio Session.gtype", required
  "error in": error
  "scope": string = "rx", required  # is the channel on which stream is to be initiated. The options are "rx/RF 0", "rx/RF 1", "tx/RF 0", and "tx/RF 1".
outputs:
  "niusrprio session out": "niUsrpRio Config v1 Host.lvlib__niUsrpRio Session.gtype"
  "error out": error
types:
  "niInstr Register Bus v0 Host.lvlib__Register Bus Session.gtype" = Queue<"niInstr Register Bus v0 Host.lvlib__Session Data.gtype">
  "Semaphore RefNum.gtype" = i32
  "niUsrpRio Config v1 Host.lvlib__DB Queue Reference.gtype" = Queue<"niUsrpRio Config v1 Host.lvlib__Daughterboard Data.gtype">
  "niUsrpRio Config v1 Host.lvlib__EEPROM Header.gtype" = cluster{"Checksum": u32, "Product Code": u16, "Hardware Current Version": u16, "Hardware Oldest Compatible Version": u16, "EEPROM Map Current Version": u16, "EEPROM Map Oldest Compatible Version": u16, "User Password": string, "Pointer to Factory Header": u32, "Pointer to User Header": u32, "Recommended Interval": u16, "Number of Reserved Bytes": i32, "Number of Daughterboards": u8, "Daughterboard IDs": u16[], "Daughterboard Serial Numbers": string[]}
  "niUsrpRio Config v1 Host.lvlib__EEPROM Device Data Header.gtype" = cluster{"Checksum": u32, "Number of Channels": u8, "Number of Gain Settings": u16[], "Pointer to Characterization Data": u32[], "Number of Reserved Bytes": i32, "Number of Frequencies": u16[]}
  "niUsrpRio Config v1 Host.lvlib__EEPROM Characterization Header.gtype" = cluster{"Checksum": u32, "Date": timestamp, "Temperature": f32, "Misc. Info": string, "Pointer to Device Data Header": u32, "Number of Reserved Bytes": i32}
  "niUsrpRio Config v1 Host.lvlib__Characterization Data.gtype" = cluster{"Gains[dB]": f64[], "Frequencies [Hz]": f64[], "IQ Imbalance Table": "niUsrpRio Config v1 Host.lvlib__IQ Imbalance.gtype"[], "Measured Gains[dB]": f64[][]}
  "niUsrpRio Config v1 Host.lvlib__niUsrpRio Session.gtype" = cluster{"FPGA Interface": any, "RIO Interface Number": u32, "Data Clock Rate": u32, "FPGA Data Clock Rate": u32, "Global Settings Register Bus": "niInstr Register Bus v0 Host.lvlib__Register Bus Session.gtype", "Radio 0 Settings Register Bus": "niInstr Register Bus v0 Host.lvlib__Register Bus Session.gtype", "Radio 1 Settings Register Bus": "niInstr Register Bus v0 Host.lvlib__Register Bus Session.gtype", "Radio Settings Bus Semaphore": "Semaphore RefNum.gtype", "DB Queues": "niUsrpRio Config v1 Host.lvlib__DB Queue Reference.gtype"[], "Characterization Data Valid?": bool, "EEPROM Header": "niUsrpRio Config v1 Host.lvlib__EEPROM Header.gtype", "Device Data Header": "niUsrpRio Config v1 Host.lvlib__EEPROM Device Data Header.gtype", "EEPROM Characterization Header": "niUsrpRio Config v1 Host.lvlib__EEPROM Characterization Header.gtype", "Characterization Data": "niUsrpRio Config v1 Host.lvlib__Characterization Data.gtype"[], "FPGA Current Version": u32, "FPGA Oldest Compatible Version": u32, "Fixed Logic Current Version": u32, "Fixed Logic Oldest Compatible Version": u32, "FPGA Radio Settings Bus Current Version": u32, "FPGA Radio Settings Bus Oldest Compatible Version": u32, "FPGA Board Config Current Version": u32, "FPGA Board Config Oldest Compatible Version": u32, "Daughterboard Clock Rate": u32}
diagram:
  call "niUsrpRio Config v1 Host.lvlib__Parse Scope.gvi"(niusrprio session in=$"niusrprio session in", error in=$"error in", scope=$scope) -> (niusrprio session out=w1, device subfunction=w2, device subfunction channel=w3, error out=w4)
  $"niusrprio session out" <- w1
  Property Node(instance in=w1) -> ("FPGA Interface"=w5)
  Dynamic Fpga Interface Cast(reference in=w5, type="802.11 FGPA Reference.gtype" constant) -> (reference out=w6)
  case (w2) {
    frame "tx" {
      Property Node(instance in=w6, "tx 0.stream enable"=FALSE, "tx 1.stream enable"=FALSE, error in=w4) -> (error out=w8, instance out=w9)
      # an extra read transaction adds delay to ensure the reset propagates to the dsp logic and the reset done indicator
      Property Node(instance in=w9, "tx.abort"=FALSE, error in=w8) -> (error out=w10, instance out=w11)
      Property Node(instance in=w11, "tx.reset"=TRUE, "tx.reset"=FALSE, error in=w10) -> (error out=w12, instance out=w13)
      # wait for DSP to reset
      s1 = FALSE  # shift register
      while (iteration -> i1) {
        Property Node(instance in=w13, error in=w12) -> ("tx.dsp reset done"=w14, error out=w15, instance out=w16)
        Logical Or(w15, w14, s1) -> w17
        Is Equal To 0(x=i1) -> w18
        # using a shift register ensures the loop runs once more after a timeout in case this thread went to sleep
        call "Elapsed Time.gvi"(Time Target (s)=1, Reset=w18) -> (Time has Elapsed=w19)
        next s1 = w19
        stop if w17
      }
      call "Error Cluster From Error Code.gvi"(error code=-1, error message="-1: Tx DSP failed to reset within time limit.", show call chain?=TRUE, is warning?=FALSE) -> (error out=w20)
      Select(s=w14, t=no error, f=w20) -> w21
      Merge Errors(w15, w21) -> (error out=w22)
      case (w3) {
        frame "0", Default {
          Property Node(instance in=w16, "tx 0.stream enable"=TRUE, error in=w22) -> (error out=w7, instance out=w23)
        }
        frame "All" {
          Property Node(instance in=w16, "tx 0.stream enable"=TRUE, "tx 1.stream enable"=TRUE, error in=w22) -> (error out=w7, instance out=w24)
        }
        frame "1" {
          Property Node(instance in=w16, "tx 1.stream enable"=TRUE, error in=w22) -> (error out=w7, instance out=w25)
        }
      }
    }
    frame "rx", Default {
      Property Node(instance in=w6, "rx 0.stream enable"=FALSE, "rx 1.stream enable"=FALSE, error in=w4) -> (error out=w26, instance out=w27)
      # an extra read transaction adds delay to ensure the reset propagates to the dsp logic and the reset done indicator
      Property Node(instance in=w27, "rx.abort"=FALSE, error in=w26) -> (error out=w28, instance out=w29)
      Property Node(instance in=w29, "rx.reset"=TRUE, "rx.reset"=FALSE, error in=w28) -> (error out=w30, instance out=w31)
      # wait for DSP to reset
      s2 = FALSE  # shift register
      while (iteration -> i2) {
        Property Node(instance in=w31, error in=w30) -> ("rx.dsp reset done"=w32, error out=w33, instance out=w34)
        call "Is Error.gvi"(error in=w33) -> (is error?=w35)
        Logical Or(w35, w32, s2) -> w36
        Is Equal To 0(x=i2) -> w37
        # using a shift register ensures the loop runs once more after a timeout in case this thread went to sleep
        call "Elapsed Time.gvi"(Time Target (s)=1, Reset=w37) -> (Time has Elapsed=w38)
        next s2 = w38
        stop if w36
      }
      call "Error Cluster From Error Code.gvi"(error code=-1, error message="-1: Rx DSP failed to reset within time limit.", show call chain?=TRUE, is warning?=FALSE) -> (error out=w39)
      Select(s=w32, t=no error, f=w39) -> w40
      Merge Errors(w33, w40) -> (error out=w41)
      case (w3) {
        frame "0", Default {
          Property Node(instance in=w34, "rx 0.stream enable"=TRUE, error in=w41) -> (error out=w7, instance out=w42)
        }
        frame "All" {
          Property Node(instance in=w34, "rx 0.stream enable"=TRUE, "rx 1.stream enable"=TRUE, error in=w41) -> (error out=w7, instance out=w43)
        }
        frame "1" {
          Property Node(instance in=w34, "rx 1.stream enable"=TRUE, error in=w41) -> (error out=w7, instance out=w44)
        }
      }
    }
  }
  $"error out" <- w7
